# Grasshopper definition MYST_FeasibilityMatrix.gh (Grasshopper 1.0.7)
# plug-ins: GrasshopperChimera, Human UI, LunchBox, Wombat, treesloth01, Pufferfish, MetaHopper, Heteroptera, Human, Sasquatch

getdatakey = GetDataKey(
    KeyNames="Project_Information/AE_Civil_Leads: List of AECivilLead: String",
    TreeItem="a5c2a799-f98a-41d3-a65b-a890dc2617ad|-1;32821af2-a2c2-4d30-8784-e2fbaccc0928|-1;",
    rootIds="a5c2a799-f98a-41d3-a65b-a890dc2617ad|-1;32821af2-a2c2-4d30-8784-e2fbaccc0928|-1;||C:\Users\sdanilow\AppData\Roaming\McNeel\Rhinoceros\packages\7.0\MYST - Ryan Companies\3.1.2.0\Chimera Definition Files\MYSTv3_WIP.chi")
getdatakey_2 = GetDataKey(
    KeyNames="Project_Information/AE_Design_Leads: List of AEDesignLead: String",
    TreeItem="a5c2a799-f98a-41d3-a65b-a890dc2617ad|-1;25b452fe-b34d-4875-89f0-e5ba2b6e8da2|-1;",
    rootIds="a5c2a799-f98a-41d3-a65b-a890dc2617ad|-1;25b452fe-b34d-4875-89f0-e5ba2b6e8da2|-1;||C:\Users\sdanilow\AppData\Roaming\McNeel\Rhinoceros\packages\7.0\MYST - Ryan Companies\3.1.2.0\Chimera Definition Files\MYSTv3_WIP.chi")
getdatakey_3 = GetDataKey(
    KeyNames="Project_Information/Construction_Leads: List of Construction_Lead: String",
    TreeItem="a5c2a799-f98a-41d3-a65b-a890dc2617ad|-1;6fcf1f52-63e5-4d0d-ab0b-ccb805f63e70|-1;",
    rootIds="a5c2a799-f98a-41d3-a65b-a890dc2617ad|-1;6fcf1f52-63e5-4d0d-ab0b-ccb805f63e70|-1;||C:\Users\sdanilow\AppData\Roaming\McNeel\Rhinoceros\packages\7.0\MYST - Ryan Companies\3.1.2.0\Chimera Definition Files\MYSTv3_WIP.chi")
getdatakey_4 = GetDataKey(
    KeyNames="Project_Information/Development_Leads: List of Development_Lead: String",
    TreeItem="a5c2a799-f98a-41d3-a65b-a890dc2617ad|-1;cb5718b5-8b43-4e06-8f7f-262ff03d74fe|-1;",
    rootIds="a5c2a799-f98a-41d3-a65b-a890dc2617ad|-1;cb5718b5-8b43-4e06-8f7f-262ff03d74fe|-1;||C:\Users\sdanilow\AppData\Roaming\McNeel\Rhinoceros\packages\7.0\MYST - Ryan Companies\3.1.2.0\Chimera Definition Files\MYSTv3_WIP.chi")
getdatakey_5 = GetDataKey(
    KeyNames="Project_Information/Project_Location: String",
    TreeItem="a5c2a799-f98a-41d3-a65b-a890dc2617ad|-1;65546c57-1d23-44a5-8594-26c84122076a|-1;",
    rootIds="a5c2a799-f98a-41d3-a65b-a890dc2617ad|-1;65546c57-1d23-44a5-8594-26c84122076a|-1;||C:\Users\sdanilow\AppData\Roaming\McNeel\Rhinoceros\packages\7.0\MYST - Ryan Companies\3.1.2.0\Chimera Definition Files\MYSTv3_WIP.chi")
getdatakey_6 = GetDataKey(
    KeyNames="Project_Information/Project_Name: String",
    TreeItem="a5c2a799-f98a-41d3-a65b-a890dc2617ad|-1;5ee02f7e-780f-48bd-8964-016ad86c9144|-1;",
    rootIds="a5c2a799-f98a-41d3-a65b-a890dc2617ad|-1;5ee02f7e-780f-48bd-8964-016ad86c9144|-1;||C:\Users\sdanilow\AppData\Roaming\McNeel\Rhinoceros\packages\7.0\MYST - Ryan Companies\3.1.2.0\Chimera Definition Files\MYSTv3_WIP.chi")
readdocumentdata = ReadDocumentData(DataKeyOptional=getdatakey_6)
readdocumentdata_2 = ReadDocumentData(DataKeyOptional=getdatakey_5)
readdocumentdata_3 = ReadDocumentData(DataKeyOptional=getdatakey_4)
readdocumentdata_4 = ReadDocumentData(DataKeyOptional=getdatakey_3)
readdocumentdata_5 = ReadDocumentData(DataKeyOptional=getdatakey_2)
readdocumentdata_6 = ReadDocumentData(DataKeyOptional=getdatakey)
getdatakey_7 = GetDataKey(TreeItem="b74d9c63-0a81-4c72-bb23-7d0cfe223454|-1;473a1067-9aed-4d5d-8ba9-4ce4e52f639f|-1;")

# ---- group: Minimize Grasshopper
c_script = CSharpScript(x=Toggle(True))  # -> out; inputs x: Boolean
# ---------- c_script: C# ----------
    if (x)
    {
      Grasshopper.Instances.DocumentEditor.WindowState = System.Windows.Forms.FormWindowState.Minimized;
    }
# ---------- end c_script ----------

# ----
getdatakey_8 = GetDataKey(TreeItem="8691b996-e2d5-4e74-b9d5-24f2abd54ece|-1;")
getdatakey_9 = GetDataKey(
    KeyNames="Document_Libraries/Material_Library_List: List of Material: Species",
    TreeItem="bf708b74-0dae-42b1-a209-c24051da8914|-1;d8075df0-f773-4986-b77f-d02adf046b34|-1;",
    rootIds="bf708b74-0dae-42b1-a209-c24051da8914|-1;d8075df0-f773-4986-b77f-d02adf046b34|-1;||C:\Users\sdanilow\AppData\Roaming\McNeel\Rhinoceros\packages\7.0\MYST - Ryan Companies\3.1.2.0\Chimera Definition Files\MYSTv3_WIP.chi")
readdocumentdata_7 = ReadDocumentData(DataKeyOptional=getdatakey_9)
get_data_value = GetDataValue(ChimeraData=readdocumentdata)
get_data_value_2 = GetDataValue(ChimeraData=readdocumentdata_2)
get_data_value_3 = GetDataValue(ChimeraData=readdocumentdata_4)
get_data_value_4 = GetDataValue(ChimeraData=readdocumentdata_5)
get_data_value_5 = GetDataValue(ChimeraData=readdocumentdata_3)
get_data_value_6 = GetDataValue(ChimeraData=readdocumentdata_6)
getdatakey_10 = GetDataKey(TreeItem="6a55d2d9-ee28-477b-a0d4-48a84f2b3a50|-1;3443d855-81b7-4d64-8efe-1af2de4e8668|-1;")
getdatakey_11 = GetDataKey(TreeItem="b74d9c63-0a81-4c72-bb23-7d0cfe223454|-1;c52f7483-d725-4c42-8378-d2ee2f8a3366|-1;")
getdatakey_12 = GetDataKey(TreeItem="b74d9c63-0a81-4c72-bb23-7d0cfe223454|-1;29d28d6e-c544-434a-a5c4-d81229ecca41|-1;")
getdatakey_13 = GetDataKey(TreeItem="b74d9c63-0a81-4c72-bb23-7d0cfe223454|-1;829d644e-c9f6-4fcd-b2cd-fc78829fa806|-1;")
getdatakey_14 = GetDataKey(TreeItem="b74d9c63-0a81-4c72-bb23-7d0cfe223454|-1;7cf74ad9-353b-4f9e-a89a-a118abd8da5f|-1;")
getdatakey_15 = GetDataKey(TreeItem="b74d9c63-0a81-4c72-bb23-7d0cfe223454|-1;2db2527d-972b-462a-8322-2de676e6aca6|-1;")
getdatakey_16 = GetDataKey(TreeItem="5bdaacf8-d290-4e40-bc6c-2b160cde33ea|-1;45ec1215-e8bb-4ee5-9cc8-028e22539836|-1;")
getdatakey_17 = GetDataKey(
    KeyNames="Building/Building_Height: Double",
    TreeItem="8691b996-e2d5-4e74-b9d5-24f2abd54ece|-1;797a644f-4a36-44ef-94b1-def5c667c64b|-1;",
    rootIds="8691b996-e2d5-4e74-b9d5-24f2abd54ece|-1;797a644f-4a36-44ef-94b1-def5c667c64b|-1;||C:\Users\sdanilow\AppData\Roaming\McNeel\Rhinoceros\packages\7.0\MYST - Ryan Companies\3.1.0.0\Chimera Definition Files\MYSTv3_WIP.chi")
getdatakey_18 = GetDataKey(TreeItem="8691b996-e2d5-4e74-b9d5-24f2abd54ece|-1;c52f7483-d725-4c42-8378-d2ee2f8a3366|-1;")
getdatakey_19 = GetDataKey(TreeItem="a42c566e-7024-4aec-86d8-1fd0712f80bc|-1;3a974da7-a976-4be8-ba59-aeeabfbce269|-1;")
getdatakey_20 = GetDataKey(TreeItem="a42c566e-7024-4aec-86d8-1fd0712f80bc|-1;ba75923e-712b-4fbd-b959-b3dda30ed4ae|-1;")
getdatakey_21 = GetDataKey(TreeItem="8691b996-e2d5-4e74-b9d5-24f2abd54ece|-1;829d644e-c9f6-4fcd-b2cd-fc78829fa806|-1;")
getdatakey_22 = GetDataKey(TreeItem="a42c566e-7024-4aec-86d8-1fd0712f80bc|-1;3a974da7-a976-4be8-ba59-aeeabfbce269|-1;")
getscriptproperty = GetScriptProperty(IsDocumentProperty=True, TreeItem="bf708b74-0dae-42b1-a209-c24051da8914|-1;32f42984-24c4-4690-80c8-463d60055c81|-1;")
getdatakey_23 = GetDataKey(TreeItem="a42c566e-7024-4aec-86d8-1fd0712f80bc|-1;3a974da7-a976-4be8-ba59-aeeabfbce269|-1;")
getdatakey_24 = GetDataKey(TreeItem="a42c566e-7024-4aec-86d8-1fd0712f80bc|-1;3a974da7-a976-4be8-ba59-aeeabfbce269|-1;")
getdatakey_25 = GetDataKey(TreeItem="b19ebb98-eeaf-4d91-9977-387d15bf1ac0|-1;6a1fd12f-c9e4-49b8-88b1-f434c07b4760|-1;")
getdatakey_26 = GetDataKey(TreeItem="b19ebb98-eeaf-4d91-9977-387d15bf1ac0|-1;c2dc43de-8586-478b-af2d-e70fdada3b7d|-1;")
getenumvalues = GetEnumValues(EnumDefinitionKey=getdatakey_10)
getchilddata = GetChildData(ChimeraData=readdocumentdata_7, ChildDefinitionKeyOptional=getdatakey_25)
getchilddata_2 = GetChildData(ChimeraData=readdocumentdata_7, ChildDefinitionKeyOptional=getdatakey_26)
get_data_value_7 = GetDataValue(ChimeraData=getscriptproperty)
getdatakey_27 = GetDataKey(TreeItem="d7e3a77d-8ac4-447f-8dd1-b6f6add1243f|-1;")
getdatakey_28 = GetDataKey(TreeItem="6a1fd12f-c9e4-49b8-88b1-f434c07b4760|-1;")
getchilddata_3 = GetChildData(ChimeraData=get_data_value_7, ChildDefinitionKeyOptional=getdatakey_27)
getchilddata_4 = GetChildData(ChimeraData=get_data_value_7, ChildDefinitionKeyOptional=getdatakey_28)
getdatakey_29 = GetDataKey(TreeItem="29550054-10bd-4263-af17-94f2a7dadb06|-1;6a1fd12f-c9e4-49b8-88b1-f434c07b4760|-1;")
getdatakey_30 = GetDataKey(TreeItem="29550054-10bd-4263-af17-94f2a7dadb06|-1;5e1c33d2-1b94-49cf-a08f-2a17639c52f2|-1;")
list_item = ListItem(List=getenumvalues, Index=0, Wrap=True)  # -> Item, Item1, Item2, Item3, Item4, Item5, Item6, Item7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
get_data_value_8 = GetDataValue(ChimeraData=getchilddata_2)
get_data_value_9 = GetDataValue(ChimeraData=getchilddata)
getdatakey_31 = GetDataKey(TreeItem="6a1fd12f-c9e4-49b8-88b1-f434c07b4760|-1;")
getdatakey_32 = GetDataKey(TreeItem="5e1c33d2-1b94-49cf-a08f-2a17639c52f2|-1;")
getdatakey_33 = GetDataKey(TreeItem="47d23fe7-f588-4660-b856-7917a8ced1b2|-1;")
getdatakey_34 = GetDataKey(TreeItem="253ef6d7-c2b0-4279-9aca-7be702290c35|-1;")
getdatakey_35 = GetDataKey(TreeItem="6a1fd12f-c9e4-49b8-88b1-f434c07b4760|-1;")
get_data_value_10 = GetDataValue(ChimeraData=getchilddata_3)
get_data_value_11 = GetDataValue(ChimeraData=getchilddata_4)
number = Number(0)
number_2 = Number(0)
getdatakey_36 = GetDataKey(
    KeyNames="Area/Typology: Enumeration",
    TreeItem="6a55d2d9-ee28-477b-a0d4-48a84f2b3a50|-1;3443d855-81b7-4d64-8efe-1af2de4e8668|-1;",
    rootIds="6a55d2d9-ee28-477b-a0d4-48a84f2b3a50|-1;3443d855-81b7-4d64-8efe-1af2de4e8668|-1;||C:\Users\sdanilow\Ryan Companies US, Inc\Ryan Rhino Resources - Documents\Massing Yield Study Tool (MYST)\MYSTv3\Chimera Definition Files\MYSTv3_WIP.chi")
getdatakey_37 = GetDataKey(
    KeyNames="Area/Area_Name: String",
    TreeItem="6a55d2d9-ee28-477b-a0d4-48a84f2b3a50|-1;a64d03de-ca92-4694-9c46-79f5d73b0afe|-1;",
    rootIds="6a55d2d9-ee28-477b-a0d4-48a84f2b3a50|-1;a64d03de-ca92-4694-9c46-79f5d73b0afe|-1;||C:\Users\sdanilow\Ryan Companies US, Inc\Ryan Rhino Resources - Documents\Massing Yield Study Tool (MYST)\MYSTv3\Chimera Definition Files\MYSTv3_WIP.chi")
getenumvalues_2 = GetEnumValues(EnumDefinitionKey=getdatakey_36)
number_3 = Number(0)
layer_table = LayerTable(Update=True, AutoUpdate=False)  # -> Layers, FullLayerPaths, LayerColors, Linetypes, MaterialNames, Visible, PrintWidth, PrintColor
boolean_toggle = BooleanToggle(True)

# ---- group: Project Information
panel = Panel("Project Name:")
panel_2 = Panel("Project Location:")
panel_3 = Panel("Development Lead(s):")
panel_4 = Panel("Construction Lead(s):")
panel_5 = Panel("A+E Design Lead(s):")
panel_6 = Panel("A+E Civil Lead(s):")
create_text_block = CreateTextBlock(Text=panel_3, TextSize=18, Justification=0)
create_label = CreateLabel(LabelText=panel, LabelSize=18, Justification=0)
create_label_2 = CreateLabel(LabelText=panel, LabelSize=18, Justification=0)
create_label_3 = CreateLabel(LabelText=panel_2, LabelSize=18, Justification=0)
create_text_block_2 = CreateTextBlock(Text=panel_4, TextSize=18, Justification=0)
create_label_4 = CreateLabel(LabelText=panel_2, LabelSize=18, Justification=0)
set_label_contents = SetLabelContents(LabelToModify=create_label_2, NewLabelContents=get_data_value)
set_label_contents_2 = SetLabelContents(LabelToModify=create_label_4, NewLabelContents=get_data_value_2)
create_label_5 = CreateLabel(LabelText=panel_3, LabelSize=18, Justification=0)
create_text_block_3 = CreateTextBlock(Text=panel_6, TextSize=18, Justification=0)
create_text_block_4 = CreateTextBlock(Text=panel_5, TextSize=18, Justification=0)
create_label_6 = CreateLabel(LabelText=panel_4, LabelSize=18, Justification=0)
cluster = Cluster_3(text=get_data_value_3)
cluster_2 = Cluster_3(text=get_data_value_5)
create_label_7 = CreateLabel(LabelText=panel_5, LabelSize=18, Justification=0)
create_label_8 = CreateLabel(LabelText=panel_6, LabelSize=18, Justification=0)
cluster_3 = Cluster_3(text=get_data_value_6)
cluster_4 = Cluster_3(text=get_data_value_4)
create_label_9 = CreateLabel(LabelText="Project Information", LabelSize=24, Justification=0)
set_textblock_contents = SetTextBlockContents(TextBlockToModify=create_text_block, NewTextBlockContents=cluster_2)
entwine = Entwine(Branch00=create_label_3, Branch01=create_label_4, FlattenInputs=True)  # -> flatten(Result)
set_textblock_contents_2 = SetTextBlockContents(TextBlockToModify=create_text_block_2, NewTextBlockContents=cluster)
entwine_2 = Entwine(Branch00=create_label_5, Branch01=create_text_block, FlattenInputs=True)  # -> flatten(Result)
set_textblock_contents_3 = SetTextBlockContents(TextBlockToModify=create_text_block_3, NewTextBlockContents=cluster_3)
set_textblock_contents_4 = SetTextBlockContents(TextBlockToModify=create_text_block_4, NewTextBlockContents=cluster_4)
entwine_3 = Entwine(Branch00=create_label, Branch01=create_label_2, FlattenInputs=True)  # -> flatten(Result)
entwine_4 = Entwine(Branch00=create_label_6, Branch01=create_text_block_2, FlattenInputs=True)  # -> flatten(Result)
entwine_5 = Entwine(Branch00=create_label_7, Branch01=create_text_block_4, FlattenInputs=True)  # -> flatten(Result)
entwine_6 = Entwine(Branch00=create_label_8, Branch01=create_text_block_3, FlattenInputs=True)  # -> flatten(Result)
create_wrappanel = CreateWrapPanel(UIElements=entwine, Horizontal=False)
create_wrappanel_2 = CreateWrapPanel(UIElements=entwine_2, Horizontal=False)
create_wrappanel_3 = CreateWrapPanel(UIElements=entwine_4, Horizontal=False)
create_wrappanel_4 = CreateWrapPanel(UIElements=entwine_3, Horizontal=False)
create_wrappanel_5 = CreateWrapPanel(UIElements=entwine_5, Horizontal=False)
create_wrappanel_6 = CreateWrapPanel(UIElements=entwine_6, Horizontal=False)
create_border = CreateBorder(UIElement=create_wrappanel_2, BorderThickness=1, BorderColor=RGB(0, 0, 0), CornerRadius=0)
create_border_2 = CreateBorder(UIElement=create_wrappanel_4, BorderThickness=1, BorderColor=RGB(0, 0, 0), CornerRadius=0)
create_border_3 = CreateBorder(UIElement=create_wrappanel, BorderThickness=1, BorderColor=RGB(0, 0, 0), CornerRadius=0)
create_border_4 = CreateBorder(UIElement=create_wrappanel_3, BorderThickness=1, BorderColor=RGB(0, 0, 0), CornerRadius=0)
create_border_5 = CreateBorder(UIElement=create_wrappanel_5, BorderThickness=1, BorderColor=RGB(0, 0, 0), CornerRadius=0)
create_border_6 = CreateBorder(UIElement=create_wrappanel_6, BorderThickness=1, BorderColor=RGB(0, 0, 0), CornerRadius=0)
entwine_7 = Entwine(
    Branch00=create_border_2,
    Branch01=create_border_3,
    Branch02=create_border,
    Branch03=create_border_4,
    Branch04=create_border_5,
    Branch05=create_border_6,
    FlattenInputs=True)  # -> flatten(Result)
create_wrappanel_7 = CreateWrapPanel(UIElements=entwine_7, Horizontal=True)
entwine_8 = Entwine(Branch00=create_label_9, Branch01=create_wrappanel_7, FlattenInputs=True)

# ----
create_separator = CreateSeparator(Thickness=0.5, Horizontal=True, Color=RGB(0, 0, 0))
create_separator_2 = CreateSeparator(Thickness=0.5, Horizontal=True, Color=RGB(0, 0, 0))

create_true_only_button = CreateTrueOnlyButton(ButtonName="Bake Geometry", ButtonStyle=0)
adjust_element_positioning = AdjustElementPositioning(
    ElementsToAdjust=create_true_only_button,
    AbsolutePositioning=False,
    Width=Slider(260, range=0..1000),
    Height=Slider(48, range=0..1000))
adjust_element_appearance = AdjustElementAppearance(ElementsToAdjust=create_true_only_button, FontSize=Slider(24, range=0..100))
value_listener = ValueListener(Elements=create_true_only_button, SomeProperty=True)  # -> Values, Indices

# ---- group: Save Report Window
panel_7 = Panel("""Roadway Surfaces
Roadway Parking Surfaces
Surface Parking Surfaces
Stormwater Retention Surfaces
Landscaping Surfaces
Building Mass
Floor Masses
Area Masses""")
create_button = CreateButton(ButtonName="Cancel", ButtonStyle=0)
create_button_2 = CreateButton(ButtonName="Bake Selected", ButtonStyle=0)
create_checklist = CreateChecklist(ChecklistItems=panel_7, Selected=False)
value_listener_2 = ValueListener(Elements=create_button, SomeProperty=True)  # -> Values, Indices
invert_boolean = InvertBoolean(Boolean=value_listener_2.Values)  # -> Inverted, Number
value_listener_3 = ValueListener(Elements=create_button_2, SomeProperty=True)  # -> Values, Indices
invert_boolean_2 = InvertBoolean(Boolean=value_listener_3.Values)  # -> Inverted, Number
gate_or = GateOr(A=invert_boolean_2.Inverted, B=invert_boolean.Inverted)
value_listener_4 = ValueListener(Elements=create_checklist, Trigger=value_listener_3.Values, SomeProperty=False)  # -> flatten(Values), Indices
merge = Merge(Data1=create_button_2, Data2=create_button)
enable_disable_object = EnableDisableObject(Enabled=gate_or, AllObjects_Object=create_true_only_button)
create_wrappanel_8 = CreateWrapPanel(UIElements=merge, Horizontal=True)
merge_2 = Merge(Data1=create_checklist, Data2=create_wrappanel_8)
cd_humanui_brand = CDHumanUIBrand(elements=merge_2)  # -> elements_4, font_family_2, accent_colors_2
launch_window = LaunchWindow(
    Show=value_listener.Values,
    Name="Bake Geometry",
    Width=370,
    Height=Slider(350, range=0..1000),
    FontFamily=cd_humanui_brand.font_family_2,
    ChildStatus=1,
    EnableHorizScroll=False)
add_elements = AddElements(Window=launch_window, Elements=flatten(cd_humanui_brand.elements_4), DoVLChecking=True)  # -> AddedElements, ElementNames
set_window_properties = SetWindowProperties(Window=launch_window, AccentColor=cd_humanui_brand.accent_colors_2, ShowTitleBar=True, ScaleFactor=1)

# ---- group: Bake Controller
enable_disable_object_2 = EnableDisableObject(Enabled=value_listener_3.Values, AllObjects_Object=list_item_2)
list_item_2 = ListItem(List=value_listener_4.Values, Index=0, Wrap=True)  # -> Item, Item1, Item2, Item3, Item4, Item5, Item6, Item7; disabled
roadway_surfaces = Data(list_item_2.Item)
roadway_parking_surfaces = Data(list_item_2.Item1)
surface_parking_surfaces = Data(list_item_2.Item2)
stormwater_retention_surfaces = Data(list_item_2.Item3)
landscaping_surfaces = Data(list_item_2.Item4)
building_mass = Data(list_item_2.Item5)
floor_masses = Data(list_item_2.Item6)
area_masses = Data(list_item_2.Item7)

# ----
create_file_picker = CreateFilePicker(ButtonLabelText="Set File Path", DialogType=1, MustExist=False, Filter="CSV Files|*.csv")
create_button_3 = CreateButton(ButtonName="Export CSV", ButtonStyle=0)
merge_3 = Merge(Data1=create_file_picker, Data2=create_button_3)
adjust_element_appearance_2 = AdjustElementAppearance(ElementsToAdjust=merge_3, FontSize=Slider(24, range=0..100))
adjust_element_positioning_2 = AdjustElementPositioning(ElementsToAdjust=merge_3, AbsolutePositioning=False, Width=Slider(260, range=0..1000), Height=Slider(48, range=0..1000))
value_listener_5 = ValueListener(Elements=create_button_3, SomeProperty=True)  # -> Values, Indices
value_listener_6 = ValueListener(Elements=create_file_picker, SomeProperty=True)  # -> Values, Indices
merge_4 = Merge(Data1=create_file_picker, Data2=create_button_3)
create_wrappanel_9 = CreateWrapPanel(UIElements=merge_4, Horizontal=True)

create_button_4 = CreateButton(ButtonName="Recalcuate", ButtonStyle=0)
adjust_element_positioning_3 = AdjustElementPositioning(
    ElementsToAdjust=create_button_4,
    AbsolutePositioning=False,
    Width=Slider(260, range=0..1000),
    Height=Slider(48, range=0..1000))
adjust_element_appearance_3 = AdjustElementAppearance(ElementsToAdjust=create_button_4, FontSize=Slider(24, range=0..100))
value_listener_7 = ValueListener(Elements=create_button_4, SomeProperty=True)  # -> Values, Indices
invert_boolean_3 = InvertBoolean(Boolean=value_listener_7.Values)  # -> Inverted, Number

getscriptproperty_2 = GetScriptProperty(
    IsDocumentProperty=True,
    KeyNames="Project_Information/Project_Name: String",
    TreeItem="a5c2a799-f98a-41d3-a65b-a890dc2617ad|-1;5ee02f7e-780f-48bd-8964-016ad86c9144|-1;",
    rootIds="a5c2a799-f98a-41d3-a65b-a890dc2617ad|-1;5ee02f7e-780f-48bd-8964-016ad86c9144|-1;||C:\Users\sdanilow\AppData\Roaming\McNeel\Rhinoceros\packages\7.0\MYST - Ryan Companies\3.1.2.0\Chimera Definition Files\MYSTv3_WIP.chi")
getscriptproperty_3 = GetScriptProperty(IsDocumentProperty=True, TreeItem="a5c2a799-f98a-41d3-a65b-a890dc2617ad|-1;65546c57-1d23-44a5-8594-26c84122076a|-1;")
getscriptproperty_4 = GetScriptProperty(
    IsDocumentProperty=True,
    KeyNames="ProjectInformation/Construction_Leads: List of Construction_Lead: String",
    TreeItem="a5c2a799-f98a-41d3-a65b-a890dc2617ad|-1;6fcf1f52-63e5-4d0d-ab0b-ccb805f63e70|-1;",
    rootIds="a5c2a799-f98a-41d3-a65b-a890dc2617ad|-1;6fcf1f52-63e5-4d0d-ab0b-ccb805f63e70|-1;||C:\Users\sdanilow\Ryan Companies US, Inc\Ryan Rhino Resources - Documents\Massing Yield Study Tool (MYST)\MYSTv3\Chimera Definition Files\MYSTv3_WIP.chi")
getscriptproperty_5 = GetScriptProperty(
    IsDocumentProperty=True,
    KeyNames="ProjectInformation/AE_Design_Leads: List of AEDesignLead: String",
    TreeItem="a5c2a799-f98a-41d3-a65b-a890dc2617ad|-1;25b452fe-b34d-4875-89f0-e5ba2b6e8da2|-1;",
    rootIds="a5c2a799-f98a-41d3-a65b-a890dc2617ad|-1;25b452fe-b34d-4875-89f0-e5ba2b6e8da2|-1;||C:\Users\sdanilow\Ryan Companies US, Inc\Ryan Rhino Resources - Documents\Massing Yield Study Tool (MYST)\MYSTv3\Chimera Definition Files\MYSTv3_WIP.chi")
getscriptproperty_6 = GetScriptProperty(
    IsDocumentProperty=True,
    KeyNames="ProjectInformation/Development_Leads: List of Development_Lead: String",
    TreeItem="a5c2a799-f98a-41d3-a65b-a890dc2617ad|-1;cb5718b5-8b43-4e06-8f7f-262ff03d74fe|-1;",
    rootIds="a5c2a799-f98a-41d3-a65b-a890dc2617ad|-1;cb5718b5-8b43-4e06-8f7f-262ff03d74fe|-1;||C:\Users\sdanilow\Ryan Companies US, Inc\Ryan Rhino Resources - Documents\Massing Yield Study Tool (MYST)\MYSTv3\Chimera Definition Files\MYSTv3_WIP.chi")
getscriptproperty_7 = GetScriptProperty(
    IsDocumentProperty=True,
    KeyNames="ProjectInformation/AE_Civil_Leads: List of AECivilLead: String",
    TreeItem="a5c2a799-f98a-41d3-a65b-a890dc2617ad|-1;32821af2-a2c2-4d30-8784-e2fbaccc0928|-1;",
    rootIds="a5c2a799-f98a-41d3-a65b-a890dc2617ad|-1;32821af2-a2c2-4d30-8784-e2fbaccc0928|-1;||C:\Users\sdanilow\Ryan Companies US, Inc\Ryan Rhino Resources - Documents\Massing Yield Study Tool (MYST)\MYSTv3\Chimera Definition Files\MYSTv3_WIP.chi")
enable_disable_object_3 = EnableDisableObject(
    Enabled=invert_boolean_3.Inverted,
    AllObjects_Object=[getscriptproperty_2, getscriptproperty_3, getscriptproperty_6, getscriptproperty_4, getscriptproperty_5, getscriptproperty_7])

getobjectsbyspecies = GetObjectsBySpecies(DataKey=getdatakey_8)  # -> ObjectGuid, ChimeraData
enable_disable_object_4 = EnableDisableObject(Enabled=invert_boolean_3.Inverted, AllObjects_Object=getobjectsbyspecies)

getscriptproperty_8 = GetScriptProperty(IsDocumentProperty=True, TreeItem="bf708b74-0dae-42b1-a209-c24051da8914|-1;d8075df0-f773-4986-b77f-d02adf046b34|-1;")
enable_disable_object_5 = EnableDisableObject(Enabled=invert_boolean_3.Inverted, AllObjects_Object=readdocumentdata_7)

enable_disable_object_6 = EnableDisableObject(
    Enabled=invert_boolean_3.Inverted,
    AllObjects_Object=[getdatakey_42, getdatakey_40, getdatakey_41, getdatakey_38, getdatakey_39])
getdatakey_38 = GetDataKey(
    KeyNames="Landscaping_Plantings/Geometry_List: List of Geometry: GeometryBase",
    TreeItem="b2c85f8f-50fa-4116-9e6c-950d1a14a234|-1;c129e691-c1e3-413a-ab46-a1cf75236389|-1;",
    rootIds="b2c85f8f-50fa-4116-9e6c-950d1a14a234|-1;c129e691-c1e3-413a-ab46-a1cf75236389|-1;||C:\Users\sdanilow\Ryan Companies US, Inc\Ryan Rhino Resources - Documents\Massing Yield Study Tool (MYST)\MYSTv3\Chimera Definition Files\MYSTv3_GeoStorage_WIP.chi")
getdatakey_39 = GetDataKey(
    KeyNames="Landscaping_Plantings/Planting_Types: Enumeration",
    TreeItem="b2c85f8f-50fa-4116-9e6c-950d1a14a234|-1;01a22c83-e4e6-4f25-97ac-35f89b1f40d6|-1;",
    rootIds="b2c85f8f-50fa-4116-9e6c-950d1a14a234|-1;01a22c83-e4e6-4f25-97ac-35f89b1f40d6|-1;||C:\Users\sdanilow\Ryan Companies US, Inc\Ryan Rhino Resources - Documents\Massing Yield Study Tool (MYST)\MYSTv3\Chimera Definition Files\MYSTv3_SiteFeatures_WIP.chi")
getdatakey_40 = GetDataKey(
    KeyNames="Parking/Geometry_List: List of Geometry: GeometryBase",
    TreeItem="80c07d16-c6f7-4e51-807a-83adf853502c|-1;c129e691-c1e3-413a-ab46-a1cf75236389|-1;",
    rootIds="80c07d16-c6f7-4e51-807a-83adf853502c|-1;c129e691-c1e3-413a-ab46-a1cf75236389|-1;||C:\Users\sdanilow\Ryan Companies US, Inc\Ryan Rhino Resources - Documents\Massing Yield Study Tool (MYST)\MYSTv3\Chimera Definition Files\MYSTv3_GeoStorage_WIP.chi")
getdatakey_41 = GetDataKey(
    KeyNames="Stormwater_Retention/Geometry_List: List of Geometry: GeometryBase",
    TreeItem="7d3738b8-9ffc-4c5e-8885-a5cfdb3819de|-1;c129e691-c1e3-413a-ab46-a1cf75236389|-1;",
    rootIds="7d3738b8-9ffc-4c5e-8885-a5cfdb3819de|-1;c129e691-c1e3-413a-ab46-a1cf75236389|-1;||C:\Users\sdanilow\Ryan Companies US, Inc\Ryan Rhino Resources - Documents\Massing Yield Study Tool (MYST)\MYSTv3\Chimera Definition Files\MYSTv3_GeoStorage_WIP.chi")
getdatakey_42 = GetDataKey(
    KeyNames="Roadway/Geometry: GeometryBase",
    TreeItem="4c60d713-650c-4438-a843-60bf97c1bb9a|-1;951e1861-18fe-43d7-b9f0-c44dec75399d|-1;",
    rootIds="4c60d713-650c-4438-a843-60bf97c1bb9a|-1;951e1861-18fe-43d7-b9f0-c44dec75399d|-1;||C:\Users\sdanilow\Ryan Companies US, Inc\Ryan Rhino Resources - Documents\Massing Yield Study Tool (MYST)\MYSTv3\Chimera Definition Files\MYSTv3_GeoStorage_WIP.chi")

enable_disable_object_7 = EnableDisableObject(Enabled=invert_boolean_3.Inverted, AllObjects_Object=getdatakey_43)
getdatakey_43 = GetDataKey(KeyNames="Landscaping_Plantings", TreeItem="b2c85f8f-50fa-4116-9e6c-950d1a14a234|-1;")

getobjectsbyspecies_2 = GetObjectsBySpecies(DataKey=getdatakey_38)  # -> ObjectGuid, ChimeraData
getobjectsbyspecies_3 = GetObjectsBySpecies(DataKey=getdatakey_39)  # -> ObjectGuid, ChimeraData
getobjectsbyspecies_4 = GetObjectsBySpecies(DataKey=getdatakey_41)  # -> ObjectGuid, ChimeraData
getobjectsbyspecies_5 = GetObjectsBySpecies(DataKey=getdatakey_40)  # -> ObjectGuid, ChimeraData
getobjectsbyspecies_6 = GetObjectsBySpecies(DataKey=getdatakey_42)  # -> ObjectGuid, ChimeraData
getenumvalues_3 = GetEnumValues(EnumDefinitionKey=getdatakey_39)

enable_disable_object_8 = EnableDisableObject(Enabled=invert_boolean_3.Inverted, AllObjects_Object=getdatakey_44)
getdatakey_44 = GetDataKey(TreeItem="9c339a82-0add-41b8-97da-e42402cdf9b8|-1;")

get_data_value_12 = GetDataValue(ChimeraData=getobjectsbyspecies_2.ChimeraData)
get_data_value_13 = GetDataValue(ChimeraData=getobjectsbyspecies_3.ChimeraData)
get_data_value_14 = GetDataValue(ChimeraData=getobjectsbyspecies_4.ChimeraData)
get_data_value_15 = GetDataValue(ChimeraData=getobjectsbyspecies_6.ChimeraData)
text = Text(getobjectsbyspecies_6.ObjectGuid)
text_2 = Text(getobjectsbyspecies_5.ObjectGuid)
member_index = MemberIndex(Set=text_2, Member=text)  # -> flatten(Index), Count
flatten_tree = FlattenTree(Tree=getobjectsbyspecies_5.ChimeraData, Path="{0}")
list_item_3 = ListItem(List=getenumvalues_3, Index=get_data_value_13, Wrap=True)
list_item_4 = ListItem(List=flatten_tree, Index=member_index.Index, Wrap=True)
cull_index = CullIndex(List=flatten_tree, Indices=member_index.Index, Wrap=True)
get_data_value_16 = GetDataValue(ChimeraData=list_item_4)
get_data_value_17 = GetDataValue(ChimeraData=cull_index)

# ---- group: Ordered Planting Categories
text_3 = Text(simplify(flatten(list_item_3)))

# ---- group: Building Selection Dropdown
getdatakey_45 = GetDataKey(TreeItem="8691b996-e2d5-4e74-b9d5-24f2abd54ece|-1;6a1fd12f-c9e4-49b8-88b1-f434c07b4760|-1;")
filterobjectsbykeys = FilterObjectsByKeys(DataKey=getdatakey_45, RhinoObjectIds=getobjectsbyspecies.ObjectGuid)  # -> ObjectGuid, ChimeraData
boolean = Boolean(True)
get_data_value_18 = GetDataValue(ChimeraData=filterobjectsbykeys.ChimeraData)  # -> flatten(Value)
create_pulldown_menu = CreatePulldownMenu(Label="Building Selection", ListItems=boolean, showLabel=True)
flatten_tree_2 = FlattenTree(Tree=get_data_value_18, Path="{0}")
ghpython_script = GhPythonScript(x=flatten_tree_2)  # -> a; inputs x: list
# ---------- ghpython_script: Python ----------
__author__ = "sdanilow"
__version__ = "2023.03.14"

import rhinoscriptsyntax as rs

if x == []:
    a = False
else:
    a = True
# ---------- end ghpython_script ----------
value_listener_8 = ValueListener(Elements=create_pulldown_menu, SomeProperty=True)  # -> Values, Indices
adjust_element_positioning_4 = AdjustElementPositioning(ElementsToAdjust=create_pulldown_menu, Margin=Slider(24, range=0..100), AbsolutePositioning=False)
adjust_element_appearance_4 = AdjustElementAppearance(ElementsToAdjust=create_pulldown_menu, FontSize=Slider(20, range=0..100))
hide_show_element = HideShowElement(ElementToHideShow=create_pulldown_menu, Show=ghpython_script, Collapse=True, Disable=False)
set_list_contents = SetListContents(ListToModify=create_pulldown_menu, NewListContents=get_data_value_18)

# ----
list_item_5 = ListItem(List=getobjectsbyspecies.ObjectGuid, Index=value_listener_8.Indices, Wrap=True)
data = Data(list_item_5)
getblockobjects = GetBlockObjects(ObjectGuid=data)  # -> ObjectGuidS, InstanceTransform
filterobjectsbykeys_2 = FilterObjectsByKeys(DataKey=getdatakey_7, RhinoObjectIds=getblockobjects.ObjectGuidS)  # -> ObjectGuid, ChimeraData
filterobjectsbykeys_3 = FilterObjectsByKeys(DataKey=getdatakey_16, RhinoObjectIds=data)  # -> ObjectGuid, ChimeraData
filterobjectsbykeys_4 = FilterObjectsByKeys(DataKey=getdatakey_13, RhinoObjectIds=getblockobjects.ObjectGuidS)  # -> ObjectGuid, ChimeraData
filterobjectsbykeys_5 = FilterObjectsByKeys(DataKey=getdatakey_14, RhinoObjectIds=getblockobjects.ObjectGuidS)  # -> ObjectGuid, ChimeraData
filterobjectsbykeys_6 = FilterObjectsByKeys(DataKey=getdatakey_12, RhinoObjectIds=getblockobjects.ObjectGuidS)  # -> ObjectGuid, ChimeraData
filterobjectsbykeys_7 = FilterObjectsByKeys(DataKey=getdatakey_11, RhinoObjectIds=getblockobjects.ObjectGuidS)  # -> ObjectGuid, ChimeraData
filterobjectsbykeys_8 = FilterObjectsByKeys(DataKey=getdatakey_17, RhinoObjectIds=data)  # -> ObjectGuid, ChimeraData
filterobjectsbykeys_9 = FilterObjectsByKeys(DataKey=getdatakey_15, RhinoObjectIds=getblockobjects.ObjectGuidS)  # -> ObjectGuid, ChimeraData
filterobjectsbykeys_10 = FilterObjectsByKeys(DataKey=getdatakey_21, RhinoObjectIds=data)  # -> ObjectGuid, ChimeraData
filterobjectsbykeys_11 = FilterObjectsByKeys(DataKey=getdatakey_19, RhinoObjectIds=data)  # -> ObjectGuid, ChimeraData
filterobjectsbykeys_12 = FilterObjectsByKeys(DataKey=getdatakey_20, RhinoObjectIds=data)  # -> ObjectGuid, ChimeraData
filterobjectsbykeys_13 = FilterObjectsByKeys(DataKey=getdatakey_18, RhinoObjectIds=data)  # -> ObjectGuid, ChimeraData
filterobjectsbykeys_14 = FilterObjectsByKeys(DataKey=getdatakey_24, RhinoObjectIds=data)  # -> ObjectGuid, ChimeraData
filterobjectsbykeys_15 = FilterObjectsByKeys(DataKey=getdatakey_23, RhinoObjectIds=data)  # -> ObjectGuid, ChimeraData
filterobjectsbykeys_16 = FilterObjectsByKeys(DataKey=getdatakey_22, RhinoObjectIds=data)  # -> ObjectGuid, ChimeraData
get_data_value_19 = GetDataValue(ChimeraData=filterobjectsbykeys_7.ChimeraData)
get_data_value_20 = GetDataValue(ChimeraData=filterobjectsbykeys_6.ChimeraData)
get_data_value_21 = GetDataValue(ChimeraData=filterobjectsbykeys_4.ChimeraData)
get_data_value_22 = GetDataValue(ChimeraData=filterobjectsbykeys_5.ChimeraData)
get_data_value_23 = GetDataValue(ChimeraData=filterobjectsbykeys_9.ChimeraData)
flatten_tree_3 = FlattenTree(Tree=get_data_value_23, Path="{0}")
sort_list = SortList(Keys=flatten_tree_3, ValuesValuesA=flatten(filterobjectsbykeys_2.ChimeraData))  # -> Keys, graft(ValuesValuesA)
chimera_data = Data(sort_list.ValuesValuesA)
getchilddata_5 = GetChildData(ChimeraData=chimera_data, ChildDefinitionKeyOptional=getdatakey_10)
get_data_value_24 = GetDataValue(ChimeraData=getchilddata_5)
get_data_value_25 = GetDataValue(ChimeraData=chimera_data)
get_data_value_26 = GetDataValue(ChimeraData=filterobjectsbykeys_8.ChimeraData)
get_data_value_27 = GetDataValue(ChimeraData=filterobjectsbykeys_13.ChimeraData)
get_data_value_28 = GetDataValue(ChimeraData=filterobjectsbykeys_11.ChimeraData)
get_data_value_29 = GetDataValue(ChimeraData=filterobjectsbykeys_12.ChimeraData)
get_data_value_30 = GetDataValue(ChimeraData=filterobjectsbykeys_10.ChimeraData)
get_data_value_31 = GetDataValue(ChimeraData=filterobjectsbykeys_16.ChimeraData)
get_data_value_32 = GetDataValue(ChimeraData=filterobjectsbykeys_15.ChimeraData)
get_data_value_33 = GetDataValue(ChimeraData=filterobjectsbykeys_14.ChimeraData)
dispatch_unweave = DispatchUnweave(Data=get_data_value_25, Pattern=get_data_value_24)  # -> Out00, Out01, Out02, Out03, Out04, Out05, Out06, Out07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
getchilddata_6 = GetChildData(ChimeraData=filterobjectsbykeys_3.ChimeraData, ChildDefinitionKeyOptional=getdatakey_29)
getchilddata_7 = GetChildData(ChimeraData=filterobjectsbykeys_3.ChimeraData, ChildDefinitionKeyOptional=getdatakey_30)
division = Division(A=get_data_value_27, B=100)
getchilddata_8 = GetChildData(ChimeraData=get_data_value_28, ChildDefinitionKeyOptional=getdatakey_31)
getchilddata_9 = GetChildData(ChimeraData=get_data_value_29, ChildDefinitionKeyOptional=getdatakey_32)
getchilddata_10 = GetChildData(ChimeraData=get_data_value_31, ChildDefinitionKeyOptional=getdatakey_33)
getchilddata_11 = GetChildData(ChimeraData=get_data_value_32, ChildDefinitionKeyOptional=getdatakey_34)
getchilddata_12 = GetChildData(ChimeraData=get_data_value_33, ChildDefinitionKeyOptional=getdatakey_35)
mass_addition = MassAddition(Input=get_data_value_30)  # -> Result, PartialResults
list_length = ListLength(List=get_data_value_26)
sort_list_2 = SortList(Keys=get_data_value_26)  # -> Keys, ValuesValuesA
multiplication = Multiplication(A=get_data_value_30, B=division)
sort_list_3 = SortList(Keys=get_data_value_23, ValuesValuesA=get_data_value_19)  # -> Keys, ValuesValuesA
sort_list_4 = SortList(Keys=get_data_value_23, ValuesValuesA=get_data_value_22)  # -> Keys, ValuesValuesA
sort_list_5 = SortList(Keys=get_data_value_23, ValuesValuesA=get_data_value_20)  # -> Keys, ValuesValuesA
sort_list_6 = SortList(Keys=get_data_value_23, ValuesValuesA=get_data_value_21)  # -> Keys, ValuesValuesA
larger_than = LargerThan(FirstNumber=list_length, SecondNumber=1)  # -> LargerThan, OrEqualTo
get_data_value_34 = GetDataValue(ChimeraData=getchilddata_7)
get_data_value_35 = GetDataValue(ChimeraData=getchilddata_6)
mass_addition_2 = MassAddition(Input=multiplication)  # -> Result, PartialResults
reverse_list = ReverseList(List=sort_list_2.Keys)
get_data_value_36 = GetDataValue(ChimeraData=getchilddata_8)
get_data_value_37 = GetDataValue(ChimeraData=getchilddata_9)
get_data_value_38 = GetDataValue(ChimeraData=getchilddata_10)
get_data_value_39 = GetDataValue(ChimeraData=getchilddata_11)
get_data_value_40 = GetDataValue(ChimeraData=getchilddata_12)
round_to_decimal_place = RoundToDecimalPlace(NumberX=get_data_value_34, DecimalPlace=2, RoundType=0)  # -> Rounded, Difference

# ---- group: Tallest Building (used when multiple bldgs present)
list_item_6 = ListItem(List=reverse_list, Index=0, Wrap=True)

# ---- group: Building Height (used for single building selected)
data_2 = Data(get_data_value_26)

# ----
mass_addition_3 = MassAddition(Input=get_data_value_38)  # -> Result, PartialResults

# ---- group: Material Names
data_3 = Data(get_data_value_35)

# ----
key_value_search = KeyValueSearch(Keys=get_data_value_9, Values=get_data_value_8, Search=data_3)
flatten_tree_4 = FlattenTree(Tree=sort_list_4.Keys, Path="{0}")
dispatch = Dispatch(List=list_item_6, DispatchPattern=larger_than.LargerThan)  # -> ListA, ListB
dispatch_2 = Dispatch(List=data_2, DispatchPattern=larger_than.LargerThan)  # -> ListA, ListB
key_value_search_2 = KeyValueSearch(Keys=get_data_value_40, Values=get_data_value_39, Search=get_data_value_11)
key_value_search_3 = KeyValueSearch(Keys=get_data_value_36, Values=get_data_value_37, Search=get_data_value_11)
key_value_search_4 = KeyValueSearch(Keys=get_data_value_11, Values=get_data_value_10, Search=get_data_value_36)

# ---- group: Material %
data_4 = Data(round_to_decimal_place.Rounded)

# ----
division_2 = Division(A=get_data_value_37, B=100)
flatten_tree_5 = FlattenTree(Tree=mass_addition_3.Result, Path="{0}")
sort_duplicate_values = SortDuplicateValues(ValueList=flatten_tree_4)  # -> UniqueValues, Indices
clean_tree = CleanTree(RemoveNulls=True, RemoveInvalid=True, RemoveEmpty=True, Tree=key_value_search_2)
division_3 = Division(A=data_4, B=100)
path_mapper = PathMapper(key_value_search_2, source="{A;B}(i)", target="{i}")
merge_5 = Merge(Data1=dispatch.ListA, Data2=dispatch_2.ListB)
mass_addition_4 = MassAddition(Input=flatten_tree_5)  # -> Result, PartialResults
average = Average(Input=sort_list_3.ValuesValuesA)
average_2 = Average(Input=sort_list_6.ValuesValuesA)
path_mapper_2 = PathMapper(key_value_search_3, source="{A;B}(i)", target="{i}")
clean_tree_2 = CleanTree(RemoveNulls=True, RemoveInvalid=True, RemoveEmpty=True, Tree=key_value_search_3)
average_3 = Average(Input=sort_list_5.ValuesValuesA)
average_4 = Average(Input=sort_list_4.ValuesValuesA)
multiplication_2 = Multiplication(A=division_2, B=key_value_search_4)
clean_tree_3 = CleanTree(RemoveNulls=True, RemoveInvalid=True, RemoveEmpty=True, Tree=merge_5)
replace_nulls = ReplaceNulls(Items=path_mapper, Replacements=number)  # -> Items, Count
cluster_5 = Cluster(number=mass_addition_2.Result)
cluster_6 = Cluster(number=mass_addition.Result)
mass_addition_5 = MassAddition(Input=multiplication_2)  # -> Result, PartialResults
replace_nulls_2 = ReplaceNulls(Items=path_mapper_2, Replacements=number_2)  # -> Items, Count

enum_value = Data(list_item.Item)
chimera_data_2 = Data(dispatch_unweave.Out00)
getdatakey_46 = GetDataKey(TreeItem="a64d03de-ca92-4694-9c46-79f5d73b0afe|-1;")
getdatakey_47 = GetDataKey(TreeItem="c52f7483-d725-4c42-8378-d2ee2f8a3366|-1;")
getdatakey_48 = GetDataKey(TreeItem="829d644e-c9f6-4fcd-b2cd-fc78829fa806|-1;")
getdatakey_49 = GetDataKey(TreeItem="75169155-5d02-4ef4-a0ba-ef3fc40dfa30|-1;")
getchilddata_13 = GetChildData(ChimeraData=chimera_data_2, ChildDefinitionKeyOptional=getdatakey_46)
getchilddata_14 = GetChildData(ChimeraData=chimera_data_2, ChildDefinitionKeyOptional=getdatakey_48)
getchilddata_15 = GetChildData(ChimeraData=chimera_data_2, ChildDefinitionKeyOptional=getdatakey_47)
getchilddata_16 = GetChildData(ChimeraData=chimera_data_2, ChildDefinitionKeyOptional=getdatakey_49)
get_data_value_41 = GetDataValue(ChimeraData=getchilddata_13)
get_data_value_42 = GetDataValue(ChimeraData=getchilddata_14)
get_data_value_43 = GetDataValue(ChimeraData=getchilddata_16)
get_data_value_44 = GetDataValue(ChimeraData=getchilddata_15)
sort_duplicate_values_2 = SortDuplicateValues(ValueList=flatten(get_data_value_41))  # -> UniqueValues, Indices
ghpython_script_2 = GhPythonScript(
    uniqueAreas=sort_duplicate_values_2.UniqueValues,
    areasByFloor=get_data_value_41,
    effPercent=get_data_value_44,
    GSF=get_data_value_42,
    RSF=get_data_value_43)  # -> newAreasByFloor, newEffPercent, newGSF, newRSF; inputs uniqueAreas: list, areasByFloor: list, effPercent: list, GSF: list, RSF: list
# ---------- ghpython_script_2: Python ----------
__author__ = "sdanilow"
__version__ = "2023.03.14"

import rhinoscriptsyntax as rs

newAreasByFloor = areasByFloor
newEffPercent = effPercent
newGSF = GSF
newRSF = RSF

for i in range(len(uniqueAreas)):
    if uniqueAreas[i] not in areasByFloor:
        newAreasByFloor.append(uniqueAreas[i])
        newEffPercent.append(0)
        newGSF.append(0)
        newRSF.append(0)
# ---------- end ghpython_script_2 ----------
sort_duplicate_values_3 = SortDuplicateValues(ValueList=flatten(ghpython_script_2.newAreasByFloor))  # -> UniqueValues, Indices
flatten_tree_6 = FlattenTree(Tree=ghpython_script_2.newEffPercent, Path="{0}")
flatten_tree_7 = FlattenTree(Tree=ghpython_script_2.newGSF, Path="{0}")
flatten_tree_8 = FlattenTree(Tree=ghpython_script_2.newRSF, Path="{0}")
round_to_decimal_place_2 = RoundToDecimalPlace(NumberX=flatten_tree_6, DecimalPlace=2, RoundType=0)  # -> Rounded, Difference
cluster_7 = Cluster(number=flatten_tree_7)
cluster_8 = Cluster(number=flatten_tree_8)
list_item_7 = ListItem(List=round_to_decimal_place_2.Rounded, Index=sort_duplicate_values_3.Indices, Wrap=True)
concatenate = Concatenate(FragmentA=enum_value, FragmentB=" Areas")

enum_value_2 = Data(list_item.Item1)
chimera_data_3 = Data(dispatch_unweave.Out01)
getdatakey_50 = GetDataKey(TreeItem="a64d03de-ca92-4694-9c46-79f5d73b0afe|-1;")
getdatakey_51 = GetDataKey(TreeItem="c52f7483-d725-4c42-8378-d2ee2f8a3366|-1;")
getdatakey_52 = GetDataKey(TreeItem="829d644e-c9f6-4fcd-b2cd-fc78829fa806|-1;")
getdatakey_53 = GetDataKey(TreeItem="75169155-5d02-4ef4-a0ba-ef3fc40dfa30|-1;")
getchilddata_17 = GetChildData(ChimeraData=chimera_data_3, ChildDefinitionKeyOptional=getdatakey_50)
getchilddata_18 = GetChildData(ChimeraData=chimera_data_3, ChildDefinitionKeyOptional=getdatakey_52)
getchilddata_19 = GetChildData(ChimeraData=chimera_data_3, ChildDefinitionKeyOptional=getdatakey_51)
getchilddata_20 = GetChildData(ChimeraData=chimera_data_3, ChildDefinitionKeyOptional=getdatakey_53)
get_data_value_45 = GetDataValue(ChimeraData=getchilddata_17)
get_data_value_46 = GetDataValue(ChimeraData=getchilddata_18)
get_data_value_47 = GetDataValue(ChimeraData=getchilddata_20)
get_data_value_48 = GetDataValue(ChimeraData=getchilddata_19)
sort_duplicate_values_4 = SortDuplicateValues(ValueList=flatten(get_data_value_45))  # -> UniqueValues, Indices
ghpython_script_3 = GhPythonScript(
    uniqueAreas=sort_duplicate_values_4.UniqueValues,
    areasByFloor=get_data_value_45,
    effPercent=get_data_value_48,
    GSF=get_data_value_46,
    RSF=get_data_value_47)  # -> newAreasByFloor, newEffPercent, newGSF, newRSF; inputs uniqueAreas: list, areasByFloor: list, effPercent: list, GSF: list, RSF: list; same code as ghpython_script_2
sort_duplicate_values_5 = SortDuplicateValues(ValueList=flatten(ghpython_script_3.newAreasByFloor))  # -> UniqueValues, Indices
flatten_tree_9 = FlattenTree(Tree=ghpython_script_3.newEffPercent, Path="{0}")
flatten_tree_10 = FlattenTree(Tree=ghpython_script_3.newGSF, Path="{0}")
flatten_tree_11 = FlattenTree(Tree=ghpython_script_3.newRSF, Path="{0}")
round_to_decimal_place_3 = RoundToDecimalPlace(NumberX=flatten_tree_9, DecimalPlace=2, RoundType=0)  # -> Rounded, Difference
cluster_9 = Cluster(number=flatten_tree_10)
cluster_10 = Cluster(number=flatten_tree_11)
list_item_8 = ListItem(List=round_to_decimal_place_3.Rounded, Index=sort_duplicate_values_5.Indices, Wrap=True)
concatenate_2 = Concatenate(FragmentA=enum_value_2, FragmentB=" Areas")

flatten_tree_12 = FlattenTree(Tree=average, Path="{0}")

# ---- group: Total Bed Count
data_5 = Data(mass_addition_4.Result)

# ----
getblockobjects_2 = GetBlockObjects(ObjectGuid=data)  # -> ObjectGuidS, InstanceTransform
getdatakey_54 = GetDataKey(TreeItem="35a37d85-eb6e-4e37-aaf6-5cbc00dfdeac|-1;50478ae9-d942-446e-b272-e7f609cbfe62|-1;")
filterobjectsbykeys_17 = FilterObjectsByKeys(DataKey=getdatakey_54, RhinoObjectIds=getblockobjects_2.ObjectGuidS)  # -> ObjectGuid, flatten(ChimeraData)
getblockobjects_3 = GetBlockObjects(ObjectGuid=filterobjectsbykeys_17.ObjectGuid)  # -> ObjectGuidS, InstanceTransform
getdatakey_55 = GetDataKey(TreeItem="6a55d2d9-ee28-477b-a0d4-48a84f2b3a50|-1;829d644e-c9f6-4fcd-b2cd-fc78829fa806|-1;")
getdatakey_56 = GetDataKey(TreeItem="6a55d2d9-ee28-477b-a0d4-48a84f2b3a50|-1;3443d855-81b7-4d64-8efe-1af2de4e8668|-1;")
getdatakey_57 = GetDataKey(TreeItem="b74d9c63-0a81-4c72-bb23-7d0cfe223454|-1;2db2527d-972b-462a-8322-2de676e6aca6|-1;")
readobjectdata = ReadObjectData(ObjectGuid=getblockobjects_3.ObjectGuidS, DataKeyOptional=getdatakey_56)
readobjectdata_2 = ReadObjectData(ObjectGuid=getblockobjects_3.ObjectGuidS, DataKeyOptional=getdatakey_55)
getenumvalues_4 = GetEnumValues(EnumDefinitionKey=getdatakey_56)
get_data_value_49 = GetDataValue(ChimeraData=filterobjectsbykeys_17.ChimeraData)
readobjectdata_3 = ReadObjectData(ObjectGuid=filterobjectsbykeys_17.ObjectGuid, DataKeyOptional=getdatakey_57)
get_data_value_50 = GetDataValue(ChimeraData=readobjectdata)
get_data_value_51 = GetDataValue(ChimeraData=readobjectdata_3)
list_item_9 = ListItem(List=getenumvalues_4, Index=get_data_value_50, Wrap=True)
sort_list_7 = SortList(Keys=get_data_value_51, ValuesValuesA=get_data_value_49)  # -> Keys, ValuesValuesA
match_text = MatchText(Text=list_item_9, Pattern="Structured Parking", Case=True)
dispatch_3 = Dispatch(List=readobjectdata_2, DispatchPattern=match_text)  # -> ListA, ListB
renumber_paths = RenumberPaths(Data=sort_list_7.Keys)
renumber_paths_2 = RenumberPaths(Data=sort_list_7.ValuesValuesA)
get_data_value_52 = GetDataValue(ChimeraData=dispatch_3.ListA)
mass_addition_6 = MassAddition(Input=get_data_value_52)  # -> flatten(Result), PartialResults
renumber_paths_3 = RenumberPaths(Data=mass_addition_6.Result)
ghpython_script_4 = GhPythonScript(x=get_data_value_52)  # -> a; inputs x: list; same code as ghpython_script_2
stream_filter = StreamFilter(Gate=ghpython_script_4, Stream1=renumber_paths_3)

# ---- group: Floor Numbers
data_6 = Data(sort_duplicate_values.UniqueValues)

# ----
enum_value_3 = Data(list_item.Item2)
chimera_data_4 = Data(dispatch_unweave.Out02)
getdatakey_58 = GetDataKey(TreeItem="a64d03de-ca92-4694-9c46-79f5d73b0afe|-1;")
getdatakey_59 = GetDataKey(TreeItem="c52f7483-d725-4c42-8378-d2ee2f8a3366|-1;")
getdatakey_60 = GetDataKey(TreeItem="829d644e-c9f6-4fcd-b2cd-fc78829fa806|-1;")
getdatakey_61 = GetDataKey(TreeItem="75169155-5d02-4ef4-a0ba-ef3fc40dfa30|-1;")
getchilddata_21 = GetChildData(ChimeraData=chimera_data_4, ChildDefinitionKeyOptional=getdatakey_58)
getchilddata_22 = GetChildData(ChimeraData=chimera_data_4, ChildDefinitionKeyOptional=getdatakey_60)
getchilddata_23 = GetChildData(ChimeraData=chimera_data_4, ChildDefinitionKeyOptional=getdatakey_59)
getchilddata_24 = GetChildData(ChimeraData=chimera_data_4, ChildDefinitionKeyOptional=getdatakey_61)
get_data_value_53 = GetDataValue(ChimeraData=getchilddata_21)
get_data_value_54 = GetDataValue(ChimeraData=getchilddata_22)
get_data_value_55 = GetDataValue(ChimeraData=getchilddata_24)
get_data_value_56 = GetDataValue(ChimeraData=getchilddata_23)
sort_duplicate_values_6 = SortDuplicateValues(ValueList=flatten(get_data_value_53))  # -> UniqueValues, Indices
ghpython_script_5 = GhPythonScript(
    uniqueAreas=sort_duplicate_values_6.UniqueValues,
    areasByFloor=get_data_value_53,
    effPercent=get_data_value_56,
    GSF=get_data_value_54,
    RSF=get_data_value_55)  # -> newAreasByFloor, newEffPercent, newGSF, newRSF; inputs uniqueAreas: list, areasByFloor: list, effPercent: list, GSF: list, RSF: list; same code as ghpython_script_2
sort_duplicate_values_7 = SortDuplicateValues(ValueList=flatten(ghpython_script_5.newAreasByFloor))  # -> UniqueValues, Indices
flatten_tree_13 = FlattenTree(Tree=ghpython_script_5.newEffPercent, Path="{0}")
flatten_tree_14 = FlattenTree(Tree=ghpython_script_5.newGSF, Path="{0}")
flatten_tree_15 = FlattenTree(Tree=ghpython_script_5.newRSF, Path="{0}")
round_to_decimal_place_4 = RoundToDecimalPlace(NumberX=flatten_tree_13, DecimalPlace=2, RoundType=0)  # -> Rounded, Difference
cluster_11 = Cluster(number=flatten_tree_14)
cluster_12 = Cluster(number=flatten_tree_15)
list_item_10 = ListItem(List=round_to_decimal_place_4.Rounded, Index=sort_duplicate_values_7.Indices, Wrap=True)
concatenate_3 = Concatenate(FragmentA=enum_value_3, FragmentB=" Areas")

flatten_tree_16 = FlattenTree(Tree=average_2, Path="{0}")
flatten_tree_17 = FlattenTree(Tree=average_3, Path="{0}")
flatten_tree_18 = FlattenTree(Tree=average_4, Path="{0}")

enum_value_4 = Data(list_item.Item4)
chimera_data_5 = Data(dispatch_unweave.Out04)
getdatakey_62 = GetDataKey(TreeItem="a64d03de-ca92-4694-9c46-79f5d73b0afe|-1;")
getdatakey_63 = GetDataKey(TreeItem="c52f7483-d725-4c42-8378-d2ee2f8a3366|-1;")
getdatakey_64 = GetDataKey(TreeItem="829d644e-c9f6-4fcd-b2cd-fc78829fa806|-1;")
getdatakey_65 = GetDataKey(TreeItem="75169155-5d02-4ef4-a0ba-ef3fc40dfa30|-1;")
getchilddata_25 = GetChildData(ChimeraData=chimera_data_5, ChildDefinitionKeyOptional=getdatakey_62)
getchilddata_26 = GetChildData(ChimeraData=chimera_data_5, ChildDefinitionKeyOptional=getdatakey_64)
getchilddata_27 = GetChildData(ChimeraData=chimera_data_5, ChildDefinitionKeyOptional=getdatakey_63)
getchilddata_28 = GetChildData(ChimeraData=chimera_data_5, ChildDefinitionKeyOptional=getdatakey_65)
get_data_value_57 = GetDataValue(ChimeraData=getchilddata_25)
get_data_value_58 = GetDataValue(ChimeraData=getchilddata_26)
get_data_value_59 = GetDataValue(ChimeraData=getchilddata_28)
get_data_value_60 = GetDataValue(ChimeraData=getchilddata_27)
sort_duplicate_values_8 = SortDuplicateValues(ValueList=flatten(get_data_value_57))  # -> UniqueValues, Indices
ghpython_script_6 = GhPythonScript(
    uniqueAreas=sort_duplicate_values_8.UniqueValues,
    areasByFloor=get_data_value_57,
    effPercent=get_data_value_60,
    GSF=get_data_value_58,
    RSF=get_data_value_59)  # -> newAreasByFloor, newEffPercent, newGSF, newRSF; inputs uniqueAreas: list, areasByFloor: list, effPercent: list, GSF: list, RSF: list; same code as ghpython_script_2
sort_duplicate_values_9 = SortDuplicateValues(ValueList=flatten(ghpython_script_6.newAreasByFloor))  # -> UniqueValues, Indices
flatten_tree_19 = FlattenTree(Tree=ghpython_script_6.newEffPercent, Path="{0}")
flatten_tree_20 = FlattenTree(Tree=ghpython_script_6.newGSF, Path="{0}")
flatten_tree_21 = FlattenTree(Tree=ghpython_script_6.newRSF, Path="{0}")
round_to_decimal_place_5 = RoundToDecimalPlace(NumberX=flatten_tree_19, DecimalPlace=2, RoundType=0)  # -> Rounded, Difference
cluster_13 = Cluster(number=flatten_tree_20)
cluster_14 = Cluster(number=flatten_tree_21)
list_item_11 = ListItem(List=round_to_decimal_place_5.Rounded, Index=sort_duplicate_values_9.Indices, Wrap=True)
concatenate_4 = Concatenate(FragmentA=enum_value_4, FragmentB=" Areas")

enum_value_5 = Data(list_item.Item3)
chimera_data_6 = Data(dispatch_unweave.Out03)
getdatakey_66 = GetDataKey(TreeItem="a64d03de-ca92-4694-9c46-79f5d73b0afe|-1;")
getdatakey_67 = GetDataKey(TreeItem="c52f7483-d725-4c42-8378-d2ee2f8a3366|-1;")
getdatakey_68 = GetDataKey(TreeItem="829d644e-c9f6-4fcd-b2cd-fc78829fa806|-1;")
getdatakey_69 = GetDataKey(TreeItem="75169155-5d02-4ef4-a0ba-ef3fc40dfa30|-1;")
getchilddata_29 = GetChildData(ChimeraData=chimera_data_6, ChildDefinitionKeyOptional=getdatakey_66)
getchilddata_30 = GetChildData(ChimeraData=chimera_data_6, ChildDefinitionKeyOptional=getdatakey_68)
getchilddata_31 = GetChildData(ChimeraData=chimera_data_6, ChildDefinitionKeyOptional=getdatakey_67)
getchilddata_32 = GetChildData(ChimeraData=chimera_data_6, ChildDefinitionKeyOptional=getdatakey_69)
get_data_value_61 = GetDataValue(ChimeraData=getchilddata_29)
get_data_value_62 = GetDataValue(ChimeraData=getchilddata_30)
get_data_value_63 = GetDataValue(ChimeraData=getchilddata_32)
get_data_value_64 = GetDataValue(ChimeraData=getchilddata_31)
sort_duplicate_values_10 = SortDuplicateValues(ValueList=flatten(get_data_value_61))  # -> UniqueValues, Indices
ghpython_script_7 = GhPythonScript(
    uniqueAreas=sort_duplicate_values_10.UniqueValues,
    areasByFloor=get_data_value_61,
    effPercent=get_data_value_64,
    GSF=get_data_value_62,
    RSF=get_data_value_63)  # -> newAreasByFloor, newEffPercent, newGSF, newRSF; inputs uniqueAreas: list, areasByFloor: list, effPercent: list, GSF: list, RSF: list; same code as ghpython_script_2
sort_duplicate_values_11 = SortDuplicateValues(ValueList=flatten(ghpython_script_7.newAreasByFloor))  # -> UniqueValues, Indices
flatten_tree_22 = FlattenTree(Tree=ghpython_script_7.newEffPercent, Path="{0}")
flatten_tree_23 = FlattenTree(Tree=ghpython_script_7.newGSF, Path="{0}")
flatten_tree_24 = FlattenTree(Tree=ghpython_script_7.newRSF, Path="{0}")
round_to_decimal_place_6 = RoundToDecimalPlace(NumberX=flatten_tree_22, DecimalPlace=2, RoundType=0)  # -> Rounded, Difference
cluster_15 = Cluster(number=flatten_tree_23)
cluster_16 = Cluster(number=flatten_tree_24)
list_item_12 = ListItem(List=round_to_decimal_place_6.Rounded, Index=sort_duplicate_values_11.Indices, Wrap=True)
concatenate_5 = Concatenate(FragmentA=enum_value_5, FragmentB=" Areas")

enum_value_6 = Data(list_item.Item8)
chimera_data_7 = Data(dispatch_unweave.Out08)
getdatakey_70 = GetDataKey(TreeItem="a64d03de-ca92-4694-9c46-79f5d73b0afe|-1;")
getdatakey_71 = GetDataKey(TreeItem="c52f7483-d725-4c42-8378-d2ee2f8a3366|-1;")
getdatakey_72 = GetDataKey(TreeItem="829d644e-c9f6-4fcd-b2cd-fc78829fa806|-1;")
getdatakey_73 = GetDataKey(TreeItem="75169155-5d02-4ef4-a0ba-ef3fc40dfa30|-1;")
getchilddata_33 = GetChildData(ChimeraData=chimera_data_7, ChildDefinitionKeyOptional=getdatakey_70)
getchilddata_34 = GetChildData(ChimeraData=chimera_data_7, ChildDefinitionKeyOptional=getdatakey_72)
getchilddata_35 = GetChildData(ChimeraData=chimera_data_7, ChildDefinitionKeyOptional=getdatakey_71)
getchilddata_36 = GetChildData(ChimeraData=chimera_data_7, ChildDefinitionKeyOptional=getdatakey_73)
get_data_value_65 = GetDataValue(ChimeraData=getchilddata_33)
get_data_value_66 = GetDataValue(ChimeraData=getchilddata_34)
get_data_value_67 = GetDataValue(ChimeraData=getchilddata_36)
get_data_value_68 = GetDataValue(ChimeraData=getchilddata_35)
sort_duplicate_values_12 = SortDuplicateValues(ValueList=flatten(get_data_value_65))  # -> UniqueValues, Indices
ghpython_script_8 = GhPythonScript(
    uniqueAreas=sort_duplicate_values_12.UniqueValues,
    areasByFloor=get_data_value_65,
    effPercent=get_data_value_68,
    GSF=get_data_value_66,
    RSF=get_data_value_67)  # -> newAreasByFloor, newEffPercent, newGSF, newRSF; inputs uniqueAreas: list, areasByFloor: list, effPercent: list, GSF: list, RSF: list; same code as ghpython_script_2
sort_duplicate_values_13 = SortDuplicateValues(ValueList=flatten(ghpython_script_8.newAreasByFloor))  # -> UniqueValues, Indices
flatten_tree_25 = FlattenTree(Tree=ghpython_script_8.newEffPercent, Path="{0}")
flatten_tree_26 = FlattenTree(Tree=ghpython_script_8.newGSF, Path="{0}")
flatten_tree_27 = FlattenTree(Tree=ghpython_script_8.newRSF, Path="{0}")
round_to_decimal_place_7 = RoundToDecimalPlace(NumberX=flatten_tree_25, DecimalPlace=2, RoundType=0)  # -> Rounded, Difference
cluster_17 = Cluster(number=flatten_tree_26)
cluster_18 = Cluster(number=flatten_tree_27)
list_item_13 = ListItem(List=round_to_decimal_place_7.Rounded, Index=sort_duplicate_values_13.Indices, Wrap=True)
concatenate_6 = Concatenate(FragmentA=enum_value_6, FragmentB=" Areas")

enum_value_7 = Data(list_item.Item7)
chimera_data_8 = Data(dispatch_unweave.Out07)
getdatakey_74 = GetDataKey(TreeItem="a64d03de-ca92-4694-9c46-79f5d73b0afe|-1;")
getdatakey_75 = GetDataKey(TreeItem="c52f7483-d725-4c42-8378-d2ee2f8a3366|-1;")
getdatakey_76 = GetDataKey(TreeItem="829d644e-c9f6-4fcd-b2cd-fc78829fa806|-1;")
getdatakey_77 = GetDataKey(TreeItem="75169155-5d02-4ef4-a0ba-ef3fc40dfa30|-1;")
getchilddata_37 = GetChildData(ChimeraData=chimera_data_8, ChildDefinitionKeyOptional=getdatakey_74)
getchilddata_38 = GetChildData(ChimeraData=chimera_data_8, ChildDefinitionKeyOptional=getdatakey_76)
getchilddata_39 = GetChildData(ChimeraData=chimera_data_8, ChildDefinitionKeyOptional=getdatakey_75)
getchilddata_40 = GetChildData(ChimeraData=chimera_data_8, ChildDefinitionKeyOptional=getdatakey_77)
get_data_value_69 = GetDataValue(ChimeraData=getchilddata_37)
get_data_value_70 = GetDataValue(ChimeraData=getchilddata_38)
get_data_value_71 = GetDataValue(ChimeraData=getchilddata_40)
get_data_value_72 = GetDataValue(ChimeraData=getchilddata_39)
sort_duplicate_values_14 = SortDuplicateValues(ValueList=flatten(get_data_value_69))  # -> UniqueValues, Indices
ghpython_script_9 = GhPythonScript(
    uniqueAreas=sort_duplicate_values_14.UniqueValues,
    areasByFloor=get_data_value_69,
    effPercent=get_data_value_72,
    GSF=get_data_value_70,
    RSF=get_data_value_71)  # -> newAreasByFloor, newEffPercent, newGSF, newRSF; inputs uniqueAreas: list, areasByFloor: list, effPercent: list, GSF: list, RSF: list; same code as ghpython_script_2
sort_duplicate_values_15 = SortDuplicateValues(ValueList=flatten(ghpython_script_9.newAreasByFloor))  # -> UniqueValues, Indices
flatten_tree_28 = FlattenTree(Tree=ghpython_script_9.newEffPercent, Path="{0}")
flatten_tree_29 = FlattenTree(Tree=ghpython_script_9.newGSF, Path="{0}")
flatten_tree_30 = FlattenTree(Tree=ghpython_script_9.newRSF, Path="{0}")
round_to_decimal_place_8 = RoundToDecimalPlace(NumberX=flatten_tree_28, DecimalPlace=2, RoundType=0)  # -> Rounded, Difference
cluster_19 = Cluster(number=flatten_tree_29)
cluster_20 = Cluster(number=flatten_tree_30)
list_item_14 = ListItem(List=round_to_decimal_place_8.Rounded, Index=sort_duplicate_values_15.Indices, Wrap=True)
concatenate_7 = Concatenate(FragmentA=enum_value_7, FragmentB=" Areas")

enum_value_8 = Data(list_item.Item9)
chimera_data_9 = Data(dispatch_unweave.Out09)
getdatakey_78 = GetDataKey(TreeItem="a64d03de-ca92-4694-9c46-79f5d73b0afe|-1;")
getdatakey_79 = GetDataKey(TreeItem="c52f7483-d725-4c42-8378-d2ee2f8a3366|-1;")
getdatakey_80 = GetDataKey(TreeItem="829d644e-c9f6-4fcd-b2cd-fc78829fa806|-1;")
getdatakey_81 = GetDataKey(TreeItem="75169155-5d02-4ef4-a0ba-ef3fc40dfa30|-1;")
getchilddata_41 = GetChildData(ChimeraData=chimera_data_9, ChildDefinitionKeyOptional=getdatakey_78)
getchilddata_42 = GetChildData(ChimeraData=chimera_data_9, ChildDefinitionKeyOptional=getdatakey_80)
getchilddata_43 = GetChildData(ChimeraData=chimera_data_9, ChildDefinitionKeyOptional=getdatakey_79)
getchilddata_44 = GetChildData(ChimeraData=chimera_data_9, ChildDefinitionKeyOptional=getdatakey_81)
get_data_value_73 = GetDataValue(ChimeraData=getchilddata_41)
get_data_value_74 = GetDataValue(ChimeraData=getchilddata_42)
get_data_value_75 = GetDataValue(ChimeraData=getchilddata_44)
get_data_value_76 = GetDataValue(ChimeraData=getchilddata_43)
sort_duplicate_values_16 = SortDuplicateValues(ValueList=flatten(get_data_value_73))  # -> UniqueValues, Indices
ghpython_script_10 = GhPythonScript(
    uniqueAreas=sort_duplicate_values_16.UniqueValues,
    areasByFloor=get_data_value_73,
    effPercent=get_data_value_76,
    GSF=get_data_value_74,
    RSF=get_data_value_75)  # -> newAreasByFloor, newEffPercent, newGSF, newRSF; inputs uniqueAreas: list, areasByFloor: list, effPercent: list, GSF: list, RSF: list; same code as ghpython_script_2
sort_duplicate_values_17 = SortDuplicateValues(ValueList=flatten(ghpython_script_10.newAreasByFloor))  # -> UniqueValues, Indices
flatten_tree_31 = FlattenTree(Tree=ghpython_script_10.newEffPercent, Path="{0}")
flatten_tree_32 = FlattenTree(Tree=ghpython_script_10.newGSF, Path="{0}")
flatten_tree_33 = FlattenTree(Tree=ghpython_script_10.newRSF, Path="{0}")
round_to_decimal_place_9 = RoundToDecimalPlace(NumberX=flatten_tree_31, DecimalPlace=2, RoundType=0)  # -> Rounded, Difference
cluster_21 = Cluster(number=flatten_tree_32)
cluster_22 = Cluster(number=flatten_tree_33)
list_item_15 = ListItem(List=round_to_decimal_place_9.Rounded, Index=sort_duplicate_values_17.Indices, Wrap=True)
concatenate_8 = Concatenate(FragmentA=enum_value_8, FragmentB=" Areas")

enum_value_9 = Data(list_item.Item10)
chimera_data_10 = Data(dispatch_unweave.Out10)
getdatakey_82 = GetDataKey(TreeItem="a64d03de-ca92-4694-9c46-79f5d73b0afe|-1;")
getdatakey_83 = GetDataKey(TreeItem="c52f7483-d725-4c42-8378-d2ee2f8a3366|-1;")
getdatakey_84 = GetDataKey(TreeItem="829d644e-c9f6-4fcd-b2cd-fc78829fa806|-1;")
getdatakey_85 = GetDataKey(TreeItem="75169155-5d02-4ef4-a0ba-ef3fc40dfa30|-1;")
getchilddata_45 = GetChildData(ChimeraData=chimera_data_10, ChildDefinitionKeyOptional=getdatakey_82)
getchilddata_46 = GetChildData(ChimeraData=chimera_data_10, ChildDefinitionKeyOptional=getdatakey_84)
getchilddata_47 = GetChildData(ChimeraData=chimera_data_10, ChildDefinitionKeyOptional=getdatakey_83)
getchilddata_48 = GetChildData(ChimeraData=chimera_data_10, ChildDefinitionKeyOptional=getdatakey_85)
get_data_value_77 = GetDataValue(ChimeraData=getchilddata_45)
get_data_value_78 = GetDataValue(ChimeraData=getchilddata_46)
get_data_value_79 = GetDataValue(ChimeraData=getchilddata_48)
get_data_value_80 = GetDataValue(ChimeraData=getchilddata_47)
sort_duplicate_values_18 = SortDuplicateValues(ValueList=flatten(get_data_value_77))  # -> UniqueValues, Indices
ghpython_script_11 = GhPythonScript(
    uniqueAreas=sort_duplicate_values_18.UniqueValues,
    areasByFloor=get_data_value_77,
    effPercent=get_data_value_80,
    GSF=get_data_value_78,
    RSF=get_data_value_79)  # -> newAreasByFloor, newEffPercent, newGSF, newRSF; inputs uniqueAreas: list, areasByFloor: list, effPercent: list, GSF: list, RSF: list; same code as ghpython_script_2
sort_duplicate_values_19 = SortDuplicateValues(ValueList=flatten(ghpython_script_11.newAreasByFloor))  # -> UniqueValues, Indices
flatten_tree_34 = FlattenTree(Tree=ghpython_script_11.newEffPercent, Path="{0}")
flatten_tree_35 = FlattenTree(Tree=ghpython_script_11.newGSF, Path="{0}")
flatten_tree_36 = FlattenTree(Tree=ghpython_script_11.newRSF, Path="{0}")
round_to_decimal_place_10 = RoundToDecimalPlace(NumberX=flatten_tree_34, DecimalPlace=2, RoundType=0)  # -> Rounded, Difference
cluster_23 = Cluster(number=flatten_tree_35)
cluster_24 = Cluster(number=flatten_tree_36)
list_item_16 = ListItem(List=round_to_decimal_place_10.Rounded, Index=sort_duplicate_values_19.Indices, Wrap=True)
concatenate_9 = Concatenate(FragmentA=enum_value_9, FragmentB=" Areas")

enum_value_10 = Data(list_item.Item6)
chimera_data_11 = Data(dispatch_unweave.Out06)
getdatakey_86 = GetDataKey(TreeItem="a64d03de-ca92-4694-9c46-79f5d73b0afe|-1;")
getdatakey_87 = GetDataKey(TreeItem="c52f7483-d725-4c42-8378-d2ee2f8a3366|-1;")
getdatakey_88 = GetDataKey(TreeItem="829d644e-c9f6-4fcd-b2cd-fc78829fa806|-1;")
getdatakey_89 = GetDataKey(TreeItem="75169155-5d02-4ef4-a0ba-ef3fc40dfa30|-1;")
getchilddata_49 = GetChildData(ChimeraData=chimera_data_11, ChildDefinitionKeyOptional=getdatakey_86)
getchilddata_50 = GetChildData(ChimeraData=chimera_data_11, ChildDefinitionKeyOptional=getdatakey_88)
getchilddata_51 = GetChildData(ChimeraData=chimera_data_11, ChildDefinitionKeyOptional=getdatakey_87)
getchilddata_52 = GetChildData(ChimeraData=chimera_data_11, ChildDefinitionKeyOptional=getdatakey_89)
get_data_value_81 = GetDataValue(ChimeraData=getchilddata_49)
get_data_value_82 = GetDataValue(ChimeraData=getchilddata_50)
get_data_value_83 = GetDataValue(ChimeraData=getchilddata_52)
get_data_value_84 = GetDataValue(ChimeraData=getchilddata_51)
sort_duplicate_values_20 = SortDuplicateValues(ValueList=flatten(get_data_value_81))  # -> UniqueValues, Indices
ghpython_script_12 = GhPythonScript(
    uniqueAreas=sort_duplicate_values_20.UniqueValues,
    areasByFloor=get_data_value_81,
    effPercent=get_data_value_84,
    GSF=get_data_value_82,
    RSF=get_data_value_83)  # -> newAreasByFloor, newEffPercent, newGSF, newRSF; inputs uniqueAreas: list, areasByFloor: list, effPercent: list, GSF: list, RSF: list; same code as ghpython_script_2
sort_duplicate_values_21 = SortDuplicateValues(ValueList=flatten(ghpython_script_12.newAreasByFloor))  # -> UniqueValues, Indices
flatten_tree_37 = FlattenTree(Tree=ghpython_script_12.newEffPercent, Path="{0}")
flatten_tree_38 = FlattenTree(Tree=ghpython_script_12.newGSF, Path="{0}")
flatten_tree_39 = FlattenTree(Tree=ghpython_script_12.newRSF, Path="{0}")
round_to_decimal_place_11 = RoundToDecimalPlace(NumberX=flatten_tree_37, DecimalPlace=2, RoundType=0)  # -> Rounded, Difference
cluster_25 = Cluster(number=flatten_tree_38)
cluster_26 = Cluster(number=flatten_tree_39)
list_item_17 = ListItem(List=round_to_decimal_place_11.Rounded, Index=sort_duplicate_values_21.Indices, Wrap=True)
concatenate_10 = Concatenate(FragmentA=enum_value_10, FragmentB=" Areas")

getblockobjects_4 = GetBlockObjects(ObjectGuid=getblockobjects.ObjectGuidS)  # -> ObjectGuidS, InstanceTransform

enum_value_11 = Data(list_item.Item5)
chimera_data_12 = Data(dispatch_unweave.Out05)
getdatakey_90 = GetDataKey(TreeItem="a64d03de-ca92-4694-9c46-79f5d73b0afe|-1;")
getdatakey_91 = GetDataKey(TreeItem="c52f7483-d725-4c42-8378-d2ee2f8a3366|-1;")
getdatakey_92 = GetDataKey(TreeItem="829d644e-c9f6-4fcd-b2cd-fc78829fa806|-1;")
getdatakey_93 = GetDataKey(TreeItem="75169155-5d02-4ef4-a0ba-ef3fc40dfa30|-1;")
getchilddata_53 = GetChildData(ChimeraData=chimera_data_12, ChildDefinitionKeyOptional=getdatakey_90)
getchilddata_54 = GetChildData(ChimeraData=chimera_data_12, ChildDefinitionKeyOptional=getdatakey_92)
getchilddata_55 = GetChildData(ChimeraData=chimera_data_12, ChildDefinitionKeyOptional=getdatakey_91)
getchilddata_56 = GetChildData(ChimeraData=chimera_data_12, ChildDefinitionKeyOptional=getdatakey_93)
get_data_value_85 = GetDataValue(ChimeraData=getchilddata_53)
get_data_value_86 = GetDataValue(ChimeraData=getchilddata_54)
get_data_value_87 = GetDataValue(ChimeraData=getchilddata_56)
get_data_value_88 = GetDataValue(ChimeraData=getchilddata_55)
sort_duplicate_values_22 = SortDuplicateValues(ValueList=flatten(get_data_value_85))  # -> UniqueValues, Indices
ghpython_script_13 = GhPythonScript(
    uniqueAreas=sort_duplicate_values_22.UniqueValues,
    areasByFloor=get_data_value_85,
    effPercent=get_data_value_88,
    GSF=get_data_value_86,
    RSF=get_data_value_87)  # -> newAreasByFloor, newEffPercent, newGSF, newRSF; inputs uniqueAreas: list, areasByFloor: list, effPercent: list, GSF: list, RSF: list; same code as ghpython_script_2
sort_duplicate_values_23 = SortDuplicateValues(ValueList=flatten(ghpython_script_13.newAreasByFloor))  # -> UniqueValues, Indices
flatten_tree_40 = FlattenTree(Tree=ghpython_script_13.newEffPercent, Path="{0}")
flatten_tree_41 = FlattenTree(Tree=ghpython_script_13.newGSF, Path="{0}")
flatten_tree_42 = FlattenTree(Tree=ghpython_script_13.newRSF, Path="{0}")
round_to_decimal_place_12 = RoundToDecimalPlace(NumberX=flatten_tree_40, DecimalPlace=2, RoundType=0)  # -> Rounded, Difference
cluster_27 = Cluster(number=flatten_tree_41)
cluster_28 = Cluster(number=flatten_tree_42)
list_item_18 = ListItem(List=round_to_decimal_place_12.Rounded, Index=sort_duplicate_values_23.Indices, Wrap=True)
concatenate_11 = Concatenate(FragmentA=enum_value_11, FragmentB=" Areas")

mass_addition_7 = MassAddition(Input=replace_nulls.Items)  # -> Result, PartialResults
flatten_tree_43 = FlattenTree(Tree=mass_addition_5.Result, Path="{0}")

# ---- group: Building Height
data_7 = Data(clean_tree_3)

# ----
average_5 = Average(Input=replace_nulls_2.Items)
readobjectdata_4 = ReadObjectData(ObjectGuid=getblockobjects_4.ObjectGuidS, DataKeyOptional=getdatakey_37)
readobjectdata_5 = ReadObjectData(ObjectGuid=getblockobjects_4.ObjectGuidS, DataKeyOptional=getdatakey_36)
list_item_19 = ListItem(List=flatten_tree_18, Index=sort_duplicate_values.Indices, Wrap=True)
list_item_20 = ListItem(List=flatten_tree_12, Index=sort_duplicate_values.Indices, Wrap=True)
list_item_21 = ListItem(List=flatten_tree_17, Index=sort_duplicate_values.Indices, Wrap=True)
list_item_22 = ListItem(List=flatten_tree_16, Index=sort_duplicate_values.Indices, Wrap=True)

# ---- group: Total RSF
data_8 = Data(cluster_5)

# ---- group: Total GSF
data_9 = Data(cluster_6)

# ----
average_6 = Average(Input=flatten_tree_43)
flatten_tree_44 = FlattenTree(Tree=mass_addition_7.Result, Path="{0}")
transform = Transform(Geometry=getblockobjects_4.ObjectGuidS, Transform=graft(getblockobjects_4.InstanceTransform))
flatten_tree_45 = FlattenTree(Tree=list_item_19, Path="{0}")
flatten_tree_46 = FlattenTree(Tree=list_item_20, Path="{0}")
flatten_tree_47 = FlattenTree(Tree=list_item_21, Path="{0}")
flatten_tree_48 = FlattenTree(Tree=list_item_22, Path="{0}")
flatten_tree_49 = FlattenTree(Tree=average_5, Path="{0}")

# ---- group: Unit Totals by Type
data_10 = Data(get_data_value_39)

# ---- group: F2F Heights
data_11 = Data(get_data_value_22)

# ----
get_data_value_89 = GetDataValue(ChimeraData=readobjectdata_4)
get_data_value_90 = GetDataValue(ChimeraData=readobjectdata_5)
cluster_29 = Cluster(number=average_6)
round_to_decimal_place_13 = RoundToDecimalPlace(NumberX=flatten_tree_46, DecimalPlace=2, RoundType=0)  # -> Rounded, Difference
cluster_30 = Cluster(number=flatten_tree_49)
round_to_decimal_place_14 = RoundToDecimalPlace(NumberX=flatten_tree_48, DecimalPlace=2, RoundType=0)  # -> Rounded, Difference
round_to_decimal_place_15 = RoundToDecimalPlace(NumberX=flatten_tree_47, DecimalPlace=2, RoundType=0)  # -> Rounded, Difference

# ---- group: Avg Floor to Floor Heights
data_12 = Data(flatten_tree_45)

# ----
unit_z = UnitZ(Factor=data_11)
transform_2 = Transform(Geometry=transform, Transform=getblockobjects.InstanceTransform)
mass_addition_8 = MassAddition(Input=data_10)  # -> Result, PartialResults
list_item_23 = ListItem(List=getenumvalues_2, Index=get_data_value_90, Wrap=True)

# ---- group: Average Sf/Unit across selected bldgs
data_13 = Data(cluster_29)

# ----
extrude = Extrude(Base=transform_2, Direction=unit_z)
solid_union = SolidUnion(Breps=extrude)
merge_faces = MergeFaces(Brep=solid_union)  # -> Breps, Before, After
flatten_tree_50 = FlattenTree(Tree=merge_faces.Breps, Path="{0}")
solid_union_2 = SolidUnion(Breps=flatten_tree_50)
merge_faces_2 = MergeFaces(Brep=solid_union_2)  # -> Breps, Before, After
division_4 = Division(A=round_to_decimal_place_13.Rounded, B=100)

# ---- group: Unit Mix across all Buildings
data_14 = Data(get_data_value_37)

# ---- group: Total Unit Count
data_15 = Data(mass_addition_8.Result)

# ---- group: Avg Floor Perimeter
data_16 = Data(round_to_decimal_place_15.Rounded)

# ----
round_to_decimal_place_16 = RoundToDecimalPlace(NumberX=data_14, DecimalPlace=2, RoundType=0)  # -> Rounded, Difference

# ---- group: Floor Numbers
text_4 = Text(get_data_value_23)

# ---- group: Avg Floor Efficiency
data_17 = Data(division_4)

# ----
concatenate_12 = Concatenate(Fragment_A="MYST::Areas::", Fragment_B=list_item_23, A="::", B=get_data_value_89)

# ---- group: Facade Area by Floor
multiplication_3 = Multiplication(A=data_12, B=data_16)

# ----
sort_list_8 = SortList(Keys=data_6, ValuesValuesA=multiplication_3)  # -> Keys, ValuesValuesA
multiplication_4 = Multiplication(A=sort_list_8.ValuesValuesA, B=graft(division_3))
multiplication_5 = Multiplication(A=multiplication_4, B=graft(key_value_search))
round_to_decimal_place_17 = RoundToDecimalPlace(NumberX=multiplication_5, DecimalPlace=2, RoundType=0)  # -> Rounded, Difference
cluster_31 = Cluster(number=multiplication_4)
path_mapper_3 = PathMapper(round_to_decimal_place_17.Rounded, source="{A;B;C}(i)", target="{i}")

# ---- group: Material SF by Floor
data_18 = Data(cluster_31)

# ----
mass_addition_9 = MassAddition(Input=path_mapper_3)  # -> flatten(Result), PartialResults
list_length_2 = ListLength(List=data_18)
cluster_32 = Cluster(number=round_to_decimal_place_17.Rounded)
repeat_data = RepeatData(Data=number_3, Length=list_length_2)
data_exists = DataExists(Data=path_mapper_3)
cluster_33 = Cluster(number=mass_addition_9.Result)
concatenate_13 = Concatenate(FragmentA="$", FragmentB=cluster_32)
stream_filter_2 = StreamFilter(Gate=data_exists, Stream0=repeat_data, Stream1=cluster_33)

# ---- group: Avg GSF by Floor
data_19 = Data(round_to_decimal_place_14.Rounded)

# ----
concatenate_14 = Concatenate(FragmentA="$", FragmentB=stream_filter_2)

# ---- group: Selected Building Name
text_5 = Text(get_data_value_18)

# ---- group: Cost/Material by Floor
data_20 = Data(concatenate_13)

# ----
multiplication_6 = Multiplication(A=data_19, B=data_17)
concatenate_15 = Concatenate(FragmentA=round_to_decimal_place_16.Rounded, FragmentB="%")
concatenate_16 = Concatenate(FragmentA=data_17, FragmentB="%")

# ---- group: Total Cost/Material by Floor
data_21 = Data(concatenate_14)

# ----
concatenate_17 = Concatenate(FragmentA="MYST::Building::", FragmentB=text_5)
concatenate_18 = Concatenate(FragmentA="MYST::Floors::Floor ", FragmentB=text_4)
ghpython_script_14 = GhPythonScript(x=round_to_decimal_place_16.Rounded)  # -> a; inputs x: list; same code as ghpython_script_2
brep = Brep(getblockobjects_4.ObjectGuidS)
cluster_34 = Cluster(number=multiplication_6)
cluster_35 = Cluster(number=multiplication_3)
cluster_36 = Cluster(number=data_16)
cluster_37 = Cluster(number=data_19)
ghpython_script_15 = GhPythonScript(x=text_4)  # -> a; inputs x: list; same code as ghpython_script_2
stream_filter_3 = StreamFilter(Gate=ghpython_script_14, Stream1=concatenate_15)
object_attributes = ObjectAttributes(ObjectOrAttributes=brep)  # -> Name, LayerName, LayerFullPath, Color, MaterialName, LinetypeName, GroupIndices, PlotWeight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
panel_8 = Panel(data_21)
dispatch_4 = Dispatch(List=concatenate_18, DispatchPattern=ghpython_script_15)  # -> ListA, ListB

# ---- group: Avg Floor RSF
data_22 = Data(cluster_34)

# ----
sort_list_9 = SortList(Keys=data_6, ValuesValuesA=cluster_36)  # -> Keys, ValuesValuesA
sort_list_10 = SortList(Keys=data_6, ValuesValuesA=cluster_37)  # -> Keys, ValuesValuesA
sort_list_11 = SortList(Keys=data_6, ValuesValuesA=data_22)  # -> Keys, ValuesValuesA
sort_list_12 = SortList(Keys=data_6, ValuesValuesA=concatenate_16)  # -> Keys, ValuesValuesA
sort_list_13 = SortList(Keys=data_6, ValuesValuesA=cluster_35)  # -> Keys, ValuesValuesA
sort_list_14 = SortList(Keys=data_6, ValuesValuesA=data_12)  # -> Keys, ValuesValuesA
key_value_search_5 = KeyValueSearch(Keys=layer_table.FullLayerPaths, Values=layer_table.LayerColors, Search=object_attributes.LayerFullPath)
flatten_tree_51 = FlattenTree(Tree=key_value_search_5, Path="{0}")

# ---- group: Efficiency %
concatenate_19 = Concatenate(FragmentA=list_item_7, FragmentB="%")

concatenate_20 = Concatenate(FragmentA=list_item_8, FragmentB="%")

concatenate_21 = Concatenate(FragmentA=list_item_10, FragmentB="%")

concatenate_22 = Concatenate(FragmentA=list_item_11, FragmentB="%")

concatenate_23 = Concatenate(FragmentA=list_item_12, FragmentB="%")

concatenate_24 = Concatenate(FragmentA=list_item_13, FragmentB="%")

concatenate_25 = Concatenate(FragmentA=list_item_16, FragmentB="%")

concatenate_26 = Concatenate(FragmentA=list_item_14, FragmentB="%")

concatenate_27 = Concatenate(FragmentA=list_item_15, FragmentB="%")

concatenate_28 = Concatenate(FragmentA=list_item_17, FragmentB="%")

concatenate_29 = Concatenate(FragmentA=list_item_18, FragmentB="%")

# ---- group: GSF
list_item_24 = ListItem(List=cluster_7, Index=sort_duplicate_values_3.Indices, Wrap=True)

# ---- group: RSF
list_item_25 = ListItem(List=cluster_8, Index=sort_duplicate_values_3.Indices, Wrap=True)

# ---- group: GSF
list_item_26 = ListItem(List=cluster_9, Index=sort_duplicate_values_5.Indices, Wrap=True)

# ---- group: RSF
list_item_27 = ListItem(List=cluster_10, Index=sort_duplicate_values_5.Indices, Wrap=True)

# ---- group: GSF
list_item_28 = ListItem(List=cluster_11, Index=sort_duplicate_values_7.Indices, Wrap=True)

# ---- group: RSF
list_item_29 = ListItem(List=cluster_12, Index=sort_duplicate_values_7.Indices, Wrap=True)

# ---- group: GSF
list_item_30 = ListItem(List=cluster_13, Index=sort_duplicate_values_9.Indices, Wrap=True)

# ---- group: RSF
list_item_31 = ListItem(List=cluster_14, Index=sort_duplicate_values_9.Indices, Wrap=True)

# ---- group: GSF
list_item_32 = ListItem(List=cluster_15, Index=sort_duplicate_values_11.Indices, Wrap=True)

# ---- group: RSF
list_item_33 = ListItem(List=cluster_16, Index=sort_duplicate_values_11.Indices, Wrap=True)

# ---- group: Unique Names
data_23 = Data(sort_duplicate_values_3.UniqueValues)

# ---- group: GSF
list_item_34 = ListItem(List=cluster_17, Index=sort_duplicate_values_13.Indices, Wrap=True)

# ---- group: RSF
list_item_35 = ListItem(List=cluster_18, Index=sort_duplicate_values_13.Indices, Wrap=True)

# ---- group: Table Title
data_24 = Data(concatenate)

# ---- group: GSF
list_item_36 = ListItem(List=cluster_23, Index=sort_duplicate_values_19.Indices, Wrap=True)

# ---- group: RSF
list_item_37 = ListItem(List=cluster_24, Index=sort_duplicate_values_19.Indices, Wrap=True)

# ---- group: GSF
list_item_38 = ListItem(List=cluster_19, Index=sort_duplicate_values_15.Indices, Wrap=True)

# ---- group: RSF
list_item_39 = ListItem(List=cluster_20, Index=sort_duplicate_values_15.Indices, Wrap=True)

# ---- group: GSF
list_item_40 = ListItem(List=cluster_21, Index=sort_duplicate_values_17.Indices, Wrap=True)

# ---- group: RSF
list_item_41 = ListItem(List=cluster_22, Index=sort_duplicate_values_17.Indices, Wrap=True)

# ---- group: Unique Names
data_25 = Data(sort_duplicate_values_5.UniqueValues)

# ---- group: Table Title
data_26 = Data(concatenate_2)

data_27 = Data(concatenate_3)

# ---- group: Unique Names
data_28 = Data(sort_duplicate_values_7.UniqueValues)

# ---- group: GSF
list_item_42 = ListItem(List=cluster_25, Index=sort_duplicate_values_21.Indices, Wrap=True)

# ---- group: RSF
list_item_43 = ListItem(List=cluster_26, Index=sort_duplicate_values_21.Indices, Wrap=True)

# ---- group: GSF
list_item_44 = ListItem(List=cluster_27, Index=sort_duplicate_values_23.Indices, Wrap=True)

# ---- group: RSF
list_item_45 = ListItem(List=cluster_28, Index=sort_duplicate_values_23.Indices, Wrap=True)

# ---- group: Unique Names
data_29 = Data(sort_duplicate_values_9.UniqueValues)

# ---- group: Table Title
data_30 = Data(concatenate_4)

# ---- group: Unique Names
data_31 = Data(sort_duplicate_values_11.UniqueValues)

# ---- group: Table Title
data_32 = Data(concatenate_5)

# ---- group: Unique Names
data_33 = Data(sort_duplicate_values_13.UniqueValues)

# ---- group: Table Title
data_34 = Data(concatenate_6)

# ---- group: Unique Names
data_35 = Data(sort_duplicate_values_15.UniqueValues)

# ---- group: Table Title
data_36 = Data(concatenate_7)

data_37 = Data(concatenate_8)

# ---- group: Unique Names
data_38 = Data(sort_duplicate_values_17.UniqueValues)

# ---- group: Table Title
data_39 = Data(concatenate_9)

# ---- group: Unique Names
data_40 = Data(sort_duplicate_values_19.UniqueValues)

data_41 = Data(sort_duplicate_values_21.UniqueValues)

# ---- group: Table Title
data_42 = Data(concatenate_10)

# ---- group: Unique Names
data_43 = Data(sort_duplicate_values_23.UniqueValues)

# ---- group: Table Title
data_44 = Data(concatenate_11)

# ---- group: Area Layer Full Paths
text_6 = Text(flatten(concatenate_12))

# ---- group: Floor Layer Full Paths
text_7 = Text(flatten(dispatch_4.ListA))

# ---- group: Building Layer Full Paths
text_8 = Text(flatten(concatenate_17))

# ---- group: Data
entwine_9 = Entwine(Branch00=concatenate_19, Branch01=list_item_24, Branch02=list_item_25, FlattenInputs=True)

entwine_10 = Entwine(Branch00=concatenate_20, Branch01=list_item_26, Branch02=list_item_27, FlattenInputs=True)

entwine_11 = Entwine(Branch00=concatenate_21, Branch01=list_item_28, Branch02=list_item_29, FlattenInputs=True)

entwine_12 = Entwine(Branch00=concatenate_22, Branch01=list_item_30, Branch02=list_item_31, FlattenInputs=True)

entwine_13 = Entwine(Branch00=concatenate_23, Branch01=list_item_32, Branch02=list_item_33, FlattenInputs=True)

# ---- group: Floor Numbers
data_45 = Data(sort_list.Keys)

# ----
entwine_14 = Entwine(FlattenInputs=True)
nulls_in_empty_branches = NullsInEmptyBranches(DataWithEmptyBranches=entwine_14)
unique_area_names = Data(data_23)
panel_9 = Panel("""Eff %
GSF
RSF""")
flatten_tree_52 = FlattenTree(Tree=nulls_in_empty_branches, Path="{0}")
list_length_3 = ListLength(List=data_45)
concatenate_30 = Concatenate(Fragment_A=graft(unique_area_names), Fragment_B=graft(" "), A=panel_9)
list_length_4 = ListLength(List=flatten_tree_52)
partition_list = PartitionList(List=entwine_9, Size=list_length_3)
series = Series(Start=0, Step=1, Count=list_length_4)
flatten_tree_53 = FlattenTree(Tree=concatenate_30, Path="{0}")
path_mapper_4 = PathMapper(partition_list, source="{A;B;C}", target="{C;B}")
create_data_table = CreateDataTable(Data=entwine_14, ColumnHeadings=series, AllowSorting=True, ColumnSizingMode=-4)
stack_trees = StackTrees(Data0=data_45, Data1=path_mapper_4, Reduce=True)
create_label_10 = CreateLabel(LabelText="Area Breakdowns", LabelSize=18, Justification=0)  # -> simplify(Label)
stack_trees_2 = StackTrees(Data0="Floor Levels", Data1=flatten_tree_53, Reduce=True)  # -> flatten(Tree)
set_data_table = SetDataTable(DataTableToSet=create_data_table, Data=stack_trees, ColumnHeadings=stack_trees_2)
flatten_tree_54 = FlattenTree(Tree=chimera_data_2, Path="{0}")
set_label_contents_3 = SetLabelContents(LabelToModify=create_label_10, NewLabelContents=data_24)
ghpython_script_16 = GhPythonScript(x=flatten_tree_54)  # -> a; inputs x: list; same code as ghpython_script
create_separator_3 = CreateSeparator(Thickness=0.5, Horizontal=True, Color=RGB(0, 0, 0))
merge_6 = Merge(Data1=create_label_10, Data2=simplify(create_data_table), Data3=create_separator_3)
hide_show_element_2 = HideShowElement(ElementToHideShow=merge_6, Show=ghpython_script_16, Collapse=True, Disable=False)

# ---- group: Data
entwine_15 = Entwine(Branch00=concatenate_24, Branch01=list_item_34, Branch02=list_item_35, FlattenInputs=True)

entwine_16 = Entwine(Branch00=concatenate_25, Branch01=list_item_36, Branch02=list_item_37, FlattenInputs=True)

entwine_17 = Entwine(Branch00=concatenate_26, Branch01=list_item_38, Branch02=list_item_39, FlattenInputs=True)

entwine_18 = Entwine(Branch00=concatenate_27, Branch01=list_item_40, Branch02=list_item_41, FlattenInputs=True)

# ---- group: Floor Numbers
data_46 = Data(sort_list.Keys)

# ----
entwine_19 = Entwine(FlattenInputs=True)
nulls_in_empty_branches_2 = NullsInEmptyBranches(DataWithEmptyBranches=entwine_19)
unique_area_names_2 = Data(data_25)
panel_10 = Panel("""Eff %
GSF
RSF""")
flatten_tree_55 = FlattenTree(Tree=nulls_in_empty_branches_2, Path="{0}")
list_length_5 = ListLength(List=data_46)
concatenate_31 = Concatenate(Fragment_A=graft(unique_area_names_2), Fragment_B=graft(" "), A=panel_10)
list_length_6 = ListLength(List=flatten_tree_55)
partition_list_2 = PartitionList(List=entwine_10, Size=list_length_5)
series_2 = Series(Start=0, Step=1, Count=list_length_6)
flatten_tree_56 = FlattenTree(Tree=concatenate_31, Path="{0}")
path_mapper_5 = PathMapper(partition_list_2, source="{A;B;C}", target="{C;B}")
create_data_table_2 = CreateDataTable(Data=entwine_19, ColumnHeadings=series_2, AllowSorting=True, ColumnSizingMode=-4)
stack_trees_3 = StackTrees(Data0=data_46, Data1=path_mapper_5, Reduce=True)
create_label_11 = CreateLabel(LabelText="Area Breakdowns", LabelSize=18, Justification=0)  # -> simplify(Label)
stack_trees_4 = StackTrees(Data0="Floor Levels", Data1=flatten_tree_56, Reduce=True)  # -> flatten(Tree)
set_data_table_2 = SetDataTable(DataTableToSet=create_data_table_2, Data=stack_trees_3, ColumnHeadings=stack_trees_4)
flatten_tree_57 = FlattenTree(Tree=chimera_data_3, Path="{0}")
set_label_contents_4 = SetLabelContents(LabelToModify=create_label_11, NewLabelContents=data_26)
ghpython_script_17 = GhPythonScript(x=flatten_tree_57)  # -> a; inputs x: list; same code as ghpython_script
create_separator_4 = CreateSeparator(Thickness=0.5, Horizontal=True, Color=RGB(0, 0, 0))
merge_7 = Merge(Data1=create_label_11, Data2=simplify(create_data_table_2), Data3=create_separator_4)
hide_show_element_3 = HideShowElement(ElementToHideShow=merge_7, Show=ghpython_script_17, Collapse=True, Disable=False)

# ---- group: Floor Numbers
data_47 = Data(sort_list.Keys)

# ----
entwine_20 = Entwine(FlattenInputs=True)
nulls_in_empty_branches_3 = NullsInEmptyBranches(DataWithEmptyBranches=entwine_20)
unique_area_names_3 = Data(data_28)
panel_11 = Panel("""Eff %
GSF
RSF""")
flatten_tree_58 = FlattenTree(Tree=nulls_in_empty_branches_3, Path="{0}")
list_length_7 = ListLength(List=data_47)
concatenate_32 = Concatenate(Fragment_A=graft(unique_area_names_3), Fragment_B=graft(" "), A=panel_11)
list_length_8 = ListLength(List=flatten_tree_58)
partition_list_3 = PartitionList(List=entwine_11, Size=list_length_7)
series_3 = Series(Start=0, Step=1, Count=list_length_8)
flatten_tree_59 = FlattenTree(Tree=concatenate_32, Path="{0}")
path_mapper_6 = PathMapper(partition_list_3, source="{A;B;C}", target="{C;B}")
create_data_table_3 = CreateDataTable(Data=entwine_20, ColumnHeadings=series_3, AllowSorting=True, ColumnSizingMode=-4)
stack_trees_5 = StackTrees(Data0=data_47, Data1=path_mapper_6, Reduce=True)
create_label_12 = CreateLabel(LabelText="Area Breakdowns", LabelSize=18, Justification=0)  # -> simplify(Label)
stack_trees_6 = StackTrees(Data0="Floor Levels", Data1=flatten_tree_59, Reduce=True)  # -> flatten(Tree)
set_data_table_3 = SetDataTable(DataTableToSet=create_data_table_3, Data=stack_trees_5, ColumnHeadings=stack_trees_6)
flatten_tree_60 = FlattenTree(Tree=chimera_data_4, Path="{0}")
set_label_contents_5 = SetLabelContents(LabelToModify=create_label_12, NewLabelContents=data_27)
ghpython_script_18 = GhPythonScript(x=flatten_tree_60)  # -> a; inputs x: list; same code as ghpython_script
create_separator_5 = CreateSeparator(Thickness=0.5, Horizontal=True, Color=RGB(0, 0, 0))
merge_8 = Merge(Data1=create_label_12, Data2=simplify(create_data_table_3), Data3=create_separator_5)
hide_show_element_4 = HideShowElement(ElementToHideShow=merge_8, Show=ghpython_script_18, Collapse=True, Disable=False)

# ---- group: Data
entwine_21 = Entwine(Branch00=concatenate_28, Branch01=list_item_42, Branch02=list_item_43, FlattenInputs=True)

# ---- group: Building Material Names
text_9 = Text(data_3)

# ---- group: Data
entwine_22 = Entwine(Branch00=concatenate_29, Branch01=list_item_44, Branch02=list_item_45, FlattenInputs=True)

# ---- group: Building Material %
number_4 = Number(data_4)

# ---- group: Floor Numbers
data_48 = Data(sort_list.Keys)

# ----
entwine_23 = Entwine(FlattenInputs=True)
nulls_in_empty_branches_4 = NullsInEmptyBranches(DataWithEmptyBranches=entwine_23)
unique_area_names_4 = Data(data_29)
panel_12 = Panel("""Eff %
GSF
RSF""")
flatten_tree_61 = FlattenTree(Tree=nulls_in_empty_branches_4, Path="{0}")
list_length_9 = ListLength(List=data_48)
concatenate_33 = Concatenate(Fragment_A=graft(unique_area_names_4), Fragment_B=graft(" "), A=panel_12)
list_length_10 = ListLength(List=flatten_tree_61)
partition_list_4 = PartitionList(List=entwine_12, Size=list_length_9)
series_4 = Series(Start=0, Step=1, Count=list_length_10)
flatten_tree_62 = FlattenTree(Tree=concatenate_33, Path="{0}")
path_mapper_7 = PathMapper(partition_list_4, source="{A;B;C}", target="{C;B}")
create_data_table_4 = CreateDataTable(Data=entwine_23, ColumnHeadings=series_4, AllowSorting=True, ColumnSizingMode=-4)
stack_trees_7 = StackTrees(Data0=data_48, Data1=path_mapper_7, Reduce=True)
create_label_13 = CreateLabel(LabelText="Area Breakdowns", LabelSize=18, Justification=0)  # -> simplify(Label)
stack_trees_8 = StackTrees(Data0="Floor Levels", Data1=flatten_tree_62, Reduce=True)  # -> flatten(Tree)
set_data_table_4 = SetDataTable(DataTableToSet=create_data_table_4, Data=stack_trees_7, ColumnHeadings=stack_trees_8)
flatten_tree_63 = FlattenTree(Tree=chimera_data_5, Path="{0}")
set_label_contents_6 = SetLabelContents(LabelToModify=create_label_13, NewLabelContents=data_30)
ghpython_script_19 = GhPythonScript(x=flatten_tree_63)  # -> a; inputs x: list; same code as ghpython_script
create_separator_6 = CreateSeparator(Thickness=0.5, Horizontal=True, Color=RGB(0, 0, 0))
merge_9 = Merge(Data1=create_label_13, Data2=simplify(create_data_table_4), Data3=create_separator_6)
hide_show_element_5 = HideShowElement(ElementToHideShow=merge_9, Show=ghpython_script_19, Collapse=True, Disable=False)

# ---- group: Floor Numbers
data_49 = Data(sort_list.Keys)

# ----
entwine_24 = Entwine(FlattenInputs=True)
nulls_in_empty_branches_5 = NullsInEmptyBranches(DataWithEmptyBranches=entwine_24)
unique_area_names_5 = Data(data_31)
panel_13 = Panel("""Eff %
GSF
RSF""")
flatten_tree_64 = FlattenTree(Tree=nulls_in_empty_branches_5, Path="{0}")
list_length_11 = ListLength(List=data_49)
concatenate_34 = Concatenate(Fragment_A=graft(unique_area_names_5), Fragment_B=graft(" "), A=panel_13)
list_length_12 = ListLength(List=flatten_tree_64)
partition_list_5 = PartitionList(List=entwine_13, Size=list_length_11)
series_5 = Series(Start=0, Step=1, Count=list_length_12)
flatten_tree_65 = FlattenTree(Tree=concatenate_34, Path="{0}")
path_mapper_8 = PathMapper(partition_list_5, source="{A;B;C}", target="{C;B}")
create_data_table_5 = CreateDataTable(Data=entwine_24, ColumnHeadings=series_5, AllowSorting=True, ColumnSizingMode=-4)
stack_trees_9 = StackTrees(Data0=data_49, Data1=path_mapper_8, Reduce=True)
create_label_14 = CreateLabel(LabelText="Area Breakdowns", LabelSize=18, Justification=0)  # -> simplify(Label)
stack_trees_10 = StackTrees(Data0="Floor Levels", Data1=flatten_tree_65, Reduce=True)  # -> flatten(Tree)
set_data_table_5 = SetDataTable(DataTableToSet=create_data_table_5, Data=stack_trees_9, ColumnHeadings=stack_trees_10)
flatten_tree_66 = FlattenTree(Tree=chimera_data_6, Path="{0}")
set_label_contents_7 = SetLabelContents(LabelToModify=create_label_14, NewLabelContents=data_32)
ghpython_script_20 = GhPythonScript(x=flatten_tree_66)  # -> a; inputs x: list; same code as ghpython_script
create_separator_7 = CreateSeparator(Thickness=0.5, Horizontal=True, Color=RGB(0, 0, 0))
merge_10 = Merge(Data1=create_label_14, Data2=simplify(create_data_table_5), Data3=create_separator_7)
hide_show_element_6 = HideShowElement(ElementToHideShow=merge_10, Show=ghpython_script_20, Collapse=True, Disable=False)

# ---- group: Floor Numbers
data_50 = Data(sort_list.Keys)

# ----
entwine_25 = Entwine(FlattenInputs=True)
nulls_in_empty_branches_6 = NullsInEmptyBranches(DataWithEmptyBranches=entwine_25)
unique_area_names_6 = Data(data_33)
panel_14 = Panel("""Eff %
GSF
RSF""")
flatten_tree_67 = FlattenTree(Tree=nulls_in_empty_branches_6, Path="{0}")
list_length_13 = ListLength(List=data_50)
concatenate_35 = Concatenate(Fragment_A=graft(unique_area_names_6), Fragment_B=graft(" "), A=panel_14)
list_length_14 = ListLength(List=flatten_tree_67)
partition_list_6 = PartitionList(List=entwine_15, Size=list_length_13)
series_6 = Series(Start=0, Step=1, Count=list_length_14)
flatten_tree_68 = FlattenTree(Tree=concatenate_35, Path="{0}")
path_mapper_9 = PathMapper(partition_list_6, source="{A;B;C}", target="{C;B}")
create_data_table_6 = CreateDataTable(Data=entwine_25, ColumnHeadings=series_6, AllowSorting=True, ColumnSizingMode=-4)
stack_trees_11 = StackTrees(Data0=data_50, Data1=path_mapper_9, Reduce=True)
create_label_15 = CreateLabel(LabelText="Area Breakdowns", LabelSize=18, Justification=0)  # -> simplify(Label)
stack_trees_12 = StackTrees(Data0="Floor Levels", Data1=flatten_tree_68, Reduce=True)  # -> flatten(Tree)
set_data_table_6 = SetDataTable(DataTableToSet=create_data_table_6, Data=stack_trees_11, ColumnHeadings=stack_trees_12)
flatten_tree_69 = FlattenTree(Tree=chimera_data_7, Path="{0}")
set_label_contents_8 = SetLabelContents(LabelToModify=create_label_15, NewLabelContents=data_34)
ghpython_script_21 = GhPythonScript(x=flatten_tree_69)  # -> a; inputs x: list; same code as ghpython_script
create_separator_8 = CreateSeparator(Thickness=0.5, Horizontal=True, Color=RGB(0, 0, 0))
merge_11 = Merge(Data1=create_label_15, Data2=simplify(create_data_table_6), Data3=create_separator_8)
hide_show_element_7 = HideShowElement(ElementToHideShow=merge_11, Show=ghpython_script_21, Collapse=True, Disable=False)

# ---- group: Floor Numbers
data_51 = Data(sort_list.Keys)

# ----
entwine_26 = Entwine(FlattenInputs=True)
nulls_in_empty_branches_7 = NullsInEmptyBranches(DataWithEmptyBranches=entwine_26)
unique_area_names_7 = Data(data_35)
panel_15 = Panel("""Eff %
GSF
RSF""")
flatten_tree_70 = FlattenTree(Tree=nulls_in_empty_branches_7, Path="{0}")
list_length_15 = ListLength(List=data_51)
concatenate_36 = Concatenate(Fragment_A=graft(unique_area_names_7), Fragment_B=graft(" "), A=panel_15)
list_length_16 = ListLength(List=flatten_tree_70)
partition_list_7 = PartitionList(List=entwine_17, Size=list_length_15)
series_7 = Series(Start=0, Step=1, Count=list_length_16)
flatten_tree_71 = FlattenTree(Tree=concatenate_36, Path="{0}")
path_mapper_10 = PathMapper(partition_list_7, source="{A;B;C}", target="{C;B}")
create_data_table_7 = CreateDataTable(Data=entwine_26, ColumnHeadings=series_7, AllowSorting=True, ColumnSizingMode=-4)
stack_trees_13 = StackTrees(Data0=data_51, Data1=path_mapper_10, Reduce=True)
create_label_16 = CreateLabel(LabelText="Area Breakdowns", LabelSize=18, Justification=0)  # -> simplify(Label)
stack_trees_14 = StackTrees(Data0="Floor Levels", Data1=flatten_tree_71, Reduce=True)  # -> flatten(Tree)
set_data_table_7 = SetDataTable(DataTableToSet=create_data_table_7, Data=stack_trees_13, ColumnHeadings=stack_trees_14)
flatten_tree_72 = FlattenTree(Tree=chimera_data_8, Path="{0}")
set_label_contents_9 = SetLabelContents(LabelToModify=create_label_16, NewLabelContents=data_36)
ghpython_script_22 = GhPythonScript(x=flatten_tree_72)  # -> a; inputs x: list; same code as ghpython_script
create_separator_9 = CreateSeparator(Thickness=0.5, Horizontal=True, Color=RGB(0, 0, 0))
merge_12 = Merge(Data1=create_label_16, Data2=simplify(create_data_table_7), Data3=create_separator_9)
hide_show_element_8 = HideShowElement(ElementToHideShow=merge_12, Show=ghpython_script_22, Collapse=True, Disable=False)

# ---- group: Floor Numbers
data_52 = Data(sort_list.Keys)

# ----
entwine_27 = Entwine(FlattenInputs=True)
nulls_in_empty_branches_8 = NullsInEmptyBranches(DataWithEmptyBranches=entwine_27)
unique_area_names_8 = Data(data_38)
panel_16 = Panel("""Eff %
GSF
RSF""")
flatten_tree_73 = FlattenTree(Tree=nulls_in_empty_branches_8, Path="{0}")
list_length_17 = ListLength(List=data_52)
concatenate_37 = Concatenate(Fragment_A=graft(unique_area_names_8), Fragment_B=graft(" "), A=panel_16)
list_length_18 = ListLength(List=flatten_tree_73)
partition_list_8 = PartitionList(List=entwine_18, Size=list_length_17)
series_8 = Series(Start=0, Step=1, Count=list_length_18)
flatten_tree_74 = FlattenTree(Tree=concatenate_37, Path="{0}")
path_mapper_11 = PathMapper(partition_list_8, source="{A;B;C}", target="{C;B}")
create_data_table_8 = CreateDataTable(Data=entwine_27, ColumnHeadings=series_8, AllowSorting=True, ColumnSizingMode=-4)
stack_trees_15 = StackTrees(Data0=data_52, Data1=path_mapper_11, Reduce=True)
create_label_17 = CreateLabel(LabelText="Area Breakdowns", LabelSize=18, Justification=0)  # -> simplify(Label)
stack_trees_16 = StackTrees(Data0="Floor Levels", Data1=flatten_tree_74, Reduce=True)  # -> flatten(Tree)
set_data_table_8 = SetDataTable(DataTableToSet=create_data_table_8, Data=stack_trees_15, ColumnHeadings=stack_trees_16)
flatten_tree_75 = FlattenTree(Tree=chimera_data_9, Path="{0}")
set_label_contents_10 = SetLabelContents(LabelToModify=create_label_17, NewLabelContents=data_37)
ghpython_script_23 = GhPythonScript(x=flatten_tree_75)  # -> a; inputs x: list; same code as ghpython_script
create_separator_10 = CreateSeparator(Thickness=0.5, Horizontal=True, Color=RGB(0, 0, 0))
merge_13 = Merge(Data1=create_label_17, Data2=simplify(create_data_table_8), Data3=create_separator_10)
hide_show_element_9 = HideShowElement(ElementToHideShow=merge_13, Show=ghpython_script_23, Collapse=True, Disable=False)

# ---- group: Floor Numbers
data_53 = Data(sort_list.Keys)

# ----
entwine_28 = Entwine(FlattenInputs=True)
nulls_in_empty_branches_9 = NullsInEmptyBranches(DataWithEmptyBranches=entwine_28)
unique_area_names_9 = Data(data_40)
panel_17 = Panel("""Eff %
GSF
RSF""")
flatten_tree_76 = FlattenTree(Tree=nulls_in_empty_branches_9, Path="{0}")
list_length_19 = ListLength(List=data_53)
concatenate_38 = Concatenate(Fragment_A=graft(unique_area_names_9), Fragment_B=graft(" "), A=panel_17)
list_length_20 = ListLength(List=flatten_tree_76)
partition_list_9 = PartitionList(List=entwine_16, Size=list_length_19)
series_9 = Series(Start=0, Step=1, Count=list_length_20)
flatten_tree_77 = FlattenTree(Tree=concatenate_38, Path="{0}")
path_mapper_12 = PathMapper(partition_list_9, source="{A;B;C}", target="{C;B}")
create_data_table_9 = CreateDataTable(Data=entwine_28, ColumnHeadings=series_9, AllowSorting=True, ColumnSizingMode=-4)
stack_trees_17 = StackTrees(Data0=data_53, Data1=path_mapper_12, Reduce=True)
create_label_18 = CreateLabel(LabelText="Area Breakdowns", LabelSize=18, Justification=0)  # -> simplify(Label)
stack_trees_18 = StackTrees(Data0="Floor Levels", Data1=flatten_tree_77, Reduce=True)  # -> flatten(Tree)
set_data_table_9 = SetDataTable(DataTableToSet=create_data_table_9, Data=stack_trees_17, ColumnHeadings=stack_trees_18)
flatten_tree_78 = FlattenTree(Tree=chimera_data_10, Path="{0}")
set_label_contents_11 = SetLabelContents(LabelToModify=create_label_18, NewLabelContents=data_39)
ghpython_script_24 = GhPythonScript(x=flatten_tree_78)  # -> a; inputs x: list; same code as ghpython_script
create_separator_11 = CreateSeparator(Thickness=0.5, Horizontal=True, Color=RGB(0, 0, 0))
merge_14 = Merge(Data1=create_label_18, Data2=simplify(create_data_table_9), Data3=create_separator_11)
hide_show_element_10 = HideShowElement(ElementToHideShow=merge_14, Show=ghpython_script_24, Collapse=True, Disable=False)

# ---- group: Floor Numbers
data_54 = Data(sort_list.Keys)

# ----
entwine_29 = Entwine(FlattenInputs=True)
nulls_in_empty_branches_10 = NullsInEmptyBranches(DataWithEmptyBranches=entwine_29)
unique_area_names_10 = Data(data_41)
panel_18 = Panel("""Eff %
GSF
RSF""")
flatten_tree_79 = FlattenTree(Tree=nulls_in_empty_branches_10, Path="{0}")
list_length_21 = ListLength(List=data_54)
concatenate_39 = Concatenate(Fragment_A=graft(unique_area_names_10), Fragment_B=graft(" "), A=panel_18)
list_length_22 = ListLength(List=flatten_tree_79)
partition_list_10 = PartitionList(List=entwine_21, Size=list_length_21)
series_10 = Series(Start=0, Step=1, Count=list_length_22)
flatten_tree_80 = FlattenTree(Tree=concatenate_39, Path="{0}")
path_mapper_13 = PathMapper(partition_list_10, source="{A;B;C}", target="{C;B}")
create_data_table_10 = CreateDataTable(Data=entwine_29, ColumnHeadings=series_10, AllowSorting=True, ColumnSizingMode=-4)
stack_trees_19 = StackTrees(Data0=data_54, Data1=path_mapper_13, Reduce=True)
create_label_19 = CreateLabel(LabelText="Area Breakdowns", LabelSize=18, Justification=0)  # -> simplify(Label)
stack_trees_20 = StackTrees(Data0="Floor Levels", Data1=flatten_tree_80, Reduce=True)  # -> flatten(Tree)
set_data_table_10 = SetDataTable(DataTableToSet=create_data_table_10, Data=stack_trees_19, ColumnHeadings=stack_trees_20)
flatten_tree_81 = FlattenTree(Tree=chimera_data_11, Path="{0}")
set_label_contents_12 = SetLabelContents(LabelToModify=create_label_19, NewLabelContents=data_42)
ghpython_script_25 = GhPythonScript(x=flatten_tree_81)  # -> a; inputs x: list; same code as ghpython_script
create_separator_12 = CreateSeparator(Thickness=0.5, Horizontal=True, Color=RGB(0, 0, 0))
merge_15 = Merge(Data1=create_label_19, Data2=simplify(create_data_table_10), Data3=create_separator_12)
hide_show_element_11 = HideShowElement(ElementToHideShow=merge_15, Show=ghpython_script_25, Collapse=True, Disable=False)

# ---- group: Floor Numbers
data_55 = Data(sort_list.Keys)

# ----
entwine_30 = Entwine(FlattenInputs=True)
nulls_in_empty_branches_11 = NullsInEmptyBranches(DataWithEmptyBranches=entwine_30)
unique_area_names_11 = Data(data_43)
panel_19 = Panel("""Eff %
GSF
RSF""")
flatten_tree_82 = FlattenTree(Tree=nulls_in_empty_branches_11, Path="{0}")
list_length_23 = ListLength(List=data_55)
concatenate_40 = Concatenate(Fragment_A=graft(unique_area_names_11), Fragment_B=graft(" "), A=panel_19)
list_length_24 = ListLength(List=flatten_tree_82)
partition_list_11 = PartitionList(List=entwine_22, Size=list_length_23)
series_11 = Series(Start=0, Step=1, Count=list_length_24)
flatten_tree_83 = FlattenTree(Tree=concatenate_40, Path="{0}")
path_mapper_14 = PathMapper(partition_list_11, source="{A;B;C}", target="{C;B}")
create_data_table_11 = CreateDataTable(Data=entwine_30, ColumnHeadings=series_11, AllowSorting=True, ColumnSizingMode=-4)
stack_trees_21 = StackTrees(Data0=data_55, Data1=path_mapper_14, Reduce=True)
create_label_20 = CreateLabel(LabelText="Area Breakdowns", LabelSize=18, Justification=0)  # -> simplify(Label)
stack_trees_22 = StackTrees(Data0="Floor Levels", Data1=flatten_tree_83, Reduce=True)  # -> flatten(Tree)
set_data_table_11 = SetDataTable(DataTableToSet=create_data_table_11, Data=stack_trees_21, ColumnHeadings=stack_trees_22)
flatten_tree_84 = FlattenTree(Tree=chimera_data_12, Path="{0}")
set_label_contents_13 = SetLabelContents(LabelToModify=create_label_20, NewLabelContents=data_44)
ghpython_script_26 = GhPythonScript(x=flatten_tree_84)  # -> a; inputs x: list; same code as ghpython_script
create_separator_13 = CreateSeparator(Thickness=0.5, Horizontal=True, Color=RGB(0, 0, 0))
merge_16 = Merge(Data1=create_label_20, Data2=simplify(create_data_table_11), Data3=create_separator_13)
hide_show_element_12 = HideShowElement(ElementToHideShow=merge_16, Show=ghpython_script_26, Collapse=True, Disable=False)

# ---- group: Building Material Names
text_10 = Text(data_3)

# ---- group: Building Information
panel_20 = Panel("""Floor Levels
F2F Heights
Bldg Perimeter
GSF by Floor
Eff % by Floor
RSF by Floor""")
entwine_31 = Entwine(FlattenInputs=True)
create_label_21 = CreateLabel(LabelText="Building Information", LabelSize=18, Justification=0)
create_label_22 = CreateLabel(LabelText="Building Overview", LabelSize=24, Justification=0)
create_data_table_12 = CreateDataTable(Data=entwine_31, ColumnHeadings=panel_20, AllowSorting=True, ColumnSizingMode=-3)
entwine_32 = Entwine(
    Branch00=sort_list_14.Keys,
    Branch01=sort_list_14.ValuesValuesA,
    Branch02=sort_list_9.ValuesValuesA,
    Branch03=sort_list_10.ValuesValuesA,
    Branch04=sort_list_12.ValuesValuesA,
    Branch05=sort_list_11.ValuesValuesA,
    FlattenInputs=True)
flatten_tree_85 = FlattenTree(Tree=entwine_32, Path="{0}")
set_data_table_12 = SetDataTable(DataTableToSet=create_data_table_12, Data=entwine_32, ColumnHeadings=panel_20)
ghpython_script_27 = GhPythonScript(x=flatten_tree_85)  # -> a; inputs x: list; same code as ghpython_script
entwine_33 = Entwine(Branch00=create_label_22, Branch01=create_label_21, Branch02=create_data_table_12, FlattenInputs=True)
hide_show_element_13 = HideShowElement(ElementToHideShow=entwine_33, Show=ghpython_script_27, Collapse=True, Disable=False)

# ----
panel_21 = Panel("""Unit Descriptions
Mix Percent
Unit SF
Unit Count""")
entwine_34 = Entwine(FlattenInputs=True)
create_label_23 = CreateLabel(LabelText="Unit Mix Calculation", LabelSize=18, Justification=0)
create_data_table_13 = CreateDataTable(Data=entwine_34, ColumnHeadings=panel_21, AllowSorting=True, ColumnSizingMode=-3)
entwine_35 = Entwine(Branch00=get_data_value_36, Branch01=stream_filter_3, Branch02=key_value_search_4, Branch03=data_10, FlattenInputs=True)
set_data_table_13 = SetDataTable(DataTableToSet=create_data_table_13, Data=entwine_35, ColumnHeadings=panel_21)
flatten_tree_86 = FlattenTree(Tree=entwine_35, Path="{0}")
ghpython_script_28 = GhPythonScript(x=flatten_tree_86)  # -> a; inputs x: list; same code as ghpython_script
entwine_36 = Entwine(Branch00=create_label_23, Branch01=create_data_table_13, FlattenInputs=True)
hide_show_element_14 = HideShowElement(ElementToHideShow=entwine_36, Show=ghpython_script_28, Collapse=True, Disable=False)

merge_17 = Merge(
    Data1=ghpython_script_16,
    Data2=ghpython_script_17,
    Data3=ghpython_script_18,
    Data4=ghpython_script_20,
    Data5=ghpython_script_19,
    Data6=ghpython_script_22,
    Data7=ghpython_script_21,
    Data8=ghpython_script_23,
    Data9=ghpython_script_24)
boolean_2 = Boolean(True)
create_label_24 = CreateLabel(LabelText="Program Areas", LabelSize=24, Justification=0)
member_index_2 = MemberIndex(Set=merge_17, Member=boolean_2)  # -> Index, Count
larger_than_2 = LargerThan(FirstNumber=member_index_2.Count, SecondNumber=0)  # -> LargerThan, OrEqualTo
hide_show_element_15 = HideShowElement(ElementToHideShow=create_label_24, Show=larger_than_2.LargerThan, Collapse=True, Disable=False)

entwine_37 = Entwine(
    Branch00=create_label_24,
    Branch01=merge_6,
    Branch02=merge_7,
    Branch03=merge_8,
    Branch04=merge_10,
    Branch05=merge_9,
    Branch06=merge_16,
    Branch07=merge_15,
    Branch08=merge_12,
    Branch09=merge_11,
    Branch010=merge_13,
    Branch011=merge_14,
    FlattenInputs=True)

merge_18 = Merge(Data1=create_button_4, Data2=create_true_only_button)
create_wrappanel_10 = CreateWrapPanel(UIElements=merge_18, Horizontal=True)

# ---- group: Unit Mix Calculation / Unit Mix Calculation Headers
data_56 = Data(panel_21)

# ---- group: Healthcare Areas / Healthcare Areas Headers
data_57 = Data(stack_trees_20)

# ---- group: Mechanical Areas / Mechanical Areas Headers
data_58 = Data(stack_trees_12)

# ---- group: Building Information / Building Information Headers
data_59 = Data(panel_20)

# ---- group: Circulation Areas / Circulation Areas Headers
data_60 = Data(stack_trees_16)

# ---- group: Other Areas / Other Areas Headers
data_61 = Data(stack_trees_18)

# ---- group: Office Areas / Office Areas Headers
data_62 = Data(stack_trees_8)

# ---- group: Structured Parking Areas / Structured Parking Areas Headers
data_63 = Data(stack_trees_14)

# ---- group: Lab Areas / Lab Areas Headers
data_64 = Data(stack_trees_22)

# ---- group: Industrial Areas / Industrial Areas Headers
data_65 = Data(stack_trees_10)

# ---- group: Senior Living Areas / Senior Living Headers
data_66 = Data(stack_trees_6)

# ---- group: Residential Areas / Residential Areas Headers
data_67 = Data(stack_trees_2)

# ---- group: Retail Areas / Retail Areas Headers
data_68 = Data(stack_trees_4)

# ---- group: Project Information / Project Information Headers
merge_19 = Merge(Data1=panel, Data2=panel_2, Data3=panel_3, Data4=panel_4, Data5=panel_5, Data6=panel_6)

# ---- group: Project Information
concatenate_41 = Concatenate(FragmentA=graft("Project Information - "), FragmentB=merge_19)

# ---- group: Healthcare Areas / Healthcare Areas Data
data_69 = Data(stack_trees_19)

# ---- group: Healthcare Areas
concatenate_42 = Concatenate(FragmentA=graft("Healthcare Areas - "), FragmentB=data_57)
null_placeholder = NullPlaceholder()
boolean_3 = Boolean(ghpython_script_25)
stream_filter_4 = StreamFilter(Gate=boolean_3, Stream0=null_placeholder, Stream1=concatenate_42)
stream_filter_5 = StreamFilter(Gate=boolean_3, Stream0=null_placeholder, Stream1=data_69)

# ---- group: Mechanical Areas / Mechanical Areas Data
data_70 = Data(stack_trees_11)

# ---- group: Mechanical Areas
concatenate_43 = Concatenate(FragmentA=graft("Mechanical Areas - "), FragmentB=data_58)
null_placeholder_2 = NullPlaceholder()
boolean_4 = Boolean(ghpython_script_21)
stream_filter_6 = StreamFilter(Gate=boolean_4, Stream0=null_placeholder_2, Stream1=concatenate_43)
stream_filter_7 = StreamFilter(Gate=boolean_4, Stream0=null_placeholder_2, Stream1=data_70)

# ---- group: Circulation Areas / Circulation Areas Data
data_71 = Data(stack_trees_15)

# ---- group: Circulation Areas
concatenate_44 = Concatenate(FragmentA=graft("Circulation Areas - "), FragmentB=data_60)
null_placeholder_3 = NullPlaceholder()
boolean_5 = Boolean(ghpython_script_23)
stream_filter_8 = StreamFilter(Gate=boolean_5, Stream0=null_placeholder_3, Stream1=concatenate_44)
stream_filter_9 = StreamFilter(Gate=boolean_5, Stream0=null_placeholder_3, Stream1=data_71)

# ---- group: Other Areas / Other Areas Data
data_72 = Data(stack_trees_17)

# ---- group: Other Areas
concatenate_45 = Concatenate(FragmentA=graft("Other Areas - "), FragmentB=data_61)
null_placeholder_4 = NullPlaceholder()
boolean_6 = Boolean(ghpython_script_24)
stream_filter_10 = StreamFilter(Gate=boolean_6, Stream0=null_placeholder_4, Stream1=concatenate_45)
stream_filter_11 = StreamFilter(Gate=boolean_6, Stream0=null_placeholder_4, Stream1=data_72)

# ---- group: Building Information / Building Information Data
data_73 = Data(entwine_32)

# ---- group: Building Information
concatenate_46 = Concatenate(FragmentA=graft("Building Information - "), FragmentB=data_59)
null_placeholder_5 = NullPlaceholder()
boolean_7 = Boolean(ghpython_script_27)
stream_filter_12 = StreamFilter(Gate=boolean_7, Stream0=null_placeholder_5, Stream1=concatenate_46)
stream_filter_13 = StreamFilter(Gate=boolean_7, Stream0=null_placeholder_5, Stream1=data_73)

# ---- group: Unit Mix Calculation / Unit Mix Calculation Data
data_74 = Data(entwine_35)

# ---- group: Unit Mix Calculation
concatenate_47 = Concatenate(FragmentA=graft("Unit Mix Calculation - "), FragmentB=data_56)
null_placeholder_6 = NullPlaceholder()
boolean_8 = Boolean(ghpython_script_28)
stream_filter_14 = StreamFilter(Gate=boolean_8, Stream0=null_placeholder_6, Stream1=concatenate_47)
stream_filter_15 = StreamFilter(Gate=boolean_8, Stream0=null_placeholder_6, Stream1=data_74)

# ---- group: Structured Parking Areas / Structured Parking Areas Data
data_75 = Data(stack_trees_13)

# ---- group: Structured Parking Areas
concatenate_48 = Concatenate(FragmentA=graft("Structured Parking Areas - "), FragmentB=data_63)
null_placeholder_7 = NullPlaceholder()
boolean_9 = Boolean(ghpython_script_22)
stream_filter_16 = StreamFilter(Gate=boolean_9, Stream0=null_placeholder_7, Stream1=concatenate_48)
stream_filter_17 = StreamFilter(Gate=boolean_9, Stream0=null_placeholder_7, Stream1=data_75)

# ---- group: Office Areas / Office Areas Data
data_76 = Data(stack_trees_7)

# ---- group: Office Areas
concatenate_49 = Concatenate(FragmentA=graft("Office Areas - "), FragmentB=data_62)
null_placeholder_8 = NullPlaceholder()
boolean_10 = Boolean(ghpython_script_19)
stream_filter_18 = StreamFilter(Gate=boolean_10, Stream0=null_placeholder_8, Stream1=concatenate_49)
stream_filter_19 = StreamFilter(Gate=boolean_10, Stream0=null_placeholder_8, Stream1=data_76)

# ---- group: Building Selection / Building Selection Data
merge_20 = Merge(Data1=get_data_value_18)

# ---- group: Building Selection
concatenate_50 = Concatenate(FragmentA=graft("Building Selection"))
null_placeholder_9 = NullPlaceholder()
boolean_11 = Boolean(ghpython_script)
stream_filter_20 = StreamFilter(Gate=boolean_11, Stream0=null_placeholder_9, Stream1=concatenate_50)
stream_filter_21 = StreamFilter(Gate=boolean_11, Stream0=null_placeholder_9, Stream1=merge_20)

# ---- group: Lab Areas / Lab Areas Data
data_77 = Data(stack_trees_21)

# ---- group: Lab Areas
concatenate_51 = Concatenate(FragmentA=graft("Lab Areas - "), FragmentB=data_64)
null_placeholder_10 = NullPlaceholder()
boolean_12 = Boolean(ghpython_script_26)
stream_filter_22 = StreamFilter(Gate=boolean_12, Stream0=null_placeholder_10, Stream1=concatenate_51)
stream_filter_23 = StreamFilter(Gate=boolean_12, Stream0=null_placeholder_10, Stream1=data_77)

# ---- group: Industrial Areas / Industrial Areas Data
data_78 = Data(stack_trees_9)

# ---- group: Industrial Areas
concatenate_52 = Concatenate(FragmentA=graft("Industrial Areas - "), FragmentB=data_65)
null_placeholder_11 = NullPlaceholder()
boolean_13 = Boolean(ghpython_script_20)
stream_filter_24 = StreamFilter(Gate=boolean_13, Stream0=null_placeholder_11, Stream1=concatenate_52)
stream_filter_25 = StreamFilter(Gate=boolean_13, Stream0=null_placeholder_11, Stream1=data_78)

# ---- group: Senior Living Areas / Senior Living Data
data_79 = Data(stack_trees_5)

# ---- group: Senior Living Areas
concatenate_53 = Concatenate(FragmentA=graft("Senior Living Areas - "), FragmentB=data_66)
null_placeholder_12 = NullPlaceholder()
boolean_14 = Boolean(ghpython_script_18)
stream_filter_26 = StreamFilter(Gate=boolean_14, Stream0=null_placeholder_12, Stream1=concatenate_53)
stream_filter_27 = StreamFilter(Gate=boolean_14, Stream0=null_placeholder_12, Stream1=data_79)

# ---- group: Residential Areas / Residential Areas Data
data_80 = Data(stack_trees)

# ---- group: Residential Areas
concatenate_54 = Concatenate(FragmentA=graft("Residential Areas - "), FragmentB=data_67)
null_placeholder_13 = NullPlaceholder()
boolean_15 = Boolean(ghpython_script_16)
stream_filter_28 = StreamFilter(Gate=boolean_15, Stream0=null_placeholder_13, Stream1=concatenate_54)
stream_filter_29 = StreamFilter(Gate=boolean_15, Stream0=null_placeholder_13, Stream1=data_80)

# ---- group: Retail Areas / Retail Areas Data
data_81 = Data(stack_trees_3)

# ---- group: Retail Areas
concatenate_55 = Concatenate(FragmentA=graft("Retail Areas - "), FragmentB=data_68)
null_placeholder_14 = NullPlaceholder()
boolean_16 = Boolean(ghpython_script_17)
stream_filter_30 = StreamFilter(Gate=boolean_16, Stream0=null_placeholder_14, Stream1=concatenate_55)
stream_filter_31 = StreamFilter(Gate=boolean_16, Stream0=null_placeholder_14, Stream1=data_81)

# ---- group: Project Information / Project Information Data
entwine_38 = Entwine(
    Branch00=get_data_value,
    Branch01=get_data_value_2,
    Branch02=cluster_2,
    Branch03=cluster,
    Branch04=cluster_4,
    Branch05=cluster_3,
    FlattenInputs=True)

# ----
file_path = FilePath(value_listener_6.Values)

getdatakey_94 = GetDataKey(TreeItem="80c07d16-c6f7-4e51-807a-83adf853502c|-1;")
getobjectsbyspecies_7 = GetObjectsBySpecies(DataKey=getdatakey_94)  # -> ObjectGuid, ChimeraData
getdatakey_95 = GetDataKey(TreeItem="35a37d85-eb6e-4e37-aaf6-5cbc00dfdeac|-1;50478ae9-d942-446e-b272-e7f609cbfe62|-1;")
getobjectsbyspecies_8 = GetObjectsBySpecies(DataKey=getdatakey_95)  # -> ObjectGuid, ChimeraData
getdatakey_96 = GetDataKey(TreeItem="80c07d16-c6f7-4e51-807a-83adf853502c|-1;50478ae9-d942-446e-b272-e7f609cbfe62|-1;")
getdatakey_97 = GetDataKey(TreeItem="80c07d16-c6f7-4e51-807a-83adf853502c|-1;c6482b43-3ecb-409d-80c1-e8917dda70f1|-1;")
get_data_value_91 = GetDataValue(ChimeraData=getobjectsbyspecies_8.ChimeraData)

cluster_38 = Cluster_4(tree=getobjectsbyspecies_7.ChimeraData, curve=getobjectsbyspecies_7.ObjectGuid)

# ---- group: Structured Parking Totals
data_82 = Data(get_data_value_91)

# ----
getchilddata_57 = GetChildData(ChimeraData=cluster_38, ChildDefinitionKeyOptional=getdatakey_96)
getchilddata_58 = GetChildData(ChimeraData=cluster_38, ChildDefinitionKeyOptional=getdatakey_97)
get_data_value_92 = GetDataValue(ChimeraData=getchilddata_57)
get_data_value_93 = GetDataValue(ChimeraData=getchilddata_58)
flatten_tree_87 = FlattenTree(Tree=get_data_value_92, Path="{0}")
flatten_tree_88 = FlattenTree(Tree=get_data_value_93, Path="{0}")
mass_addition_10 = MassAddition(Input=flatten_tree_87)  # -> Result, PartialResults
mass_addition_11 = MassAddition(Input=flatten_tree_88)  # -> Result, PartialResults

# ---- group: Surface Parking Stalls
data_83 = Data(mass_addition_10.Result)

# ---- group: Surface Parking Area
data_84 = Data(mass_addition_11.Result)

# ----
panel_22 = Panel("""Floor
Structured Parking SF
Estimated Stalls""")
panel_23 = Panel("""Surface Parking SF
Estimated Stalls""")
entwine_39 = Entwine(FlattenInputs=True)
entwine_40 = Entwine(FlattenInputs=True)
create_data_table_14 = CreateDataTable(Data=entwine_39, ColumnHeadings=panel_22, AllowSorting=True, ColumnSizingMode=-4)
create_separator_14 = CreateSeparator(Thickness=0.5, Horizontal=True, Color=RGB(0, 0, 0))
create_data_table_15 = CreateDataTable(Data=entwine_40, ColumnHeadings=panel_23, AllowSorting=True, ColumnSizingMode=-4)
merge_21 = Merge(Data1=data_84, Data2=data_83)  # -> graft(Result)
entwine_41 = Entwine(Branch00=renumber_paths, Branch01=stream_filter, Branch02=renumber_paths_2, FlattenInputs=True)
create_label_25 = CreateLabel(LabelText="Structured Parking", LabelSize=18, Justification=0)
create_separator_15 = CreateSeparator(Thickness=0.5, Horizontal=True, Color=RGB(0, 0, 0))
create_label_26 = CreateLabel(LabelText="Parking Overview", LabelSize=24, Justification=0)
create_label_27 = CreateLabel(LabelText="Surface Parking", LabelSize=18, Justification=0)
set_data_table_14 = SetDataTable(DataTableToSet=create_data_table_14, Data=entwine_41, ColumnHeadings=panel_22)
set_data_table_15 = SetDataTable(DataTableToSet=create_data_table_15, Data=merge_21, ColumnHeadings=panel_23)
flatten_tree_89 = FlattenTree(Tree=entwine_41, Path="{0}")
flatten_tree_90 = FlattenTree(Tree=merge_21, Path="{0}")
ghpython_script_29 = GhPythonScript(x=flatten_tree_89)  # -> a; inputs x: list; same code as ghpython_script
ghpython_script_30 = GhPythonScript(x=flatten_tree_90)  # -> a; inputs x: list; same code as ghpython_script
merge_22 = Merge(Data1=ghpython_script_30, Data2=ghpython_script_29)
boolean_17 = Boolean(True)
entwine_42 = Entwine(Branch00=create_label_27, Branch01=create_data_table_15, Branch02=create_separator_15, FlattenInputs=True)
entwine_43 = Entwine(Branch00=create_label_25, Branch01=create_data_table_14, Branch02=create_separator_14, FlattenInputs=True)
hide_show_element_16 = HideShowElement(ElementToHideShow=entwine_43, Show=ghpython_script_29, Collapse=True, Disable=False)
hide_show_element_17 = HideShowElement(ElementToHideShow=entwine_42, Show=ghpython_script_30, Collapse=True, Disable=False)
member_index_3 = MemberIndex(Set=merge_22, Member=boolean_17)  # -> Index, Count
larger_than_3 = LargerThan(FirstNumber=member_index_3.Count, SecondNumber=0)  # -> LargerThan, OrEqualTo
hide_show_element_18 = HideShowElement(ElementToHideShow=create_label_26, Show=larger_than_3.LargerThan, Collapse=True, Disable=False)
entwine_44 = Entwine(Branch00=create_label_26, Branch01=entwine_42, Branch02=entwine_43, FlattenInputs=True)

# ---- group: Surface Parking / Surface Parking Headers
data_85 = Data(panel_23)

# ---- group: Structured Parking / Structured Parking Headers
data_86 = Data(panel_22)

# ---- group: Surface Parking / Surface Parking Data
data_87 = Data(merge_21)

# ---- group: Surface Parking
concatenate_56 = Concatenate(FragmentA=graft("Surface Parking - "), FragmentB=data_85)
null_placeholder_15 = NullPlaceholder()
boolean_18 = Boolean(ghpython_script_30)
stream_filter_32 = StreamFilter(Gate=boolean_18, Stream0=null_placeholder_15, Stream1=concatenate_56)
stream_filter_33 = StreamFilter(Gate=boolean_18, Stream0=null_placeholder_15, Stream1=data_87)

# ---- group: Structured Parking / Structured Parking Data
data_88 = Data(entwine_41)

# ---- group: Structured Parking
concatenate_57 = Concatenate(FragmentA=graft("Structured Parking - "), FragmentB=data_86)
null_placeholder_16 = NullPlaceholder()
boolean_19 = Boolean(ghpython_script_29)
stream_filter_34 = StreamFilter(Gate=boolean_19, Stream0=null_placeholder_16, Stream1=concatenate_57)
stream_filter_35 = StreamFilter(Gate=boolean_19, Stream0=null_placeholder_16, Stream1=data_88)

# ----
addition = Addition(A=data_83, B=data_82)

# ---- group: Total Estimated Parking
data_89 = Data(addition)

# ----
division_5 = Division(A=data_89, B=data_15)
division_6 = Division(A=data_89, B=data_5)
round_to_decimal_place_18 = RoundToDecimalPlace(NumberX=division_5, DecimalPlace=2, RoundType=0)  # -> Rounded, Difference
round_to_decimal_place_19 = RoundToDecimalPlace(NumberX=division_6, DecimalPlace=2, RoundType=0)  # -> Rounded, Difference

# ---- group: Stalls per Unit
data_90 = Data(round_to_decimal_place_18.Rounded)

# ---- group: Stalls per Bedroom
data_91 = Data(round_to_decimal_place_19.Rounded)

# ---- group: Project Summary
panel_24 = Panel("""Roof Height
Building GSF
Leasable RSF
SF per Unit
Est Unit Count
Bed Count
Est Parking
Stalls per Unit
Stalls per Bed""")
entwine_45 = Entwine(FlattenInputs=True)
create_label_28 = CreateLabel(LabelText="Project Summary", LabelSize=18, Justification=0)
create_data_table_16 = CreateDataTable(Data=entwine_45, ColumnHeadings=panel_24, AllowSorting=True, ColumnSizingMode=-3)
entwine_46 = Entwine(
    Branch00=data_7,
    Branch01=data_9,
    Branch02=data_8,
    Branch03=data_13,
    Branch04=data_15,
    Branch05=data_5,
    Branch06=data_89,
    Branch07=data_90,
    Branch08=data_91,
    FlattenInputs=True)
set_data_table_16 = SetDataTable(DataTableToSet=create_data_table_16, Data=entwine_46, ColumnHeadings=panel_24)
flatten_tree_91 = FlattenTree(Tree=entwine_46, Path="{0}")
ghpython_script_31 = GhPythonScript(x=flatten_tree_91)  # -> a; inputs x: list; same code as ghpython_script
entwine_47 = Entwine(Branch00=create_label_28, Branch01=create_data_table_16, FlattenInputs=True)
hide_show_element_19 = HideShowElement(ElementToHideShow=entwine_47, Show=ghpython_script_31, Collapse=True, Disable=False)

# ---- group: Project Summary / Project Summary Headers
data_92 = Data(panel_24)

# ---- group: Project Summary / Project Summary Data
data_93 = Data(entwine_46)

# ---- group: Project Summary
concatenate_58 = Concatenate(FragmentA=graft("Project Summary - "), FragmentB=data_92)
null_placeholder_17 = NullPlaceholder()
boolean_20 = Boolean(ghpython_script_31)
stream_filter_36 = StreamFilter(Gate=boolean_20, Stream0=null_placeholder_17, Stream1=concatenate_58)
stream_filter_37 = StreamFilter(Gate=boolean_20, Stream0=null_placeholder_17, Stream1=data_93)

# ----
getobjectsbyspecies_9 = GetObjectsBySpecies(DataKey=getdatakey_43)  # -> ObjectGuid, ChimeraData
getdatakey_98 = GetDataKey(
    KeyNames="Landscaping_Plantings/Planting_Types",
    TreeItem="b2c85f8f-50fa-4116-9e6c-950d1a14a234|-1;01a22c83-e4e6-4f25-97ac-35f89b1f40d6|-1;")
getchilddata_59 = GetChildData(ChimeraData=getobjectsbyspecies_9.ChimeraData, ChildDefinitionKeyOptional=getdatakey_98)
getenumvalues_5 = GetEnumValues(EnumDefinitionKey=getdatakey_98)
area = Area(Geometry=getobjectsbyspecies_9.ObjectGuid)  # -> graft(Area), Centroid
panel_25 = Panel(getenumvalues_5)
get_data_value_94 = GetDataValue(ChimeraData=getchilddata_59)
sort_duplicate_values_24 = SortDuplicateValues(ValueList=flatten(get_data_value_94))  # -> UniqueValues, Indices
panel_26 = Panel(sort_duplicate_values_24.Indices)
flatten_tree_92 = FlattenTree(Tree=area.Area, Path="{0}")
list_item_46 = ListItem(List=flatten_tree_92, Index=sort_duplicate_values_24.Indices, Wrap=True)
list_item_47 = ListItem(List=getenumvalues_5, Index=graft(sort_duplicate_values_24.UniqueValues), Wrap=True)
mass_addition_12 = MassAddition(Input=list_item_46)  # -> Result, PartialResults
concatenate_59 = Concatenate(Fragment_A="Plantings - ", Fragment_B=list_item_47, A=" Coverage")
number_5 = Number(0)

# ---- group: Landscaping Plantings Area by Type
integer = Integer(mass_addition_12.Result)

# ---- group: Plantings Types
text_11 = Text(concatenate_59)

# ----
getobjectsbyspecies_10 = GetObjectsBySpecies(DataKey=getdatakey_44)  # -> ObjectGuid, ChimeraData
getdatakey_99 = GetDataKey(TreeItem="9c339a82-0add-41b8-97da-e42402cdf9b8|-1;ae56cdab-eef0-4ec5-9a18-8632de7b8891|-1;")
getdatakey_100 = GetDataKey(TreeItem="9c339a82-0add-41b8-97da-e42402cdf9b8|-1;cdce3acb-84f2-404c-b69b-86b858c96f2f|-1;")
getdatakey_101 = GetDataKey(TreeItem="9c339a82-0add-41b8-97da-e42402cdf9b8|-1;bddd412c-4e9b-4450-a755-c95498d48e34|-1;")
getdatakey_102 = GetDataKey(TreeItem="9c339a82-0add-41b8-97da-e42402cdf9b8|-1;4eb371aa-f42c-4c70-af5a-0b90df67820d|-1;")
getdatakey_103 = GetDataKey(TreeItem="9c339a82-0add-41b8-97da-e42402cdf9b8|-1;f8a9fd1f-8868-4f07-bccd-d10ea42a3523|-1;")
getdatakey_104 = GetDataKey(TreeItem="9c339a82-0add-41b8-97da-e42402cdf9b8|-1;37d5d069-9c87-4ce0-9ca0-8ad045d1f823|-1;")
getdatakey_105 = GetDataKey(TreeItem="9c339a82-0add-41b8-97da-e42402cdf9b8|-1;e08f1960-a516-44af-9f52-2df706b6c649|-1;")
getdatakey_106 = GetDataKey(TreeItem="9c339a82-0add-41b8-97da-e42402cdf9b8|-1;0e5deac7-818d-450c-860a-13dfe0ca21a0|-1;")
getdatakey_107 = GetDataKey(TreeItem="9c339a82-0add-41b8-97da-e42402cdf9b8|-1;c79ae240-6a18-4b8c-94a9-318c771a4a62|-1;")
getdatakey_108 = GetDataKey(TreeItem="9c339a82-0add-41b8-97da-e42402cdf9b8|-1;95d43b98-a33e-4e71-8d02-e2f038d10ca2|-1;")
getdatakey_109 = GetDataKey(TreeItem="9c339a82-0add-41b8-97da-e42402cdf9b8|-1;a1ac4631-d09a-428f-883b-de773aac8e8e|-1;")
getchilddata_60 = GetChildData(ChimeraData=getobjectsbyspecies_10.ChimeraData, ChildDefinitionKeyOptional=getdatakey_99)
getchilddata_61 = GetChildData(ChimeraData=getobjectsbyspecies_10.ChimeraData, ChildDefinitionKeyOptional=getdatakey_101)
getchilddata_62 = GetChildData(ChimeraData=getobjectsbyspecies_10.ChimeraData, ChildDefinitionKeyOptional=getdatakey_100)
getchilddata_63 = GetChildData(ChimeraData=getobjectsbyspecies_10.ChimeraData, ChildDefinitionKeyOptional=getdatakey_102)
getchilddata_64 = GetChildData(ChimeraData=getobjectsbyspecies_10.ChimeraData, ChildDefinitionKeyOptional=getdatakey_103)
getchilddata_65 = GetChildData(ChimeraData=getobjectsbyspecies_10.ChimeraData, ChildDefinitionKeyOptional=getdatakey_104)
getchilddata_66 = GetChildData(ChimeraData=getobjectsbyspecies_10.ChimeraData, ChildDefinitionKeyOptional=getdatakey_105)
getchilddata_67 = GetChildData(ChimeraData=getobjectsbyspecies_10.ChimeraData, ChildDefinitionKeyOptional=getdatakey_107)
getchilddata_68 = GetChildData(ChimeraData=getobjectsbyspecies_10.ChimeraData, ChildDefinitionKeyOptional=getdatakey_106)
getchilddata_69 = GetChildData(ChimeraData=getobjectsbyspecies_10.ChimeraData, ChildDefinitionKeyOptional=getdatakey_108)
getchilddata_70 = GetChildData(ChimeraData=getobjectsbyspecies_10.ChimeraData, ChildDefinitionKeyOptional=getdatakey_109)
get_data_value_95 = GetDataValue(ChimeraData=getchilddata_60)
get_data_value_96 = GetDataValue(ChimeraData=getchilddata_61)
get_data_value_97 = GetDataValue(ChimeraData=getchilddata_62)
get_data_value_98 = GetDataValue(ChimeraData=getchilddata_63)
get_data_value_99 = GetDataValue(ChimeraData=getchilddata_64)
get_data_value_100 = GetDataValue(ChimeraData=getchilddata_65)
get_data_value_101 = GetDataValue(ChimeraData=getchilddata_66)
get_data_value_102 = GetDataValue(ChimeraData=getchilddata_67)
get_data_value_103 = GetDataValue(ChimeraData=getchilddata_68)
get_data_value_104 = GetDataValue(ChimeraData=getchilddata_69)
get_data_value_105 = GetDataValue(ChimeraData=getchilddata_70)

select_in_document = SelectInDocument(GeometryObject=getobjectsbyspecies_10.ObjectGuid, Select=value_listener_7.Values, unselectSelInDoc=False)

# ---- group: Site Area SF
data_94 = Data(get_data_value_95)

# ---- group: Site Acreage
data_95 = Data(get_data_value_96)

# ---- group: Site Area SF
data_96 = Data(get_data_value_95)

# ---- group: FAR
data_97 = Data(get_data_value_97)

# ---- group: Density
data_98 = Data(get_data_value_98)

# ---- group: Building Coverage
data_99 = Data(get_data_value_99)

# ---- group: Parking Coverage
data_100 = Data(get_data_value_100)

# ---- group: Roadway Area
data_101 = Data(get_data_value_101)

# ---- group: Roadway Coverage
data_102 = Data(get_data_value_102)

# ---- group: SWR Coverage
data_103 = Data(get_data_value_104)

# ---- group: Greenspace
data_104 = Data(get_data_value_105)

# ---- group: Total Paved Surface Coverage
data_105 = Data(get_data_value_103)

# ----
concatenate_60 = Concatenate(FragmentA=data_102, FragmentB="%")
concatenate_61 = Concatenate(FragmentA=data_105, FragmentB="%")
concatenate_62 = Concatenate(FragmentA=data_99, FragmentB="%")
concatenate_63 = Concatenate(FragmentA=data_104, FragmentB="%")
concatenate_64 = Concatenate(FragmentA=data_100, FragmentB="%")
concatenate_65 = Concatenate(FragmentA=data_103, FragmentB="%")
ghpython_script_32 = GhPythonScript(x=data_99)  # -> a; inputs x: list
# ---------- ghpython_script_32: Python ----------
__author__ = "sdanilow"
__version__ = "2023.03.16"

import rhinoscriptsyntax as rs

print x

if x == [] or x == [None] or x == [0]:
    a = False
else:
    a = True
# ---------- end ghpython_script_32 ----------
ghpython_script_33 = GhPythonScript(x=data_102)  # -> a; inputs x: list; same code as ghpython_script_32
ghpython_script_34 = GhPythonScript(x=data_100)  # -> a; inputs x: list; same code as ghpython_script_32
ghpython_script_35 = GhPythonScript(x=data_105)  # -> a; inputs x: list; same code as ghpython_script_32
stream_filter_38 = StreamFilter(Gate=ghpython_script_32, Stream1=concatenate_62)
stream_filter_39 = StreamFilter(Gate=ghpython_script_33, Stream1=concatenate_60)
stream_filter_40 = StreamFilter(Gate=ghpython_script_34, Stream0="0", Stream1=concatenate_64)
stream_filter_41 = StreamFilter(Gate=ghpython_script_35, Stream1=concatenate_61)

division_7 = Division(A=area.Area, B=data_94)
multiplication_7 = Multiplication(A=division_7, B=100)
flatten_tree_93 = FlattenTree(Tree=multiplication_7, Path="{0}")
list_item_48 = ListItem(List=flatten_tree_93, Index=sort_duplicate_values_24.Indices, Wrap=True)
mass_addition_13 = MassAddition(Input=list_item_48)  # -> Result, PartialResults
ghpython_script_36 = GhPythonScript(x=flatten(integer))  # -> a; inputs x: list; same code as ghpython_script_2
stream_filter_42 = StreamFilter(Gate=ghpython_script_36, Stream1=integer)

# ---- group: Landscaping Plantinge Coverage by Type
integer_2 = Integer(mass_addition_13.Result)

# ----
data_exists_2 = DataExists(Data=integer_2)
stream_filter_43 = StreamFilter(Gate=data_exists_2, Stream0=number_5, Stream1=integer_2)
concatenate_66 = Concatenate(FragmentA=stream_filter_43, FragmentB="%")

panel_27 = Panel("""Site Area SF
Acreage""")
panel_28 = Panel("""FAR
Density
Building Coverage""")
panel_29 = Panel("""Parking Coverage
Roadway Area SF
Roadway Coverage
Total Paved Surface Coverage""")
panel_30 = Panel("""Stormwater Retention Coverage
Greenspace""")
entwine_48 = Entwine(FlattenInputs=True)
entwine_49 = Entwine(FlattenInputs=True)
entwine_50 = Entwine(FlattenInputs=True)
entwine_51 = Entwine(FlattenInputs=True)
create_data_table_17 = CreateDataTable(Data=entwine_48, ColumnHeadings=panel_27, AllowSorting=True, ColumnSizingMode=-4)
merge_23 = Merge(Data1=data_96, Data2=data_95)  # -> graft(Result)
create_data_table_18 = CreateDataTable(Data=entwine_49, ColumnHeadings=panel_30, AllowSorting=True, ColumnSizingMode=-4)
create_data_table_19 = CreateDataTable(Data=entwine_50, ColumnHeadings=panel_28, AllowSorting=True, ColumnSizingMode=-4)
create_data_table_20 = CreateDataTable(Data=entwine_51, ColumnHeadings=panel_29, AllowSorting=True, ColumnSizingMode=-4)
merge_24 = Merge(Data1=data_97, Data2=data_98, Data3=stream_filter_38)  # -> graft(Result)
merge_25 = Merge(Data1=stream_filter_40, Data2=data_101, Data3=stream_filter_39, Data4=stream_filter_41)  # -> graft(Result)
create_label_29 = CreateLabel(LabelText="Site-Landscaping Metrics", LabelSize=18, Justification=0)
create_label_30 = CreateLabel(LabelText="Site-Building  Metrics", LabelSize=18, Justification=0)
create_separator_16 = CreateSeparator(Thickness=0.5, Horizontal=True, Color=RGB(0, 0, 0))
create_separator_17 = CreateSeparator(Thickness=0.5, Horizontal=True, Color=RGB(0, 0, 0))
create_label_31 = CreateLabel(LabelText="Site-Paving Metrics", LabelSize=18, Justification=0)
merge_26 = Merge(Data1=flatten(text_11), Data2=panel_30)
create_separator_18 = CreateSeparator(Thickness=0.5, Horizontal=True, Color=RGB(0, 0, 0))
create_separator_19 = CreateSeparator(Thickness=0.5, Horizontal=True, Color=RGB(0, 0, 0))
create_label_32 = CreateLabel(LabelText="Site Overview", LabelSize=24, Justification=0)
stack_trees_23 = StackTrees(Data0=concatenate_66, Data1=concatenate_65, Data2=concatenate_63, Reduce=True)
create_label_33 = CreateLabel(LabelText="Site Metrics", LabelSize=18, Justification=0)
flatten_tree_94 = FlattenTree(Tree=merge_24, Path="{0}")
flatten_tree_95 = FlattenTree(Tree=stack_trees_23, Path="{0}")
set_data_table_17 = SetDataTable(DataTableToSet=create_data_table_17, Data=merge_23, ColumnHeadings=panel_27)
set_data_table_18 = SetDataTable(DataTableToSet=create_data_table_18, Data=stack_trees_23, ColumnHeadings=merge_26)
flatten_tree_96 = FlattenTree(Tree=merge_25, Path="{0}")
set_data_table_19 = SetDataTable(DataTableToSet=create_data_table_19, Data=merge_24, ColumnHeadings=panel_28)
set_data_table_20 = SetDataTable(DataTableToSet=create_data_table_20, Data=merge_25, ColumnHeadings=panel_29)
flatten_tree_97 = FlattenTree(Tree=merge_23, Path="{0}")
entwine_52 = Entwine(Branch00=create_label_30, Branch01=create_data_table_19, Branch02=create_separator_16, FlattenInputs=True)
ghpython_script_37 = GhPythonScript(x=flatten_tree_94)  # -> a; inputs x: list; same code as ghpython_script
ghpython_script_38 = GhPythonScript(x=flatten_tree_95)  # -> a; inputs x: list; same code as ghpython_script
entwine_53 = Entwine(Branch00=create_label_29, Branch01=create_data_table_18, Branch02=create_separator_17, FlattenInputs=True)
ghpython_script_39 = GhPythonScript(x=flatten_tree_96)  # -> a; inputs x: list; same code as ghpython_script
entwine_54 = Entwine(Branch00=create_label_31, Branch01=create_data_table_20, Branch02=create_separator_19, FlattenInputs=True)
boolean_21 = Boolean(True)
entwine_55 = Entwine(Branch00=create_label_33, Branch01=create_data_table_17, Branch02=create_separator_18, FlattenInputs=True)
ghpython_script_40 = GhPythonScript(x=flatten_tree_97)  # -> a; inputs x: list; same code as ghpython_script
merge_27 = Merge(Data1=ghpython_script_40, Data2=ghpython_script_37, Data3=ghpython_script_39, Data4=ghpython_script_38)
hide_show_element_20 = HideShowElement(ElementToHideShow=entwine_52, Show=ghpython_script_37, Collapse=True, Disable=False)
hide_show_element_21 = HideShowElement(ElementToHideShow=entwine_53, Show=ghpython_script_38, Collapse=True, Disable=False)
hide_show_element_22 = HideShowElement(ElementToHideShow=entwine_54, Show=ghpython_script_39, Collapse=True, Disable=False)
member_index_4 = MemberIndex(Set=merge_27, Member=boolean_21)  # -> Index, Count
hide_show_element_23 = HideShowElement(ElementToHideShow=entwine_55, Show=ghpython_script_40, Collapse=True, Disable=False)
larger_than_4 = LargerThan(FirstNumber=member_index_4.Count, SecondNumber=0)  # -> LargerThan, OrEqualTo
hide_show_element_24 = HideShowElement(ElementToHideShow=create_label_32, Show=larger_than_4.LargerThan, Collapse=True, Disable=False)
entwine_56 = Entwine(
    Branch00=create_label_32,
    Branch01=entwine_55,
    Branch02=entwine_52,
    Branch03=entwine_54,
    Branch04=entwine_53,
    FlattenInputs=True)

# ---- group: Site Metrics / Site Metrics Headers
data_106 = Data(panel_27)

# ---- group: Site-Building Metrics / Site-Building Metrics Headers
data_107 = Data(panel_28)

# ---- group: Site-Paving Metrics / Site-Paving Metrics Headers
data_108 = Data(panel_29)

# ---- group: Site-Landscaping Metrics / Site-Landscaping Metrics Headers
data_109 = Data(merge_26)

# ---- group: Site Metrics / Site Metrics Data
data_110 = Data(merge_23)

# ---- group: Site Metrics
concatenate_67 = Concatenate(FragmentA=graft("Site Metrics - "), FragmentB=data_106)
null_placeholder_18 = NullPlaceholder()
boolean_22 = Boolean(ghpython_script_40)
stream_filter_44 = StreamFilter(Gate=boolean_22, Stream0=null_placeholder_18, Stream1=concatenate_67)
stream_filter_45 = StreamFilter(Gate=boolean_22, Stream0=null_placeholder_18, Stream1=data_110)

# ---- group: Site-Building Metrics / Site-Building Metrics Data
data_111 = Data(merge_24)

# ---- group: Site-Building Metrics
concatenate_68 = Concatenate(FragmentA=graft("Site-Building Metrics - "), FragmentB=data_107)
null_placeholder_19 = NullPlaceholder()
boolean_23 = Boolean(ghpython_script_37)
stream_filter_46 = StreamFilter(Gate=boolean_23, Stream0=null_placeholder_19, Stream1=concatenate_68)
stream_filter_47 = StreamFilter(Gate=boolean_23, Stream0=null_placeholder_19, Stream1=data_111)

# ---- group: Site-Paving Metrics / Site-Paving Metrics Data
data_112 = Data(merge_25)

# ---- group: Site-Paving Metrics
concatenate_69 = Concatenate(FragmentA=graft("Site-Paving Metrics - "), FragmentB=data_108)
null_placeholder_20 = NullPlaceholder()
boolean_24 = Boolean(ghpython_script_39)
stream_filter_48 = StreamFilter(Gate=boolean_24, Stream0=null_placeholder_20, Stream1=concatenate_69)
stream_filter_49 = StreamFilter(Gate=boolean_24, Stream0=null_placeholder_20, Stream1=data_112)

# ---- group: Site-Landscaping Metrics / Site-Landscaping Metrics Data
data_113 = Data(stack_trees_23)

# ---- group: Site-Landscaping Metrics
concatenate_70 = Concatenate(FragmentA=graft("Site-Landscaping Metrics - "), FragmentB=data_109)
null_placeholder_21 = NullPlaceholder()
boolean_25 = Boolean(ghpython_script_38)
stream_filter_50 = StreamFilter(Gate=boolean_25, Stream0=null_placeholder_21, Stream1=concatenate_70)
stream_filter_51 = StreamFilter(Gate=boolean_25, Stream0=null_placeholder_21, Stream1=data_113)

# ----
createattributes = CreateAttributes(LayerName="MYST::Roadways::Roadway Surface", enableFullPath=True)
flatten_tree_98 = FlattenTree(Tree=get_data_value_15, Path="{0}")

# ---- group: Roadway Surfaces
geometry = Geometry(flatten(flatten_tree_98))

# ----
ghpython_script_41 = GhPythonScript(breps=geometry, attributes=createattributes, bake=roadway_surfaces)  # -> out, bakedGeo; inputs breps: list of GeometryBase, attributes: list
# ---------- ghpython_script_41: Python ----------
__author__ = "sdanilow"
__version__ = "2023.03.30"

import rhinoscriptsyntax as rs
import rhinoscriptsyntax as rs
import scriptcontext as sc
import Rhino

if bake:
    
    sc.doc = Rhino.RhinoDoc.ActiveDoc
    
    for i in range(len(breps)):
        bakedGeo = sc.doc.Objects.Add(breps[i], attributes[0])
        #rs.ObjectLayer(breps[i], layerFullPath[i])

sc.doc = ghdoc
# ---------- end ghpython_script_41 ----------
panel_31 = Panel(ghpython_script_41.bakedGeo)

createattributes_2 = CreateAttributes(LayerName="MYST::Surface Parking::Parking Surface", enableFullPath=True)
flatten_tree_99 = FlattenTree(Tree=get_data_value_17, Path="{0}")

# ---- group: Surface Parking Surfaces
geometry_2 = Geometry(flatten(flatten_tree_99))

# ----
ghpython_script_42 = GhPythonScript(breps=geometry_2, attributes=createattributes_2, bake=surface_parking_surfaces)  # -> out, bakedGeo; inputs breps: list of GeometryBase, attributes: list; same code as ghpython_script_41
panel_32 = Panel(ghpython_script_42.bakedGeo)

createattributes_3 = CreateAttributes(LayerName="MYST::Roadways::Roadway Parking::Roadway Parking Surface", enableFullPath=True)
flatten_tree_100 = FlattenTree(Tree=get_data_value_16, Path="{0}")

# ---- group: Roadway Parking Surfaces
geometry_3 = Geometry(flatten(flatten_tree_100))

# ----
ghpython_script_43 = GhPythonScript(breps=geometry_3, attributes=createattributes_3, bake=roadway_parking_surfaces)  # -> out, bakedGeo; inputs breps: list of GeometryBase, attributes: list; same code as ghpython_script_41
panel_33 = Panel(ghpython_script_43.bakedGeo)

createattributes_4 = CreateAttributes(LayerName="MYST::Stormwater Retention", enableFullPath=True)
flatten_tree_101 = FlattenTree(Tree=get_data_value_14, Path="{0}")

# ---- group: SWR Surfaces
geometry_4 = Geometry(simplify(flatten(flatten_tree_101)))

# ----
ghpython_script_44 = GhPythonScript(breps=geometry_4, attributes=createattributes_4, bake=stormwater_retention_surfaces)  # -> out, bakedGeo; inputs breps: list of GeometryBase, attributes: list; same code as ghpython_script_41
panel_34 = Panel(ghpython_script_44.bakedGeo)

flatten_tree_102 = FlattenTree(Tree=get_data_value_12, Path="{0}")
concatenate_71 = Concatenate(FragmentA="MYST::Landscaping::", FragmentB=text_3)
createattributes_5 = CreateAttributes(LayerName=concatenate_71, enableFullPath=True)  # -> flatten(ObjectAttributes)

# ---- group: Ordered Plantings Surfaces
geometry_5 = Geometry(simplify(flatten(flatten_tree_102)))

# ----
ghpython_script_45 = GhPythonScript(breps=geometry_5, attributes=createattributes_5, bake=landscaping_surfaces)  # -> out, bakedGeo; inputs breps: list of GeometryBase, attributes: list
# ---------- ghpython_script_45: Python ----------
__author__ = "sdanilow"
__version__ = "2023.03.30"

import rhinoscriptsyntax as rs
import rhinoscriptsyntax as rs
import scriptcontext as sc
import Rhino

if bake:
    
    sc.doc = Rhino.RhinoDoc.ActiveDoc
    
    for i in range(len(breps)):
        bakedGeo = sc.doc.Objects.Add(breps[i], attributes[i])
        #rs.ObjectLayer(breps[i], layerFullPath[i])

sc.doc = ghdoc
# ---------- end ghpython_script_45 ----------
panel_35 = Panel(ghpython_script_45.bakedGeo)

create_modify_layers = CreateModifyLayers(LayerName=text_7, DeleteLayer=False, enableFullPath=True)  # -> LayerNames, LayerFullPath
createattributes_6 = CreateAttributes(LayerName=create_modify_layers.LayerFullPath, enableFullPath=True)
flatten_tree_103 = FlattenTree(Tree=merge_faces.Breps, Path="{0}")

# ---- group: Union Floors
geometry_6 = Geometry(flatten_tree_103)

# ----
ghpython_script_46 = GhPythonScript(breps=geometry_6, attributes=createattributes_6, bake=floor_masses)  # -> out, bakedGeo; inputs breps: list of GeometryBase, attributes: list; same code as ghpython_script_45
panel_36 = Panel(ghpython_script_46.bakedGeo)

create_modify_layers_2 = CreateModifyLayers(LayerName=text_6, LayerColor=flatten_tree_51, DeleteLayer=False, enableFullPath=True)  # -> LayerNames, LayerFullPath
createattributes_7 = CreateAttributes(LayerName=create_modify_layers_2.LayerFullPath, enableFullPath=True)
flatten_tree_104 = FlattenTree(Tree=extrude, Path="{0}")

# ---- group: Areas
gathered_areas = Geometry(flatten(flatten_tree_104))

# ----
ghpython_script_47 = GhPythonScript(breps=gathered_areas, attributes=createattributes_7, bake=area_masses)  # -> out, bakedGeo; inputs breps: list of GeometryBase, attributes: list; same code as ghpython_script_45
panel_37 = Panel(ghpython_script_47.bakedGeo)

create_modify_layers_3 = CreateModifyLayers(LayerName=text_8, DeleteLayer=False, enableFullPath=True)  # -> LayerNames, LayerFullPath
createattributes_8 = CreateAttributes(LayerName=create_modify_layers_3.LayerFullPath, enableFullPath=True)
flatten_tree_105 = FlattenTree(Tree=merge_faces_2.Breps, Path="{0}")

# ---- group: Union Building
geometry_7 = Geometry(flatten(flatten_tree_105))

# ----
ghpython_script_48 = GhPythonScript(breps=geometry_7, attributes=createattributes_8, bake=building_mass)  # -> out, bakedGeo; inputs breps: list of GeometryBase, attributes: list; same code as ghpython_script_45
panel_38 = Panel(ghpython_script_48.bakedGeo)

entwine_57 = Entwine(FlattenInputs=True)
nulls_in_empty_branches_12 = NullsInEmptyBranches(DataWithEmptyBranches=entwine_57)
flatten_tree_106 = FlattenTree(Tree=text_9, Path="{0}")
flatten_tree_107 = FlattenTree(Tree=text_10, Path="{0}")
flatten_tree_108 = FlattenTree(Tree=nulls_in_empty_branches_12, Path="{0}")
concatenate_72 = Concatenate(B=flatten_tree_106, A=" ", Fragment_A=number_4, Fragment_B="%")  # -> simplify(Result)
concatenate_73 = Concatenate(FragmentB=flatten_tree_107, FragmentA=" Cost")  # -> simplify(Result)
list_length_25 = ListLength(List=flatten_tree_108)
flatten_tree_109 = FlattenTree(Tree=concatenate_73, Path="{0}")
panel_39 = Panel("""Floor Levels
Wall Area""")
series_12 = Series(Start=0, Step=1, Count=list_length_25)
flatten_tree_110 = FlattenTree(Tree=concatenate_72, Path="{0}")
stack_trees_24 = StackTrees(Data0=sort_list_14.Keys, Data1=sort_list_13.ValuesValuesA, Data2=data_18, Data3=data_20, Data4=data_21, Reduce=True)
create_data_table_21 = CreateDataTable(Data=entwine_57, ColumnHeadings=series_12, AllowSorting=True, ColumnSizingMode=-3)
entwine_58 = Entwine(Branch00=panel_39, Branch01=flatten_tree_110, Branch02=flatten_tree_109, Branch03="Total Cost", FlattenInputs=True)
create_label_34 = CreateLabel(LabelText="Material Information", LabelSize=18, Justification=0)
flatten_tree_111 = FlattenTree(Tree=stack_trees_24, Path="{0}")
ghpython_script_49 = GhPythonScript(x=flatten_tree_111)  # -> a; inputs x: list; same code as ghpython_script
entwine_59 = Entwine(Branch00=create_label_34, Branch01=create_data_table_21, FlattenInputs=True)
hide_show_element_25 = HideShowElement(ElementToHideShow=entwine_59, Show=ghpython_script_49, Collapse=True, Disable=False)

flatten_tree_112 = FlattenTree(Tree=entwine_58, Path="{0}")

set_data_table_21 = SetDataTable(DataTableToSet=create_data_table_21, Data=stack_trees_24, ColumnHeadings=flatten_tree_112)

entwine_60 = Entwine(
    Branch00=entwine_8,
    Branch01=create_pulldown_menu,
    Branch02=create_separator,
    Branch03=entwine_47,
    Branch04=entwine_33,
    Branch05=entwine_59,
    Branch06=create_separator_2,
    Branch07=entwine_37,
    Branch08=entwine_36,
    Branch09=entwine_44,
    Branch010=entwine_56,
    Branch011=create_wrappanel_10,
    Branch012=create_wrappanel_9,
    FlattenInputs=True)
cd_humanui_brand_2 = CDHumanUIBrand(elements=entwine_60)  # -> elements_4, font_family_2, accent_colors_2
launch_window_2 = LaunchWindow(
    Show=Toggle(True),
    Name="MYST Massing Feasibility Matrix",
    Width=Slider(717, range=0..2000),
    Height=Slider(666, range=0..2000),
    FontFamily=cd_humanui_brand_2.font_family_2,
    ChildStatus=1,
    EnableHorizScroll=False)
window_status = WindowStatus(Window=launch_window_2)
c_script_2 = CSharpScript(x=window_status)  # -> out; inputs x: String
# ---------- c_script_2: C# ----------
    if (x == "Hidden")
    {
      Grasshopper.Instances.DocumentEditor.ScriptAccess_CloseAllDocuments();
    }
# ---------- end c_script_2 ----------
add_elements_2 = AddElements(Window=launch_window_2, Elements=flatten(cd_humanui_brand_2.elements_4), DoVLChecking=True)  # -> AddedElements, ElementNames
set_window_properties_2 = SetWindowProperties(Window=launch_window_2, AccentColor=cd_humanui_brand_2.accent_colors_2, ShowTitleBar=True, ScaleFactor=1)

# ---- group: Material Information / Material Information Headers
data_114 = Data(entwine_58)

# ---- group: Material Information / Material Information Data
data_115 = Data(stack_trees_24)

# ---- group: Material Information
concatenate_74 = Concatenate(FragmentA=graft("Material Information - "), FragmentB=data_114)
null_placeholder_22 = NullPlaceholder()
boolean_26 = Boolean(ghpython_script_49)
stream_filter_52 = StreamFilter(Gate=boolean_26, Stream0=null_placeholder_22, Stream1=concatenate_74)
stream_filter_53 = StreamFilter(Gate=boolean_26, Stream0=null_placeholder_22, Stream1=data_115)

# ---- group: CSV Data
stack_trees_25 = StackTrees(
    Data0=entwine_38,
    Data1=stream_filter_21,
    Data2=stream_filter_37,
    Data3=stream_filter_13,
    Data4=stream_filter_53,
    Data5=stream_filter_29,
    Data6=stream_filter_31,
    Data7=stream_filter_27,
    Data8=stream_filter_25,
    Data9=stream_filter_19,
    Data10=stream_filter_23,
    Data11=stream_filter_5,
    Data12=stream_filter_17,
    Data13=stream_filter_7,
    Data14=stream_filter_9,
    Data15=stream_filter_11,
    Data16=stream_filter_15,
    Data17=stream_filter_33,
    Data18=stream_filter_35,
    Data19=stream_filter_45,
    Data20=stream_filter_47,
    Data21=stream_filter_49,
    Data22=stream_filter_51,
    Reduce=True)
cluster_39 = Cluster_2(csv_data=stack_trees_25)

# ---- group: CSV Headers
entwine_61 = Entwine(
    Branch00=concatenate_41,
    Branch01=stream_filter_20,
    Branch02=stream_filter_36,
    Branch03=stream_filter_12,
    Branch04=stream_filter_52,
    Branch05=stream_filter_28,
    Branch06=stream_filter_30,
    Branch07=stream_filter_26,
    Branch08=stream_filter_24,
    Branch09=stream_filter_18,
    Branch010=stream_filter_22,
    Branch011=stream_filter_4,
    Branch012=stream_filter_16,
    Branch013=stream_filter_6,
    Branch014=stream_filter_8,
    Branch015=stream_filter_10,
    Branch016=stream_filter_14,
    Branch017=stream_filter_32,
    Branch018=stream_filter_34,
    Branch019=stream_filter_44,
    Branch020=stream_filter_46,
    Branch021=stream_filter_48,
    Branch022=stream_filter_50,
    FlattenInputs=True)  # -> flatten(Result)
clean_tree_4 = CleanTree(RemoveNulls=True, RemoveInvalid=True, RemoveEmpty=True, Tree=entwine_61)

# ----
create_csv = CreateCSV(DataGridHeaders=clean_tree_4, ValueTree=cluster_39, Delimiter=",")
c_script_3 = CSharpScript(save=value_listener_5.Values, path=file_path, data=create_csv)  # inputs save: Boolean, path: String, data: list of String
# ---------- c_script_3: C# ----------
    if(save){
      var fileinfo = new System.IO.FileInfo(path);
      if(!fileinfo.Directory.Exists){
        fileinfo.Directory.Create();
      }

      var sw = fileinfo.CreateText();
      for(int i = 0; i < data.Count; i++){
        string row = data[i];
        if(i < data.Count - 1){
          sw.WriteLine(row);
        }else{
          sw.Write(row);
        }
      }

      sw.Flush();
      sw.Close();
    }
# ---------- end c_script_3 ----------
panel_40 = Panel(clean_tree_4)
panel_41 = Panel(cluster_39)

# ==== cluster Cluster
number = ClusterInput()
number_2 = Data(number)
round_to_decimal_place = RoundToDecimalPlace(NumberX=number_2, DecimalPlace=2, RoundType=0)  # -> Rounded, Difference

# ---- group: Add Commas to Number
ghpython_script = GhPythonScript(numberIn=round_to_decimal_place.Rounded)  # -> out, numberOut
# ---------- ghpython_script: Python ----------
__author__ = "sdanilow"
__version__ = "2023.02.17"

import rhinoscriptsyntax as rs

# initializing number
test_num = numberIn
 
# printing original number
print("The original number is : " + str(test_num))
 
# Using str.format()
# Adding comma between numbers
res = ('{:,}'.format(test_num))
numberOut = res
 
# printing result
print("The number after inserting commas : " + str(res))
# ---------- end ghpython_script ----------

# ----
ghpython_script_2 = GhPythonScript(x=number_2)  # -> a; inputs x: list
# ---------- ghpython_script_2: Python ----------
__author__ = "sdanilow"
__version__ = "2023.03.16"

import rhinoscriptsyntax as rs

print x

if x == [] or x == [None]:
    a = False
else:
    a = True
# ---------- end ghpython_script_2 ----------
stream_filter = StreamFilter(Gate=ghpython_script_2, Stream1=ghpython_script.numberOut)
formatted_number = Data(stream_filter)
formatted_number_2 = ClusterOutput(formatted_number)

# ==== cluster Cluster_2
csv_data = ClusterInput()
csv_data_2 = Data(csv_data)
clean_tree = CleanTree(RemoveNulls=True, RemoveInvalid=True, RemoveEmpty=True, Tree=csv_data_2)
list_length = ListLength(List=clean_tree)
flatten_tree = FlattenTree(Tree=list_length, Path="{0}")
sort_list = SortList(Keys=flatten_tree)  # -> Keys, ValuesValuesA
last_index = LastIndex(List=sort_list.Keys)
list_item = ListItem(List=sort_list.Keys, Index=last_index, Wrap=True)
subtraction = Subtraction(A=list_item, B=list_length)
repeat_data = RepeatData(Length=subtraction)
insert_items = InsertItems(List=clean_tree, Item=repeat_data, Indices=list_length, Wrap=False)
clean_tree_2 = CleanTree(RemoveNulls=True, RemoveInvalid=True, RemoveEmpty=True, Tree=insert_items)
csv_data_3 = Data(clean_tree_2)
replace_text = ReplaceText(Text=csv_data_3, Find=",", RecursiveReplace=False)
text_split = TextSplit(Text=replace_text)
clean_tree_3 = CleanTree(RemoveNulls=True, RemoveInvalid=True, RemoveEmpty=True, Tree=text_split)
text_join = TextJoin(Text=clean_tree_3, Join=" ")
result = ClusterOutput(replace_text)

# ==== cluster CDHumanUIBrand
number_slider = Slider(55, range=0..1000)
file_path = FilePath("R:\Resources\_Software\Rhino\Resources\CD_Logo Filled.png")
create_image = CreateImage(ImageSource=file_path, ImageWidth=number_slider, ImageHeight=number_slider)
create_text_block = CreateTextBlock(Text="Powered by Ryan Computational Design", TextSize=18, Justification=2)
entwine = Entwine(Branch00=create_text_block, Branch01=create_image, FlattenInputs=True)
create_stack = CreateStack(UIElements=flatten(entwine), Horizontal=True)
create_separator = CreateSeparator(Thickness=1, Horizontal=True, Color=RGBA(0, 0, 0, 0), Height=Slider(5, range=0..10))
create_separator_2 = CreateSeparator(Thickness=1, Horizontal=True, Color=RGB(0, 0, 0))
create_separator_3 = CreateSeparator(Thickness=1, Horizontal=True, Color=RGBA(0, 0, 0, 0), Height=Slider(3, range=0..10))
horizontal_alignment = ValueList({"Left": 0, "Center": 1, "Right": 2, "Stretch": 3}, selected="Right")
vertical_alignment = ValueList({"Bottom": 0, "Center": 1, "Top": 2, "Stretch": 3}, selected="Top")
multiplication = Multiplication(A=number_slider, B=Slider(2.5, range=0..10))
adjust_element_positioning = AdjustElementPositioning(ElementsToAdjust=create_text_block, AbsolutePositioning=False, Width=multiplication)
adjust_element_appearance = AdjustElementAppearance(
    ElementsToAdjust=create_text_block,
    Foreground=ColourSwatch(SwatchColor=RGB(106, 163, 65)),
    FontSize=Slider(17, range=0..100))
adjust_element_positioning_2 = AdjustElementPositioning(
    ElementsToAdjust=create_stack,
    AbsolutePositioning=False,
    HorizontalAlignment=horizontal_alignment,
    VerticalAlignment=vertical_alignment)
entwine_2 = Entwine(Branch00=create_separator, Branch01=create_separator_2, Branch02=create_separator_3, FlattenInputs=True)
entwine_3 = Entwine(Branch00=flatten(entwine_2), Branch01=create_stack, FlattenInputs=True)  # -> flatten(Result)
elements = ClusterInput()
elements_2 = Data(elements)
entwine_4 = Entwine(Branch00=elements_2, Branch01=entwine_3, FlattenInputs=True)  # -> flatten(Result)
accent_colors = ValueList({"Amber", "Blue", "Brown", "Cobalt", "Crimson", "Cyan", "Emerald", "Green", "Indigo", "Lime", "Magenta", "Mauve", "Olive", "Orange", "Pink", "Purple", "Red", "Sienna", "Steel", "Taupe", "Teal", "Violet", "Yellow"}, selected="Green")
elements_3 = Data(entwine_4)
font_family = Data("Proxima Nova Rg")
elements_4 = ClusterOutput(elements_3)
accent_colors_2 = ClusterOutput(accent_colors)
font_family_2 = ClusterOutput(font_family)

# ==== cluster Cluster_3
text = ClusterInput()
text_join = TextJoin(Text=text, Join=" ")
concatenate = Concatenate(Fragment_A=" ", Fragment_B=text_join, A=" ")
result = ClusterOutput(concatenate)

# ==== cluster Cluster_4
curve = ClusterInput()
curve_2 = Curve(curve)
object_attributes = ObjectAttributes(ObjectOrAttributes=curve_2)  # -> Name, LayerName, LayerFullPath, Color, MaterialName, LinetypeName, GroupIndices, PlotWeight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
tree = ClusterInput()
member_index = MemberIndex(Set=object_attributes.LayerName, Member="_Working")  # -> Index, Count
flatten_tree = FlattenTree(Tree=tree, Path="{0}")
cull_index = CullIndex(List=flatten_tree, Indices=member_index.Index, Wrap=True)
graft_tree = GraftTree(Tree=cull_index, IncludeEmptyLists=True, IncludeNullItems=True)
tree_2 = ClusterOutput(graft_tree)
