# Grasshopper definition Contour Wave.ghx (Grasshopper 0.9.76)
# plug-ins: Weaverbird

number_slider = Slider(100, range=0..100)
number_slider_2 = Slider(100, range=0..100)
pi = Pi(Factor=Slider(13, range=0..20))
range = Range(Domain=pi, Steps=number_slider)
range_2 = Range(Domain=number_slider_2, Steps=number_slider)
range_3 = Range(Domain=number_slider_2, Steps=Slider(12, range=0..100))
sin = Sine(Value=range)
number_slider_3 = Slider(2, range=0..10)
multiplication = Multiplication(A=sin, B=Slider(1.82, range=0..10))
pt = ConstructPoint(XCoordinate=range_2, YCoordinate=multiplication, ZCoordinate=0)
Y = UnitY(Factor=range_3)
Y_2 = UnitY(Factor=number_slider_3)
nurbs = NurbsCurve(Vertices=pt, Degree=3, Periodic=False)  # -> Curve, Length, Domain
move = Move(Geometry=nurbs.Curve, Motion=Y_2)  # -> Geometry, Transform
move_2 = Move(Geometry=nurbs.Curve, Motion=Y)  # -> Geometry, Transform
merge = Merge(Data1=nurbs.Curve, Data2=move.Geometry)
bbox = BoundingBox(Content=merge, Plane=PlaneXY(0, 0, 0), UnionBox=True)  # -> Box, Box_2
box_corners = BoxCorners(Box=bbox.Box)  # -> CornerA, CornerB, CornerC, CornerD, CornerE, CornerF, CornerG, CornerH
pt_2 = Point(box_corners.CornerD)
xz = XZPlane(Origin=pt_2)
mirror = Mirror(Geometry=merge, Plane=xz)  # -> reverse(Geometry), Transform
move_3 = Move(Geometry=mirror.Geometry, Motion=Y_2)  # -> Geometry, Transform
merge_2 = Merge(Data1=merge, Data2=move_3.Geometry)
bbox_2 = BoundingBox(Content=merge_2, Plane=PlaneXY(0, 0, 0), UnionBox=True)  # -> Box, Box_2
group = Group(Objects=merge_2)
box_corners_2 = BoxCorners(Box=bbox_2.Box)  # -> CornerA, CornerB, CornerC, CornerD, CornerE, CornerF, CornerG, CornerH
num = Number(number_slider_3)
dist = Distance(PointA=box_corners_2.CornerA, PointB=box_corners_2.CornerD)
addition = Addition(A=dist, B=num)
number_slider_4 = Slider(30, range=0..100)
series = Series(Start=0, Step=addition, Count=Slider(6, range=0..10))
Y_3 = UnitY(Factor=series)
pi_2 = Pi(Factor=Slider(0.5, range=0..10))
move_4 = Move(Geometry=group, Motion=Y_3)  # -> Geometry, Transform
range_4 = Range(Domain=pi_2, Steps=number_slider_4)
range_5 = Range(Domain=Slider(10, range=0..10), Steps=number_slider_4)
ungroup = Ungroup(Group=move_4.Geometry)  # -> flatten(Objects)
sin_2 = Sine(Value=range_4)
multiplication_2 = Multiplication(A=sin_2, B=Slider(8, range=0..10))
group_2 = Group(Objects=ungroup)
vec = VectorXYZ(XComponent=range_5, YComponent=multiplication_2, ZComponent=0)  # -> Vector, Length
move_5 = Move(Geometry=group_2, Motion=vec.Vector)  # -> Geometry, Transform
bbox_3 = BoundingBox(Content=move_5.Geometry, Plane=PlaneXY(0, 0, 0), UnionBox=True)  # -> Box, Box_2
debrep = DeconstructBrep(Brep=bbox_3.Box)  # -> Faces, Edges, Vertices
crv = Curve(debrep.Faces)
area = Area(Geometry=crv)  # -> Area, Centroid
ungroup_2 = Ungroup(Group=move_5.Geometry)  # -> simplify(Objects)
scale_nu = ScaleNU(Geometry=crv, Plane=area.Centroid, ScaleX=Slider(0.7, range=0..1), ScaleY="2", ScaleZ=1)  # -> Geometry, Transform
trim = TrimWithRegion(Curve=ungroup_2, Region=scale_nu.Geometry)  # -> simplify(Inside), Outside
crv_2 = Curve(trim.Inside)
pshift = ShiftPaths(Data=crv_2, Offset=-1)
tree_branch_index = TreeBranchIndex(T=pshift, i=0)
cull_i = CullIndex(List=pshift, Indices="0", Wrap=True)
cull_i_2 = CullIndex(List=reverse(cull_i), Indices="0", Wrap=True)  # -> reverse(List)
partition = PartitionList(List=cull_i_2, Size="2")
loft = Loft(Curves=partition, Options={Adjust=False, Closed=False, LoftEnds=0, LoftSimp=0, LoftType=0, Rebuild=10, Refit=0.01})
crv_3 = Curve(simplify(loft))
pshift_2 = ShiftPaths(Data=crv_3, Offset=-1)
bbox_4 = BoundingBox(Content=flatten(pshift_2), Plane=PlaneXY(0, 0, 0), UnionBox=True)  # -> Box, Box_2
tstat = TreeStatistics(Tree=pshift_2)  # -> graft(Paths), Length, Count
debrep_2 = DeconstructBrep(Brep=bbox_4.Box)  # -> Faces, Edges, Vertices
lng = ListLength(List=tstat.Paths)  # -> simplify(Length)
crv_4 = Curve(debrep_2.Faces)
area_2 = Area(Geometry=crv_4)  # -> Area, Centroid
scale = Scale(Geometry=crv_4, Center=area_2.Centroid, Factor=Slider(1.39, range=0..10))  # -> Geometry, Transform
dup = DuplicateData(Data=scale.Geometry, Number=lng, Order=True)  # -> simplify(Data)
merge_3 = Merge(Data1=pshift_2, Data2=dup)
number_slider_5 = Slider(0.5, range=0..1)
boundary = BoundarySurfaces(Edges=merge_3)  # -> flatten(Surfaces)
Z = UnitZ(Factor=number_slider_5)
lng_2 = ListLength(List=boundary)
mesh = Mesh(boundary)
series_2 = Series(Start=0, Step=number_slider_5, Count=lng_2)
num_2 = Number(number_slider_4)
wbthicken = WeaverbirdsMeshThicken(MeshCurves=mesh, Distance=number_slider_5, OffsetType=0)
range_6 = Range(Domain=Domain(0, 1), Steps=num_2)
neg = Negative(Value=series_2)
unweld = UnweldMesh(Mesh=wbthicken, Angle=1.570796327)  # -> flatten(Result)
meshnormalize = MeshNormalize(mesh=unweld)  # -> out, A; inputs mesh: Mesh
# ---------- meshnormalize: C# ----------
    if(mesh != null){
      mesh.Normals.ComputeNormals();

      A = mesh;
    }
# ---------- end meshnormalize ----------
Z_2 = UnitZ(Factor=neg)
gradient = Gradient(LowerLimit=0, UpperLimit=1, Parameter=range_6, stops=[0: RGB(209, 179, 134), 1: RGB(255, 255, 255)])
move_6 = Move(Geometry=meshnormalize.A, Motion=Z_2)  # -> Geometry, Transform
preview = CustomPreview(Geometry=move_6.Geometry, Shader=gradient)

# ==== cluster TreeBranchIndex
T = ClusterInput()
i = ClusterInput()
viewer = ParamViewer(T)
item = ListItem(List=viewer, Index=i, Wrap=False)
branch = TreeBranch(Tree=T, Path=item, MaintainPaths=True)
B = ClusterOutput(branch)
