# Grasshopper definition Fractal Crystal.ghx (Grasshopper 0.9.76)
# plug-ins: Anemone

number_slider = Slider(20, range=0..100)
multiplication = Multiplication(A=number_slider, B="0.5")
polygon = Polygon(Plane=PlaneXY(0, 0, 0), Radius=number_slider, Segments=Slider(3, range=0..10), FilletRadius=0)  # -> Polygon, Length
addition = Addition(A=number_slider, B=multiplication)
explode = Explode(Curve=polygon.Polygon, Recursive=True)  # -> Segments, Vertices
division = Division(A=multiplication, B=addition)
acos = ArcCosine(Value=division)
pi = Pi(Factor="0.5")
eval = EvaluateLength(Curve=explode.Segments, Length="0.5", Normalized=True)  # -> Point, Tangent, Parameter
Z = UnitZ(Factor=1)
Z_2 = UnitZ(Factor=1)
vrot = Rotate(Vector=eval.Tangent, Axis=Z, Angle=pi)
pl = ConstructPlane(Origin=eval.Point, XAxis=vrot, YAxis=Z_2)
rotate = Rotate(Geometry=polygon.Polygon, Angle=acos, Plane=pl)  # -> Geometry, Transform
merge = Merge(Data1=flatten(polygon.Polygon), Data2=flatten(rotate.Geometry))
md_slider = MDSlider(slider_value=Point(0.5, 0.5, 0.5), SliderMode=0, x_domain=Domain(0, 1), y_domain=Domain(0, 1), z_domain=Domain(0, 1))
boundary = BoundarySurfaces(Edges=merge)  # -> reparameterize(Surfaces)
join = BrepJoin(Breps=boundary)  # -> Breps, Closed
smesh = SimpleMesh(Brep=join.Breps)
evalsrf = EvaluateSurface(Surface=boundary, Point=md_slider)  # -> Point, Normal, Frame
loop_start = LoopStart(N=Slider(5, range=0..5), D0=smesh, D1=evalsrf.Frame)  # -> port, Counter, Data, Data_2
lng = ListLength(List=loop_start.Data_2)
group = Group(Objects=loop_start.Data_2)
lng_2 = ListLength(List=loop_start.Data_2)
series = Series(Start=0, Step=1, Count=lng)
area = Area(Geometry=loop_start.Data)  # -> Area, Centroid
int = Integer(series)
dup = DuplicateData(Data=group, Number=lng_2, Order=True)
scale = Scale(Geometry=loop_start.Data, Center=area.Centroid, Factor=Slider(0.9, range=0..1))  # -> Geometry, Transform
ungroup = Ungroup(Group=dup)  # -> simplify(Objects)
graft = GraftTree(Tree=loop_start.Data_2, IncludeEmptyLists=True, IncludeNullItems=True)
mirror = Mirror(Geometry=scale.Geometry, Plane=loop_start.Data_2)  # -> Geometry, Transform
mirror_2 = Mirror(Geometry=ungroup, Plane=graft)  # -> simplify(Geometry), Transform
graft_2 = GraftTree(Tree=mirror.Geometry, IncludeEmptyLists=True, IncludeNullItems=True)
loop_end = LoopEnd(
    port=loop_start.port,
    Exit=False,
    Data=graft_2,
    Data_2=mirror_2.Geometry,
    pausedState=False,
    state="Constant & Record",
    TimeOutVal=0)  # -> simplify(D0), D1
merge_2 = Merge(Data1=smesh, Data2=loop_end.D0)
tstat = TreeStatistics(Tree=merge_2)  # -> Paths, Length, Count
dpath = DeconstructPath(Branch=tstat.Paths)  # -> simplify(Indices)
meshnormalize = MeshNormalize(mesh=merge_2)  # -> out, A; inputs mesh: Mesh
# ---------- meshnormalize: C# ----------
    if(mesh != null){
      mesh.Normals.ComputeNormals();

      A = mesh;
    }
# ---------- end meshnormalize ----------
lng_3 = ListLength(List=dpath)
bnd = Bounds(Numbers=flatten(lng_3))
remap = RemapNumbers(Value=lng_3, Source=bnd, Target=Domain(0, 1))  # -> Mapped, Clipped
gradient = Gradient(LowerLimit=0, UpperLimit=1, Parameter=remap.Mapped, stops=[0: RGB(72, 59, 255), 1: RGBA(130, 215, 255, 13)])
flatten = FlattenTree(Tree=meshnormalize.A, Path="{0}")
flatten_2 = FlattenTree(Tree=gradient, Path="{0}")
panel = Panel(gradient)
preview = CustomPreview(Geometry=flatten, Shader=flatten_2)
