# Grasshopper definition Hollowed Weave.ghx (Grasshopper 0.9.76)
# plug-ins: Dodo

number_slider = Slider(100, range=0..100)
number_slider_2 = Slider(6, range=0..15)
pt = ConstructPoint(XCoordinate=0, YCoordinate=0, ZCoordinate=0)
Y = UnitY(Factor=1)
X = UnitX(Factor=1)
range = Range(Domain=number_slider, Steps=number_slider_2)
line = LineSDL(Start=pt, Direction=X, Length=number_slider)
line_2 = LineSDL(Start=pt, Direction=Y, Length=number_slider)
Y_2 = UnitY(Factor=range)
X_2 = UnitX(Factor=range)
move = Move(Geometry=line, Motion=Y_2)  # -> Geometry, Transform
move_2 = Move(Geometry=line_2, Motion=X_2)  # -> Geometry, Transform
merge = Merge(Data1=move.Geometry, Data2=move_2.Geometry)
divide = DivideCurve(Curve=merge, Count=number_slider_2, Kinks=False)  # -> simplify(Points), Tangents, Parameters
dispatch = Dispatch(List=divide.Points, DispatchPattern=[True, False])  # -> simplify(ListA), simplify(ListB)
Z = UnitZ(Factor=Slider(10, range=0..30))
lng = ListLength(List=move.Geometry)
neg = Negative(Value=Z)
move_3 = Move(Geometry=dispatch.ListA, Motion=Z)  # -> Geometry, Transform
move_4 = Move(Geometry=dispatch.ListB, Motion=neg)  # -> Geometry, Transform
weave = Weave(Pattern=[0, 1], Stream0=move_3.Geometry, Stream1=move_4.Geometry, NullGaps=False)
group = Group(Objects=weave)  # -> flatten(Group)
split = SplitList(List=group, Index=lng)  # -> ListA, ListB
dispatch_2 = Dispatch(List=split.ListA, DispatchPattern=[True, False])  # -> ListA, ListB
dispatch_3 = Dispatch(List=split.ListB, DispatchPattern=[True, False])  # -> ListA, ListB
ungroup = Ungroup(Group=dispatch_2.ListA)  # -> simplify(Objects)
ungroup_2 = Ungroup(Group=dispatch_3.ListB)  # -> simplify(Objects)
pdecon = Deconstruct(Point=ungroup)  # -> XComponent, YComponent, ZComponent
pdecon_2 = Deconstruct(Point=ungroup_2)  # -> XComponent, YComponent, ZComponent
neg_2 = Negative(Value=pdecon.ZComponent)
neg_3 = Negative(Value=pdecon_2.ZComponent)
pt_2 = ConstructPoint(XCoordinate=pdecon.XComponent, YCoordinate=pdecon.YComponent, ZCoordinate=neg_2)
pt_3 = ConstructPoint(XCoordinate=pdecon_2.XComponent, YCoordinate=pdecon_2.YComponent, ZCoordinate=neg_3)
group_2 = Group(Objects=pt_2)  # -> flatten(Group)
group_3 = Group(Objects=pt_3)  # -> flatten(Group)
weave_2 = Weave(Pattern=[0, 1], Stream0=group_2, Stream1=dispatch_2.ListB, NullGaps=False)
weave_3 = Weave(Pattern=[0, 1], Stream0=dispatch_3.ListA, Stream1=group_3, NullGaps=False)
ungroup_3 = Ungroup(Group=weave_2)
ungroup_4 = Ungroup(Group=weave_3)
division = Division(A=number_slider, B=2)
intcrv = Interpolate(Vertices=ungroup_3, Degree=3, Periodic=False, KnotStyle=1)  # -> Curve, Length, Domain
intcrv_2 = Interpolate(Vertices=ungroup_4, Degree=3, Periodic=False, KnotStyle=1)  # -> Curve, Length, Domain
pt_4 = ConstructPoint(XCoordinate=division, YCoordinate=division, ZCoordinate=0)
division_2 = Division(A=division, B=Slider(3, range=0..10))
merge_2 = Merge(Data1=intcrv.Curve, Data2=intcrv_2.Curve)  # -> flatten(Result)
box = CenterBox(Base=pt_4, X=division, Y=division, Z=division_2)
divide_2 = DivideCurve(Curve=merge_2, Count=Slider(60, range=0..100), Kinks=False)  # -> Points, Tangents, Parameters
pline = PolyLine(Vertices=divide_2.Points, Closed=False)
explode = Explode(Curve=pline, Recursive=True)  # -> Segments, Vertices
lcharge = LineCharge(Line=explode.Segments, Charge=Slider(2, range=0..10), Bounds=box)
mergef = MergeFields(Fields=flatten(lcharge))
voxels = Voxels(Box=box, Number=Slider(15, range=0..100), F=mergef)
mt = MarchingTetrahedra(Voxels=voxels, Isolevel=Slider(0.47, range=0..1), TetrahedraCubes=Toggle(False))
meshnormalize = MeshNormalize(mesh=mt)  # -> out, A; inputs mesh: Mesh
# ---------- meshnormalize: C# ----------
    if(mesh != null){
      mesh.Normals.ComputeNormals();

      A = mesh;
    }
# ---------- end meshnormalize ----------
msmooth = SmoothMesh(Mesh=mt, Strength=0.5, SkipNaked=True, Iterations=Slider(2, range=0..10))
demesh = DeconstructMesh(Mesh=msmooth)  # -> Vertices, Faces, Colours, Normals
crv = Curve(merge_2)
pull = PullPoint(Point=demesh.Vertices, Geometry=crv, ClosestOnly=True)  # -> ClosestPoint, Distance
bnd = Bounds(Numbers=pull.Distance)
remap = RemapNumbers(Value=pull.Distance, Source=bnd, Target=Domain(0, 1))  # -> Mapped, Clipped
gradient = Gradient(LowerLimit=0, UpperLimit=1, Parameter=remap.Mapped, stops=[0: RGB(149, 237, 234), 0.795: RGB(0, 149, 255)])
mcol = MeshColours(Mesh=msmooth, Colours=gradient)
