# Grasshopper definition Pattern Structure.ghx (Grasshopper 0.9.76)
# plug-ins: MeshEdit Components, Kangaroo Components

number_slider = Slider(10, range=0..10)
pt = ConstructPoint(XCoordinate=0, YCoordinate=0, ZCoordinate=0)
polygon = Polygon(Plane=pt, Radius=number_slider, Segments="3", FilletRadius=0)  # -> Polygon, Length
extr = ExtrudePoint(Base=polygon.Polygon, Point=pt)
num = Number(number_slider)
division = Division(A=num, B="2")
smesh = SimpleMesh(Brep=extr)
X = UnitX(Factor=division)
number_slider_2 = Slider(10, range=0..10)
cos = Cosine(Value="Rad(30)")
move = Move(Geometry=smesh, Motion=X)  # -> Geometry, Transform
num_2 = Number(num)
mirror = Mirror(Geometry=move.Geometry, Plane=PlaneYZ(0, 0, 0))  # -> Geometry, Transform
multiplication = Multiplication(A=num, B=cos)
multiplication_2 = Multiplication(A=num_2, B="3")
merge = Merge(Data1=mirror.Geometry, Data2=move.Geometry)
division_2 = Division(A=multiplication_2, B="2")
group = Group(Objects=merge)
series = Series(Start=0, Step=multiplication_2, Count=number_slider_2)
X_2 = UnitX(Factor=series)
Y = UnitY(Factor=multiplication)
move_2 = Move(Geometry=group, Motion=X_2)  # -> flatten(Geometry), Transform
move_3 = Move(Geometry=move_2.Geometry, Motion=Y)  # -> Geometry, Transform
X_3 = UnitX(Factor=division_2)
multiplication_3 = Multiplication(A=multiplication, B="2")
group_2 = Group(Objects=move_2.Geometry)
move_4 = Move(Geometry=move_3.Geometry, Motion=X_3)  # -> Geometry, Transform
group_3 = Group(Objects=move_4.Geometry)
series_2 = Series(Start=0, Step=multiplication_3, Count=number_slider_2)
merge_2 = Merge(Data1=group_2, Data2=group_3)  # -> flatten(Result)
Y_2 = UnitY(Factor=series_2)
graft = GraftTree(Tree=Y_2, IncludeEmptyLists=True, IncludeNullItems=True)  # -> simplify(Tree)
move_5 = Move(Geometry=merge_2, Motion=graft)  # -> simplify(Geometry), Transform
flatten = FlattenTree(Tree=move_5.Geometry, Path="{0}")
ungroup = Ungroup(Group=flatten)  # -> simplify(Objects)
ungroup_2 = Ungroup(Group=ungroup)  # -> simplify(Objects)
flatten_2 = FlattenTree(Tree=ungroup_2, Path="{0}")
weldvertices = MeshWeldVertices(Mesh=flatten_2, Tolerance=0.01)  # -> RuntimeMessage, Mesh
Y_3 = UnitY(Factor=1)
medges = MeshEdges(Mesh=weldvertices.Mesh)  # -> NakedEdges, InteriorEdges, NonManifoldEdges
end = EndPoints(Curve=medges.NakedEdges)  # -> Start, End
vec2pt = Vector2Pt(PointA=end.Start, PointB=end.End, Unitize=False)  # -> simplify(Vector), Length
dprod = DotProduct(VectorA=vec2pt.Vector, VectorB=Y_3, Unitize=False)
sort = SortList(Keys=dprod, ValuesA=medges.NakedEdges)  # -> Keys, simplify(ValuesA)
flip = FlipMatrix(Data=sort.ValuesA)
dupln = RemoveDuplicateLines(Lines=flip, Tolerance=0.01)
join = JoinCurves(Curves=dupln, Preserve=False)  # -> simplify(Curves)
bang = ExplodeTree(Data=simplify(join))  # -> Branch0, Branch1, Branch2
cp = ControlPoints(Curve=bang.Branch1)  # -> Points, Weights, Knots
cp_2 = ControlPoints(Curve=bang.Branch0)  # -> Points, Weights, Knots
num_3 = Number(number_slider)
pdecon = Deconstruct(Point=cp_2.Points)  # -> XComponent, YComponent, ZComponent
multiplication_4 = Multiplication(A=num_3, B="1.5")
pdecon_2 = Deconstruct(Point=cp.Points)  # -> XComponent, YComponent, ZComponent
crv = Curve(bang.Branch2)
division_3 = Division(A=pdecon.XComponent, B=multiplication_4)
division_4 = Division(A=pdecon_2.XComponent, B=multiplication_4)
cp_3 = ControlPoints(Curve=crv)  # -> Points, Weights, Knots
mod = Modulus(A=division_3, B="2")
mod_2 = Modulus(A=division_4, B="2")
dispatch = Dispatch(List=cp_3.Points, DispatchPattern=[True, False])  # -> ListA, ListB
abs = Absolute(Value=mod)
abs_2 = Absolute(Value=mod_2)
number_slider_3 = Slider(10, range=0..10)
dispatch_2 = Dispatch(List=cp_2.Points, DispatchPattern=abs)  # -> ListA, ListB
dispatch_3 = Dispatch(List=cp.Points, DispatchPattern=abs_2)  # -> ListA, ListB
pt_2 = Point(dispatch_2.ListA)
pt_3 = Point(dispatch_3.ListA)
Z = UnitZ(Factor=number_slider_3)
move_6 = Move(Geometry=dispatch.ListB, Motion=Z)  # -> Geometry, Transform
item = ListItem(List=ungroup_2, Index=0, Wrap=True)
item_2 = ListItem(List=ungroup_2, Index=1, Wrap=True)
neg = Negative(Value=Z)
move_7 = Move(Geometry=dispatch.ListA, Motion=neg)  # -> Geometry, Transform
weave = Weave(Pattern=[0, 1], Stream0=move_7.Geometry, Stream1=move_6.Geometry, NullGaps=False)
weldvertices_2 = MeshWeldVertices(Mesh=item, Tolerance=0.01)  # -> RuntimeMessage, Mesh
weldvertices_3 = MeshWeldVertices(Mesh=item_2, Tolerance=0.01)  # -> RuntimeMessage, Mesh
move_8 = Move(Geometry=pt_2, Motion=neg)  # -> Geometry, Transform
move_9 = Move(Geometry=dispatch_2.ListB, Motion=Z)  # -> Geometry, Transform
move_10 = Move(Geometry=dispatch_3.ListB, Motion=neg)  # -> Geometry, Transform
move_11 = Move(Geometry=pt_3, Motion=Z)  # -> Geometry, Transform
medges_2 = MeshEdges(Mesh=weldvertices_2.Mesh)  # -> NakedEdges, InteriorEdges, NonManifoldEdges
medges_3 = MeshEdges(Mesh=weldvertices_3.Mesh)  # -> NakedEdges, InteriorEdges, NonManifoldEdges
Z_2 = UnitZ(Factor=number_slider_3)
weave_2 = Weave(Pattern=abs, Stream0=move_9.Geometry, Stream1=move_8.Geometry, NullGaps=False)
weave_3 = Weave(Pattern=abs_2, Stream0=move_10.Geometry, Stream1=move_11.Geometry, NullGaps=False)
crv_2 = Curve(medges_2.InteriorEdges)
crv_3 = Curve(medges_3.InteriorEdges)
neg_2 = Negative(Value=Z_2)
pline = PolyLine(Vertices=weave_2, Closed=False)
pline_2 = PolyLine(Vertices=weave_3, Closed=False)
pline_3 = PolyLine(Vertices=weave, Closed=False)
move_12 = Move(Geometry=crv_2, Motion=Z_2)  # -> Geometry, Transform
move_13 = Move(Geometry=crv_3, Motion=neg_2)  # -> Geometry, Transform
merge_3 = Merge(Data1=pline, Data2=pline_2, Data3=pline_3, Data4=move_12.Geometry, Data5=move_13.Geometry)
flatten_3 = FlattenTree(Tree=merge_3, Path="{0}")
pipe = Pipe(Curve=flatten_3, Radius=Slider(1, range=0..10), Caps=0)
preview = CustomPreview(Geometry=pipe, Shader=ColourSwatch(SwatchColor=RGB(255, 137, 10)))
