# Grasshopper definition Orange Peel.ghx (Grasshopper 0.9.76)
# plug-ins: Kangaroo2 Components

number_slider = Slider(15, range=0..100)
pt = ConstructPoint(XCoordinate=0, YCoordinate=0, ZCoordinate=0)
xz = XZPlane(Origin=pt)
pi = Pi(Factor=Slider(0.5, range=0..1))
Z = UnitZ(Factor=1)
arc = Arc(Plane=xz, Radius=Slider(100, range=0..100), Angle=pi)  # -> Arc, Length
line = LineSDL(Start=pt, Direction=Z, Length=1)
revsrf = Revolution(Curve=arc.Arc, Axis=line, Domain=Domain(0, 6.283185307))
scale_nu = ScaleNU(Geometry=revsrf, Plane=PlaneXY(0, 0, 0), ScaleX=1, ScaleY=1, ScaleZ=Slider(1.22, range=0..2))  # -> Geometry, Transform
range = Range(Domain=Domain(0, 1), Steps=Slider(10, range=0..20))
srf = Surface(reparameterize(scale_nu.Geometry))
cull_i = CullIndex(List=reverse(range), Indices=0, Wrap=True)  # -> reverse(List)
number_slider_2 = Slider(28, range=0..100)
graft = GraftTree(Tree=cull_i, IncludeEmptyLists=True, IncludeNullItems=True)  # -> simplify(Tree)
range_2 = Range(Domain=Domain(0, 1), Steps=expr("x-1", number_slider_2))
series = Series(Start=graft, Step=Slider(0.013, range=0..0.05), Count=number_slider_2)
mod = Modulus(A=series, B=1)
pt_2 = ConstructPoint(XCoordinate=mod, YCoordinate=range_2, ZCoordinate=0)
evalsrf = EvaluateSurface(Surface=srf, Point=pt_2)  # -> Point, Normal, Frame
neg = Negative(Value=Slider(5, range=0..10))
nurbs = NurbsCurve(Vertices=evalsrf.Point, Degree=3, Periodic=False)  # -> flatten(Curve), Length, Domain
ext = ExtendCurve(Curve=nurbs.Curve, Type=0, Start="0", End=neg)
makepair = MakePair(x=ext, loop=Toggle(True))  # -> out, A; inputs x: tree, loop: Boolean
# ---------- makepair: C# ----------
    DataTree<object> tree = new DataTree<object>();
    for(int i = 0; i < x.BranchCount; i++){
      List<object> planes = x.Branches[i];
      GH_Path pathO = x.Paths[i];
      int[] sample = new int[pathO.Length + 1];

      for(int t = 0; t < pathO.Length - 1; t++){
        sample[t] = pathO[t];
      }


      for(int n = 0; n < x.Branches[i].Count; n++){
        sample[pathO.Length - 1] = i;
        sample[pathO.Length] = n;

        GH_Path path = new GH_Path(sample);
        if(n < x.Branches[i].Count - 1){
          tree.Add(planes[n], path);
          tree.Add(planes[n + 1], path);
        }else if(loop){
          tree.Add(planes[x.Branches[i].Count - 1], path);
          tree.Add(planes[0], path);
        }

      }
    }

    A = tree;
# ---------- end makepair ----------
item = ListItem(List=makepair.A, Index=1, Wrap=True)
item_2 = ListItem(List=makepair.A, Index=0, Wrap=True)
divide = DivideCurve(Curve=item, Count=number_slider, Kinks=False)  # -> Points, Tangents, Parameters
divide_2 = DivideCurve(Curve=item_2, Count=number_slider, Kinks=False)  # -> Points, Tangents, Parameters
ln = Line(StartPoint=divide_2.Points, EndPoint=divide.Points)  # -> simplify(Line)
number_slider_3 = Slider(2, range=0..10)
neg_2 = Negative(Value=Slider(1, range=0..10))
ext_2 = ExtendCurve(Curve=ln, Type=0, Start=neg_2, End=neg_2)
lng = ListLength(List=ext_2)  # -> expr("x-1", Length)
end = EndPoints(Curve=ext_2)  # -> Start, End
pline = PolyLine(Vertices=end.Start, Closed=False)
pline_2 = PolyLine(Vertices=end.End, Closed=False)
merge = Merge(Data1=pline, Data2=pline_2)  # -> flatten(Result)
series_2 = Series(Start=0, Step=number_slider_3, Count=lng)
series_3 = Series(Start="3", Step=number_slider_3, Count=lng)
series_4 = Series(Start="2", Step=number_slider_3, Count=lng)
series_5 = Series(Start="1", Step=number_slider_3, Count=lng)
item_3 = ListItem(List=ext_2, Index=0, Wrap=True)
explode = Explode(Curve=merge, Recursive=True)  # -> simplify(Segments), Vertices
weave = Weave(Pattern=[0, 1], Stream0=end.Start, Stream1=end.End, NullGaps=False)
quad = MeshQuad(CornerA=series_2, CornerB=series_5, CornerC=series_3, CornerD=series_4)
end_2 = EndPoints(Curve=item_3)  # -> Start, End
makepair_2 = MakePair(x=explode.Segments, loop=Toggle(False))  # -> out, A; inputs x: tree, loop: Boolean; same code as makepair
merge_2 = Merge(Data1=end_2.Start, Data2=end_2.End)  # -> flatten(Result)
conmesh = ConstructMesh(Vertices=weave, Faces=quad)
item_4 = ListItem(List=makepair.A, Index=Slider(0, range=0..1), Wrap=True)  # -> simplify(Item)
mjoin = MeshJoin(Meshes=flatten(conmesh))
pt_3 = Point(end.Start)
item_5 = ListItem(List=makepair_2.A, Index=0, Wrap=True)
item_6 = ListItem(List=makepair_2.A, Index=1, Wrap=True)
medges = MeshEdges(Mesh=conmesh)  # -> simplify(NakedEdges), simplify(InteriorEdges), NonManifoldEdges
pi_2 = Pi(Factor=1)
anchor = Anchor(Point=merge_2, Strength=1000)
show = Show(G=conmesh)  # -> flatten(G)
planarize = Planarize(M=mjoin, Strength=Slider(10, range=0..100))
oncurve = OnCurve(Points=pt_3, Curve=item_4, Strength=Slider(1, range=0..100))
angle = Angle(LineA=item_5, LineB=item_6, RestAngle=pi_2, Strength=1)
length_line = LengthLine(Line=medges.InteriorEdges, Strength=Slider(1, range=0..1))
length_line_2 = LengthLine(Line=medges.NakedEdges, Strength=Slider(0.01, range=0.01..1))
merge_3 = Merge(
    Data1=flatten(show),
    Data2=flatten(anchor),
    Data3=flatten(planarize),
    Data4=flatten(oncurve),
    Data5=flatten(length_line_2),
    Data6=flatten(length_line),
    Data7=flatten(angle))
lng_2 = ListLength(List=show)  # -> expr("x-1", Length)
solver = Solver(
    GoalObjects=merge_3,
    Reset=Toggle(False),
    Restart=False,
    Parallel=True,
    Threshold=1e-15,
    Tolerance=0.01,
    AddCurrent=False,
    On=True)  # -> V, O
subset = SubList(List=solver.O, Domain=lng_2, Wrap=True)  # -> List, Index
mjoin_2 = MeshJoin(Meshes=subset.List)
meshnormalize = MeshNormalize(mesh=mjoin_2)  # -> out, A; inputs mesh: Mesh
# ---------- meshnormalize: C# ----------
    if(mesh != null){
      mesh.Normals.ComputeNormals();

      A = mesh;
    }
# ---------- end meshnormalize ----------
planaritydisplay = PlanarityDisplay(M=meshnormalize.A, I=Domain(0, 0.05), bool=True)  # -> num_2, M_2, C
mcol = MeshColours(Mesh=meshnormalize.A, Colours=planaritydisplay.C)

# ==== cluster PlanarityDisplay: Creates colours for each face of a mesh, showing planarity levels
I = ClusterInput()
M = ClusterInput()
bool = ClusterInput()
domcomp = DomainComponents(Domain=I)  # -> Start, End
mcomp = Decompose(Mesh=M)  # -> Vertices, Faces, Colours, Normals
bool_2 = Boolean(bool)
vertices = FaceVertices(Face=mcomp.Faces)  # -> CornerA, CornerB, CornerC, CornerD
item = ListItem(List=mcomp.Vertices, Index=vertices.CornerA, Wrap=False)
item_2 = ListItem(List=mcomp.Vertices, Index=vertices.CornerB, Wrap=False)
item_3 = ListItem(List=mcomp.Vertices, Index=vertices.CornerC, Wrap=False)
item_4 = ListItem(List=mcomp.Vertices, Index=vertices.CornerD, Wrap=False)
quad = MeshQuad(CornerA=0, CornerB=1, CornerC=3, CornerD=2)
entwine = Entwine(Branch00=item, Branch01=item_2, Branch02=item_4, Branch03=item_3, FlattenInputs=True)
flip = FlipMatrix(Data=entwine)
dist = Distance(PointA=item_2, PointB=item_4)
dist_2 = Distance(PointA=item, PointB=item_3)
P = Planarity(Point1=item, Point2=item_2, Point3=item_3, Point4=item_4)  # -> flatten(Height)
mesh = Mesh(Vertices=flip, Faces=quad)  # -> flatten(Mesh)
avr = Average(Input=[dist_2, dist])  # -> flatten(ArithmeticMean)
M_2 = ClusterOutput(mesh)
division = Division(A=P, B=avr)
filter = StreamFilter(Gate=bool_2, Stream0=division, Stream1=P)  # -> flatten(Stream)
gradient = Gradient(
    LowerLimit=domcomp.Start,
    UpperLimit=domcomp.End,
    Parameter=filter,
    stops=[0: RGB(0, 128, 0), 0.5: RGB(255, 255, 0), 1: RGB(255, 0, 0)])
num = Number(filter)
C = ClusterOutput(gradient)
num_2 = ClusterOutput(num)
