# Grasshopper definition Shaded Wave.ghx (Grasshopper 0.9.76)
# plug-ins: MeshEdit Components, Weaverbird

number_slider = Slider(100, range=0..100)
pt = ConstructPoint(XCoordinate=0, YCoordinate=0, ZCoordinate=0)
X = UnitX(Factor=1)
number_slider_2 = Slider(50, range=0..100)
line = LineSDL(Start=pt, Direction=X, Length=number_slider)
planesrf = PlaneSurface(Plane=pt, XSize=number_slider, YSize=number_slider)
sdivide = DivideSurface(Surface=planesrf, UCount=number_slider_2, VCount=number_slider_2)  # -> simplify(Points), Normals, Parameters
tstat = TreeStatistics(Tree=sdivide.Points)  # -> Paths, Length, Count
rad = Radians(Degrees=Slider(15, range=0..100))
lng = ListLength(List=tstat.Paths)
series = Series(Start=0, Step=rad, Count=lng)
sin = Sine(Value=series)
bnd = Bounds(Numbers=flatten(sin))
remap = RemapNumbers(Value=sin, Source=bnd, Target=Domain(0, 1))  # -> Mapped, Clipped
graph = GraphMapper(
    remap.Mapped,
    x0=0,
    x1=1,
    y0=0,
    y1=1,
    container_name="Bezier",
    cpx=[0, 0.4169736207, 0.5535066128, 1],
    cpy=[0, 0.364197135, 0.6995941997, 1])
num = Number(graph)
bnd_2 = Bounds(Numbers=flatten(num))
graft = GraftTree(Tree=num, IncludeEmptyLists=True, IncludeNullItems=True)
remap_2 = RemapNumbers(Value=num, Source=bnd_2, Target=Slider(18, range=0..100))  # -> Mapped, Clipped
remap_3 = RemapNumbers(Value=graft, Source=bnd_2, Target=Slider(1, range=0..1))  # -> Mapped, Clipped
multiplication = Multiplication(A=remap_3.Mapped, B=remap_2.Mapped)
Z = UnitZ(Factor=multiplication)
move = Move(Geometry=sdivide.Points, Motion=Z)  # -> Geometry, Transform
addition = Addition(A=number_slider_2, B=1)
flatten = FlattenTree(Tree=move.Geometry, Path="{0}")
frompoints = MeshFromPoints(Points=flatten, UDirection=addition, VDirection=addition)
srfgrid = SurfaceFromPoints(Points=flatten, UCount=addition, Interpolate=False)
wbframe = WeaverbirdsPictureFrame(MeshPolylines=frompoints, Distance=Slider(33, range=0..100), InsetType=0)
neg = Negative(Value=Slider(1, range=0..1))
wbthicken = WeaverbirdsMeshThicken(MeshCurves=wbframe, Distance=neg, OffsetType=0)
wbcatmullclark = WeaverbirdsCatmullClarkSubdivision(MeshCurves=wbthicken, Level=1, SmoothNakedEdges=1)
number_slider_3 = Slider(0.8, range=0..1)
demesh = DeconstructMesh(Mesh=wbcatmullclark)  # -> Vertices, Faces, Colours, Normals
preview = CustomPreview(
    Geometry=wbcatmullclark,
    Shader={ambient=RGB(0, 0, 0), diffuse=RGB(255, 105, 180), emission=RGB(76, 32, 54), shine=0.5, specular=RGB(255, 255, 255), transparency=0})
devec = DeconstructVector(Vector=graft(demesh.Normals))  # -> XComponent, YComponent, ZComponent
multiplication_2 = Multiplication(A=devec.YComponent, B=number_slider_3)
multiplication_3 = Multiplication(A=devec.XComponent, B=number_slider_3)
merge = Merge(Data1=multiplication_3, Data2=multiplication_2, Data3=devec.ZComponent)
ma = MassAddition(Input=merge)  # -> Result, PartialResults
bnd_3 = Bounds(Numbers=flatten(ma.Result))
remap_4 = RemapNumbers(Value=ma.Result, Source=bnd_3, Target=Domain(0, 1))  # -> Mapped, Clipped
frgb = ColourRGBF(Alpha=1, Red=remap_4.Mapped, Green=remap_4.Mapped, Blue=remap_4.Mapped)  # -> flatten(Colour)
mcol = MeshColours(Mesh=wbcatmullclark, Colours=frgb)
