# Grasshopper definition Particle Vortex.ghx (Grasshopper 0.9.76)
# plug-ins: Python Interpreter

number_slider = Slider(100, range=0..1000)
rectangle = Rectangle(Plane=PlaneXY(0, 0, 0), XSize=number_slider, YSize=number_slider, Radius=0)  # -> Rectangle, Length
number_slider_2 = Slider(100, range=0..100)
area = Area(Geometry=rectangle.Rectangle)  # -> Area, Centroid
pop2d = Populate2D(Region=rectangle.Rectangle, Count=Slider(100, range=0..100), Seed=1)
cir = Circle(Plane=area.Centroid, Radius=number_slider_2)
number_slider_3 = Slider(20.9, range=0..50)
python = PythonScript(pts=pop2d, speed=Slider(6.38, range=0..10))  # -> out, a; inputs pts: list of Point3d
# ---------- python: Python ----------
import rhinoscriptsyntax as rs
import Rhino.Geometry as geo
import math

class Particle:
    
    def __init__(self,_pos, _speed):
        self.pos = _pos
        self.speed = _speed
        self.vel = geo.Vector3d(0,0,0)
        
    def spin(self,pt,rad):
        spinVel = geo.Vector3d(0,0,0)
        dist = rs.Distance(pt, self.pos)
        vel = pt - self.pos
        if(dist < rad):
            vel = rs.VectorRotate(vel,90,geo.Vector3d(0,0,1))
            spinVel = rs.VectorUnitize(vel)
            spinVel = spinVel * speed
        self.vel = self.vel + spinVel
    
    def cohesion(self,others,coh):
        cohVel = geo.Vector3d(0,0,0)
        minDist = float.PositiveInfinity
        minVel = geo.Vector3d(0,0,0)

        for i in range(len(others)):
            if(others[i] != self):
                dist = rs.Distance(others[i].pos,self.pos)
                if dist > coh:
                    tempVel = rs.VectorSubtract(others[i].pos,self.pos)
                    cohVel = rs.VectorAdd(cohVel,tempVel)
        if rs.VectorLength(cohVel) > 0:
            cohVel = rs.VectorUnitize(cohVel)
            cohVel = cohVel * speed*0.4
        
            self.vel = self.vel + cohVel
    
    def separate(self, others, sep):
        combinedVel = geo.Vector3d(0,0,0)
        combinedCount = 0
        for i in range(len(others)):
            if(others[i] != self):
                dist = rs.Distance(others[i].pos, self.pos)
                if(dist < sep):
                    
                    dif = rs.VectorSubtract(self.pos,others[i].pos)
                    dif = rs.VectorUnitize(dif)
                    combinedVel = rs.VectorAdd(combinedVel, dif)
                    
                    combinedCount += 1
        if(combinedCount > 0):
            combinedVel = rs.VectorDivide(combinedVel, combinedCount)
            combinedVel = rs.VectorUnitize(combinedVel)
            combinedVel = combinedVel * self.speed
            
        self.vel = self.vel + combinedVel
        
    def run(self, others, sepDist,cohDist, spinPt, spinRad):
        self.vel = geo.Vector3d(0,0,0)
        self.cohesion(others,cohDist)
        self.separate(others,sepDist)
        self.spin(spinPt,spinRad)
        
        self.pos = self.pos + self.vel
    
    def show(self):
        return rs.AddPoint(self.pos)

list = []
for i in range(len(pts)):
    pInstance = Particle(pts[i], speed)
    list.append(pInstance)

a = list
# ---------- end python ----------
timer = Timer(TimerInterval=5, Target=python_2)  # disabled
number_slider_4 = Slider(10, range=0..10)
python_2 = PythonScript(particles=python.a, sep=number_slider_3, coh=number_slider_3, pt=area.Centroid, rad=number_slider_2)  # -> out, a; inputs particles: list, pt: Point3d
# ---------- python_2: Python ----------
import rhinoscriptsyntax as rs

newParticles = []

for i in range(len(particles)):
    particle = particles[i]
    
    particle.run(particles,sep,coh,pt,rad)
    
    newParticles.append(particle.show())

a = newParticles
# ---------- end python_2 ----------
division = Division(A=number_slider_3, B=2)
msphere = MeshSphere(Base=python_2.a, Radius=division, UCount=number_slider_4, VCount=number_slider_4)
lng = ListLength(List=msphere)
panel = Panel(python_2.out)
random = Random(Range=Domain(0, 1), Number=lng, Seed=2)
hsl = ColourHSL(Alpha=1, Hue=random, Saturation=1, Luminance=0.5)
preview = CustomPreview(Geometry=msphere, Shader=hsl)
