# Grasshopper definition Waffle Bomb.ghx (Grasshopper 0.9.76)
# plug-ins: Python Interpreter

pt = ConstructPoint(XCoordinate=0, YCoordinate=0, ZCoordinate=0)
xz = XZPlane(Origin=pt)
pi = Pi(Factor="0.5")
arc = Arc(Plane=xz, Radius=Slider(100, range=0..100), Angle=pi)  # -> Arc, Length
Z = UnitZ(Factor=1)
flip = FlipCurve(Curve=arc.Arc)  # -> Curve, Flag
line = LineSDL(Start=pt, Direction=Z, Length=1)
number_slider = Slider(60, range=0..100)
number_slider_2 = Slider(20, range=0..100)
revsrf = Revolution(Curve=flip.Curve, Axis=line, Domain=Domain(0, 6.283185307))
number_slider_3 = Slider(35.4, range=0..100)
multiplication = Multiplication(A=Slider(10, range=0..10), B="2")
sdivide = DivideSurface(Surface=revsrf, UCount=number_slider, VCount=number_slider_2)  # -> simplify(Points), simplify(Normals), Parameters
pi_2 = Pi(Factor=Slider(7, range=0..10))
pi_3 = Pi(Factor=multiplication)
range = Range(Domain=pi_2, Steps=number_slider_2)
range_2 = Range(Domain=pi_3, Steps=number_slider)
neg = Negative(Value="1")
cos = Cosine(Value=range_2)
sin = Sine(Value=range)
neg_2 = Negative(Value=number_slider_3)
dom = ConstructDomain(DomainStart=neg, DomainEnd="1")
bnd = Bounds(Numbers=sin)
bnd_2 = Bounds(Numbers=cos)
dom_2 = ConstructDomain(DomainStart=neg_2, DomainEnd=number_slider_3)
remap = RemapNumbers(Value=cos, Source=bnd_2, Target=Slider(1, range=0..1))  # -> Mapped, Clipped
remap_2 = RemapNumbers(Value=sin, Source=dom, Target=dom_2)  # -> Mapped, Clipped
graft = GraftTree(Tree=remap.Mapped, IncludeEmptyLists=True, IncludeNullItems=True)
multiplication_2 = Multiplication(A=remap_2.Mapped, B=graft)  # -> simplify(Result)
neg_3 = Negative(Value=multiplication_2)
amp = Amplitude(Vector=sdivide.Normals, Amplitude=neg_3)
move = Move(Geometry=sdivide.Points, Motion=amp)  # -> Geometry, Transform
num = Number(number_slider)
addition = Addition(A=num, B="1")
flatten = FlattenTree(Tree=move.Geometry, Path="{0}")
srfgrid = SurfaceFromPoints(Points=flatten, UCount=addition, Interpolate=False)
pi_4 = Pi(Factor=1)
flip_2 = Flip(Surface=srfgrid)  # -> Surface, Result
range_3 = Range(Domain=pi_4, Steps=Slider(60, range=0..100))
xy = XYPlane(Origin=pt)
rebuildsurface = RebuildSurface(srf=flip_2.Surface, u=number_slider, v=number_slider_2)  # -> out, a; inputs u: Int32, v: Int32
# ---------- rebuildsurface: Python ----------
import math
import rhinoscriptsyntax as rs

rs.RebuildSurface(srf,[3,3],[u,v])
a = srf
# ---------- end rebuildsurface ----------
yz = YZPlane(Origin=pt)
rotate = Rotate(Geometry=xy, Angle=range_3, Plane=xz)  # -> Geometry, Transform
rotate_2 = Rotate(Geometry=xy, Angle=range_3, Plane=yz)  # -> Geometry, Transform
cap = CapHoles(Brep=rebuildsurface.a)
sec = BrepPlane(Brep=cap, Plane=rotate_2.Geometry)  # -> Curves, Points
sec_2 = BrepPlane(Brep=cap, Plane=rotate.Geometry)  # -> Curves, Points
boundary = BoundarySurfaces(Edges=sec_2.Curves)
boundary_2 = BoundarySurfaces(Edges=sec.Curves)
flatten_2 = FlattenTree(Tree=boundary, Path="{0}")
flatten_3 = FlattenTree(Tree=boundary_2, Path="{0}")
md_slider = MDSlider(slider_value=Point(0.5, 0.5, 0.5), SliderMode=0, x_domain=Domain(0, 1), y_domain=Domain(0, 1), z_domain=Domain(0, 1))
merge = Merge(Data1=flatten_2, Data2=flatten_3)
evalsrf = EvaluateSurface(Surface=reparameterize(merge), Point=md_slider)  # -> Point, Normal, Frame
amp_2 = Amplitude(Vector=evalsrf.Normal, Amplitude=Slider(2, range=0..20))
extr = Extrude(Base=merge, Direction=amp_2)
division = Division(A=amp_2, B=-2)
move_2 = Move(Geometry=extr, Motion=division)  # -> Geometry, Transform
preview = CustomPreview(Geometry=move_2.Geometry, Shader=ColourSwatch(SwatchColor=RGB(113, 255, 25)))
