# Grasshopper definition Glitch Ripple.ghx (Grasshopper 0.9.76)
# plug-ins: MeshEdit Components

number_slider = Slider(100, range=0..100)
number_slider_2 = Slider(100, range=0..100)
planesrf = PlaneSurface(Plane=PlaneXY(0, 0, 0), XSize=number_slider, YSize=number_slider)
sdivide = DivideSurface(Surface=planesrf, UCount=number_slider_2, VCount=number_slider_2)  # -> simplify(Points), Normals, Parameters
area = Area(Geometry=planesrf)  # -> Area, Centroid
flatten = FlattenTree(Tree=sdivide.Points, Path="{0}")
dist = Distance(PointA=area.Centroid, PointB=flatten)
bnd = Bounds(Numbers=dist)
remap = RemapNumbers(Value=dist, Source=bnd, Target=Domain(0, 1))  # -> Mapped, Clipped
graph = GraphMapper(remap.Mapped, x0=0, x1=1, y0=0, y1=1, container_name="Sine", Equation_px=[0, 0.113721475], Equation_py=[0, 1])
gradient = Gradient(LowerLimit=0, UpperLimit=1, Parameter=graph, stops=[0: RGB(112, 112, 112), 1: RGB(0, 0, 0)])
gradient_2 = Gradient(LowerLimit=0, UpperLimit=1, Parameter=remap.Mapped, stops=[0: RGB(89, 119, 217), 1: RGB(255, 33, 74)])
bnd_2 = Bounds(Numbers=graph)
remap_2 = RemapNumbers(Value=graph, Source=bnd_2, Target=Slider(10, range=0..20))  # -> Mapped, Clipped
num = Number(number_slider_2)
Z = UnitZ(Factor=remap_2.Mapped)
addition = Addition(A=num, B="1")
move = Move(Geometry=flatten, Motion=Z)  # -> Geometry, Transform
addition_2 = Addition(A=gradient, B=gradient_2)
frompoints = MeshFromPoints(Points=move.Geometry, UDirection=addition, VDirection=addition, Colour=addition_2)
demesh = DeconstructMesh(Mesh=frompoints)  # -> Vertices, Faces, Colours, Normals
number_slider_3 = Slider(8, range=0..20)
lng = ListLength(List=demesh.Vertices)
division = Division(A=lng, B=number_slider_3)
multiplication = Multiplication(A=Slider(0.1, range=0..1), B=division)
multiplication_2 = Multiplication(A=Slider(2, range=0..10), B=division)
dom = ConstructDomain(DomainStart=multiplication, DomainEnd=multiplication_2)
random = Random(Range=dom, Number=number_slider_3, Seed=Slider(34, range=0..100))
col = Colour(addition_2)
partition = PartitionList(List=demesh.Vertices, Size=random)
partition_2 = PartitionList(List=col, Size=random)
group = Group(Objects=partition)  # -> flatten(Group)
group_2 = Group(Objects=partition_2)  # -> flatten(Group)
lng_2 = ListLength(List=group)
random_2 = Random(Range=Domain(0, 1), Number=lng_2, Seed=Slider(412, range=0..1000))
sort = SortList(Keys=random_2, ValuesA=group_2)  # -> Keys, ValuesA
sort_2 = SortList(Keys=random_2, ValuesA=group)  # -> Keys, ValuesA
ungroup = Ungroup(Group=sort_2.ValuesA)
ungroup_2 = Ungroup(Group=sort.ValuesA)
flatten_2 = FlattenTree(Tree=ungroup, Path="{0}")
flatten_3 = FlattenTree(Tree=ungroup_2, Path="{0}")
pdecon = Deconstruct(Point=flatten_2)  # -> XComponent, YComponent, ZComponent
pdecon_2 = Deconstruct(Point=demesh.Vertices)  # -> XComponent, YComponent, ZComponent
pt = ConstructPoint(XCoordinate=pdecon_2.XComponent, YCoordinate=pdecon_2.YComponent, ZCoordinate=pdecon.ZComponent)
conmesh = ConstructMesh(Vertices=pt, Faces=demesh.Faces, Colours=flatten_3)
preview = CustomPreview(Geometry=conmesh, Shader=ColourSwatch(SwatchColor=RGB(176, 176, 176)))
