# Grasshopper definition Punching Tetrapod.ghx (Grasshopper 0.9.76)
# plug-ins: MeshEdit Components, Weaverbird

number_slider = Slider(10, range=0..10)
pt = ConstructPoint(XCoordinate=0, YCoordinate=0, ZCoordinate=0)
rad = Radians(Degrees="30")
polygon = Polygon(Plane=pt, Radius=number_slider, Segments=Slider(3, range=0..10), FilletRadius=0)  # -> Polygon, Length
sin = Sine(Value=rad)
explode = Explode(Curve=polygon.Polygon, Recursive=True)  # -> Segments, Vertices
boundary = BoundarySurfaces(Edges=polygon.Polygon)
multiplication = Multiplication(A=sin, B=number_slider)
eval = EvaluateLength(Curve=explode.Segments, Length="0.5", Normalized=True)  # -> Point, Tangent, Parameter
addition = Addition(A=multiplication, B=number_slider)
num = Number(addition)
line = LineSDL(Start=eval.Point, Direction=eval.Tangent, Length=1)
division = Division(A=multiplication, B=num)
acos = ArcCosine(Value=division)
rotax = RotateAxis(Geometry=boundary, Angle=acos, Axis=line)  # -> Geometry, Transform
merge = Merge(Data1=flatten(boundary), Data2=flatten(rotax.Geometry))
join = BrepJoin(Breps=merge)  # -> Breps, Closed
debrep = DeconstructBrep(Brep=join.Breps)  # -> Faces, Edges, Vertices
area = Area(Geometry=debrep.Faces)  # -> Area, Centroid
srf_cp = SurfaceClosestPoint(Point=area.Centroid, Surface=reparameterize(debrep.Faces))  # -> Point, UVPoint, Distance
evalsrf = EvaluateSurface(Surface=reparameterize(debrep.Faces), Point=srf_cp.UVPoint)  # -> Point, Normal, Frame
amp = Amplitude(Vector=evalsrf.Normal, Amplitude=Slider(44, range=0..100))
extr = Extrude(Base=debrep.Faces, Direction=amp)
merge_2 = Merge(Data1=join.Breps, Data2=extr)  # -> flatten(Result)
sunion = SolidUnion(Breps=merge_2)
smesh = SimpleMesh(Brep=sunion)
wbcatmullclark = WeaverbirdsCatmullClarkSubdivision(MeshCurves=smesh, Level=Slider(1, range=0..10), SmoothNakedEdges=1)
bbox = BoundingBox(Content=wbcatmullclark, Plane=PlaneXY(0, 0, 0), UnionBox=True)  # -> Box, Box_2
area_2 = Area(Geometry=bbox.Box)  # -> Area, Centroid
scale = Scale(Geometry=bbox.Box, Center=area_2.Centroid, Factor=Slider(1.2, range=0..10))  # -> Geometry, Transform
popgeo = PopulateGeometry(Geometry=wbcatmullclark, Count=Slider(100, range=0..100), Seed=1)
voronoi³ = Voronoi3D(Points=popgeo, Box=scale.Geometry)  # -> Cells, Boundary
mesh = Mesh(voronoi³.Cells)
mmx = MeshMesh(MeshA=wbcatmullclark, MeshB=mesh, UseMeshMeshFast=True)  # -> simplify(Intersections)
bbox_2 = BoundingBox(Content=mmx, Plane=PlaneXY(0, 0, 0))  # -> Box, Box_2
area_3 = Area(Geometry=bbox_2.Box)  # -> Area, Centroid
scale_2 = Scale(Geometry=mmx, Center=area_3.Centroid, Factor=Slider(0.78, range=0..1))  # -> simplify(Geometry), Transform
merge_3 = Merge(Data1=mmx, Data2=scale_2.Geometry)
loft = Loft(Curves=merge_3, Options={Adjust=False, Closed=False, LoftEnds=0, LoftSimp=0, LoftType=0, Rebuild=10, Refit=0.01})  # -> flatten(Loft)
join_2 = BrepJoin(Breps=loft)  # -> Breps, Closed
smesh_2 = SimpleMesh(Brep=join_2.Breps)
weldvertices = MeshWeldVertices(Mesh=smesh_2, Tolerance=0.01)  # -> RuntimeMessage, Mesh
wbthicken = WeaverbirdsMeshThicken(MeshCurves=weldvertices.Mesh, Distance=Slider(2, range=0..3), OffsetType=0)
wbcatmullclark_2 = WeaverbirdsCatmullClarkSubdivision(MeshCurves=wbthicken, Level=Slider(2, range=0..10), SmoothNakedEdges=1)
demesh = DeconstructMesh(Mesh=wbcatmullclark_2)  # -> Vertices, Faces, Colours, Normals
Z = UnitZ(Factor=1)
pt_2 = Point(pt)
dprod = DotProduct(VectorA=demesh.Normals, VectorB=Z, Unitize=False)
dist = Distance(PointA=pt_2, PointB=demesh.Vertices)
multiplication_2 = Multiplication(A=dprod, B=dist)
bnd = Bounds(Numbers=multiplication_2)
remap = RemapNumbers(Value=multiplication_2, Source=bnd, Target=Domain(0, 1))  # -> Mapped, Clipped
gradient = Gradient(
    LowerLimit=0,
    UpperLimit=1,
    Parameter=remap.Mapped,
    stops=[0: RGB(234, 38, 0), 0.25: RGB(234, 126, 0), 0.5: RGB(254, 244, 84), 0.75: RGB(173, 203, 249), 1: RGB(75, 107, 169)])
mcol = MeshColours(Mesh=wbcatmullclark_2, Colours=gradient)
