# Grasshopper definition GHpython3.gh (Grasshopper 1.0.8)
# Copyright: Copyright 2024 Corgan Associates, Inc
# plug-ins: RhinoCodePluginGH

# Corgan Practice Technology Grasshopper Template 0.1
python_3_script = Python3Script()  # -> out, a
# ---------- python_3_script: Python ----------
import re

def format_sheet_number(sheet_number):
    # Dictionary to convert the letter to the military alphabet designation
    military_alphabet = {
        'A': 'Alpha',
        'B': 'Bravo',
        'C': 'Charlie',
        'D': 'Delta',
        'E': 'Echo',
        'F': 'Foxtrot',
        'G': 'Golf',
        'H': 'Hotel',
        'I': 'India',
        'J': 'Juliett',
        'K': 'Kilo',
        'L': 'Lima',
        'M': 'Mike',
        'N': 'November',
        'O': 'Oscar',
        'P': 'Papa',
        'Q': 'Quebec',
        'R': 'Romeo',
        'S': 'Sierra',
        'T': 'Tango',
        'U': 'Uniform',
        'V': 'Victor',
        'W': 'Whiskey',
        'X': 'X-ray',
        'Y': 'Yankee',
        'Z': 'Zulu'
    }
    
    # Regular expression pattern to match the input format
    pattern = r'^([A-Za-z])(\d{2})-(\d{2})([A-Za-z]?)$'
    
    # Function to replace the matched pattern with the desired format
    def replace(match):
        if not match:
            return sheet_number
        
        letter = match.group(1)
        sheet_number_1 = match.group(2)
        sheet_number_2 = match.group(3)
        optional_letter = match.group(4) or ''
        
        if letter in military_alphabet:
            military_name = military_alphabet[letter]
            formatted_number = military_name + "." + sheet_number_1.zfill(3) + sheet_number_2 + optional_letter
            return formatted_number
        else:
            return sheet_number
    
    # Apply the regular expression substitution
    match = re.match(pattern, sheet_number)
    output_string = replace(match)
    
    return output_string

a = format_sheet_number(sheet_number)
# ---------- end python_3_script ----------
