# Grasshopper definition 0027 Metaball Building.ghx (Grasshopper 0.9.76)
# plug-ins: Python Interpreter, Kangaroo Components

number_slider = Slider(8, range=0..10)
number_slider_2 = Slider(100, range=0..100)
neg = Negative(Value=number_slider_2)
box = CenterBox(Base=PlaneXY(0, 0, 0), X=number_slider_2, Y=number_slider_2, Z=number_slider_2)
dom = ConstructDomain(DomainStart=Slider(808, range=0..1000), DomainEnd=Slider(1000, range=0..1000))
dom_2 = ConstructDomain(DomainStart=neg, DomainEnd=number_slider_2)
range = Range(Domain=dom_2, Steps=Slider(30, range=0..100))
random = Random(Range=dom, Number=number_slider, Seed=Slider(67, range=0..100))
pop3d = Populate3D(Region=box, Count=number_slider, Seed=Slider(23, range=0..100))
subset = SubList(List=range, Domain=Domain(0, 1), Wrap=True)  # -> List, Index
pt = ConstructPoint(XCoordinate=0, YCoordinate=0, ZCoordinate=range)
item = ListItem(List=subset.List, Index=0, Wrap=True)
item_2 = ListItem(List=subset.List, Index=1, Wrap=True)
xy = XYPlane(Origin=pt)
subtraction = Subtraction(A=item_2, B=item)
graft = GraftTree(Tree=xy, IncludeEmptyLists=True, IncludeNullItems=True)  # -> simplify(Tree)
metaball_t = MetaBallTCustom(Points=flatten(pop3d), Charge=flatten(random), Plane=graft, Threshold=0.5)  # -> simplify(Isocurve)
explode = Explode(Curve=metaball_t, Recursive=True)  # -> simplify(Segments), Vertices
pshift = ShiftPaths(Data=explode.Segments, Offset=-1)
dupln = RemoveDuplicateLines(Lines=pshift, Tolerance=0.01)
join = JoinCurves(Curves=dupln, Preserve=False)  # -> simplify(Curves)
len = Length(Curve=join)
division = Division(A=len, B=Slider(20, range=0..100))
reb = RebuildCurve(Curve=simplify(join), Degree=Slider(3, range=0..10), Count=simplify(division), Tangents=False)
md_slider = MDSlider(slider_value=Point(0.5, 0.5, 0.5), SliderMode=0, x_domain=Domain(0, 1), y_domain=Domain(0, 1), z_domain=Domain(0, 1))
boundary = BoundarySurfaces(Edges=reb)
evalsrf = EvaluateSurface(Surface=reparameterize(boundary), Point=md_slider)  # -> Point, Normal, Frame
Z = UnitZ(Factor=1)
dprod = DotProduct(VectorA=Z, VectorB=evalsrf.Normal, Unitize=False)
equals = Equality(FirstNumber=dprod, SecondNumber=1)  # -> Equality, Inequality
dispatch = Dispatch(List=boundary, DispatchPattern=equals.Equality)  # -> ListA, ListB
flip = Flip(Surface=dispatch.ListB)  # -> Surface, Result
weave = Weave(Pattern=[0, 1], Stream0=flip.Surface, Stream1=dispatch.ListA, NullGaps=False)
group = Group(Objects=weave)  # -> flatten(Group)
neg_2 = Negative(Value="1")
shift = ShiftList(List=group, Shift=neg_2, Wrap=False)
shift_2 = ShiftList(List=group, Shift="1", Wrap=False)
ungroup = Ungroup(Group=shift)  # -> simplify(Objects)
ungroup_2 = Ungroup(Group=shift_2)
item_3 = ListItem(List=ungroup, Index=0, Wrap=True)
crv = Curve(simplify(ungroup_2))
pln = Plane(simplify(item_3))
project = Project(Geometry=crv, Plane=pln)  # -> Geometry, Transform
group_2 = Group(Objects=project.Geometry)
lng = ListLength(List=ungroup)
dup = DuplicateData(Data=group_2, Number=lng, Order=True)  # -> simplify(Data)
ungroup_3 = Ungroup(Group=dup)  # -> simplify(Objects)
graft_2 = GraftTree(Tree=ungroup, IncludeEmptyLists=True, IncludeNullItems=True)
graft_3 = GraftTree(Tree=dup, IncludeEmptyLists=True, IncludeNullItems=True)
srfsplit = SurfaceSplit(Surface=graft_2, Curves=ungroup_3)  # -> simplify(Fragments)
lng_2 = ListLength(List=srfsplit)
popgeo = PopulateGeometry(Geometry=srfsplit, Count="1", Seed=1)
dup_2 = DuplicateData(Data=graft_3, Number=lng_2, Order=True)
pshift_2 = ShiftPaths(Data=popgeo, Offset=-1)
ungroup_4 = Ungroup(Group=dup_2)  # -> simplify(Objects)
incurves = PointInCurves(Point=popgeo, Curves=ungroup_4)  # -> Relationship, Index, Point
equals_2 = Equality(FirstNumber=incurves.Relationship, SecondNumber=Slider(2, range=0..10))  # -> Equality, Inequality
number_slider_3 = Slider(34, range=0..100)
pshift_3 = ShiftPaths(Data=equals_2.Equality, Offset=-1)
cull = CullPattern(List=srfsplit, CullPattern=pshift_3)
cull_2 = CullPattern(List=pshift_2, CullPattern=pshift_3)
crv_2 = Curve(cull)
num = Number(subtraction)
prune = PruneTree(Tree=crv_2, Minimum=1, Maximum=0)
prune_2 = PruneTree(Tree=cull_2, Minimum=1, Maximum=0)
Z_2 = UnitZ(Factor=num)
Z_3 = UnitZ(Factor=Slider(1, range=0..1))
offsetcrv = OffsetCurve(crv=prune, pt=prune_2, dist=Slider(2, range=0..10))  # -> out, a; inputs crv: Curve, pt: Point3d
# ---------- offsetcrv: Python ----------
import math
import rhinoscriptsyntax as rs
import scriptcontext as sc

sc.doc = ghdoc

a = rs.OffsetCurve(crv,pt,dist)
# ---------- end offsetcrv ----------
extr = Extrude(Base=offsetcrv.a, Direction=Z_2)
extr_2 = Extrude(Base=weave, Direction=Z_3)
preview = CustomPreview(Geometry=extr_2, Shader=ColourSwatch(SwatchColor=RGB(56, 56, 56)))
preview_2 = CustomPreview(Geometry=extr, Shader=ColourSwatch(SwatchColor=RGB(89, 227, 255)))
