# Grasshopper definition Checker Textile.ghx (Grasshopper 0.9.76)

number_slider = Slider(10, range=0..100)
number_slider_2 = Slider(12, range=0..29)
mod = Modulus(A=number_slider, B="2")
subtraction = Subtraction(A=number_slider, B=mod)
addition = Addition(A=subtraction, B="1")
pt = ConstructPoint(XCoordinate=0, YCoordinate=0, ZCoordinate=0)
number_slider_3 = Slider(1, range=0..1)
sqgrid = Square(Plane=pt, Size=addition, ExtentX=number_slider_2, ExtentY=number_slider_2)  # -> simplify(Cells), Points
bbox = BoundingBox(Content=flatten(sqgrid.Cells), Plane=PlaneXY(0, 0, 0), UnionBox=True)  # -> Box, Box_2
debrep = DeconstructBrep(Brep=bbox.Box)  # -> Faces, Edges, Vertices
area = Area(Geometry=debrep.Faces)  # -> Area, Centroid
flip = FlipMatrix(Data=sqgrid.Cells)
expression = Expression(x=Slider(1, range=0..1), Expression="Sqrt(Pow(x,2) * 2) / 2")
scale = Scale(Geometry=debrep.Faces, Center=area.Centroid, Factor="2")  # -> Geometry, Transform
vec = VectorXYZ(XComponent=number_slider_3, YComponent=number_slider_3, ZComponent=0)  # -> Vector, Length
runion = RegionUnion(Curves=sqgrid.Cells)
runion_2 = RegionUnion(Curves=flip)
contour = Contour(Shape=scale.Geometry, Point=pt, Direction=vec.Vector, Distance=expression)  # -> simplify(Contours)
division = Division(A="1", B=addition)
crv = Curve(runion_2)
crv_2 = Curve(runion)
flatten = FlattenTree(Tree=crv_2, Path="{0}")
flatten_2 = FlattenTree(Tree=crv, Path="{0}")
flatten_3 = FlattenTree(Tree=contour, Path="{0}")
area_2 = Area(Geometry=flatten)  # -> Area, Centroid
area_3 = Area(Geometry=flatten_2)  # -> Area, Centroid
shift = ShiftList(List=flatten_3, Shift=1, Wrap=False)
partition = PartitionList(List=flatten_3, Size="2")
scale_nu = ScaleNU(Geometry=flatten, Plane=area_2.Centroid, ScaleX=division, ScaleY=1, ScaleZ=1)  # -> Geometry, Transform
partition_2 = PartitionList(List=shift, Size="2")
scale_nu_2 = ScaleNU(Geometry=flatten_2, Plane=area_3.Centroid, ScaleX=1, ScaleY=division, ScaleZ=1)  # -> Geometry, Transform
loft = Loft(Curves=partition, Options={Adjust=False, Closed=False, LoftEnds=0, LoftSimp=0, LoftType=0, Rebuild=10, Refit=0.01})
loft_2 = Loft(Curves=partition_2, Options={Adjust=False, Closed=False, LoftEnds=0, LoftSimp=0, LoftType=0, Rebuild=10, Refit=0.01})
crv_3 = Curve(loft)
crv_4 = Curve(loft_2)
flatten_4 = FlattenTree(Tree=crv_3, Path="{0}")
flatten_5 = FlattenTree(Tree=crv_4, Path="{0}")
panel = Panel("""False
True
False""")
panel_2 = Panel("""True
False
False""")
dispatch = Dispatch(List=scale_nu_2.Geometry, DispatchPattern=panel_2)  # -> ListA, ListB
dispatch_2 = Dispatch(List=flatten_2, DispatchPattern=panel_2)  # -> ListA, ListB
dispatch_3 = Dispatch(List=flatten_2, DispatchPattern=panel)  # -> ListA, ListB
dispatch_4 = Dispatch(List=flatten, DispatchPattern=panel_2)  # -> ListA, ListB
dispatch_5 = Dispatch(List=scale_nu_2.Geometry, DispatchPattern=panel)  # -> ListA, ListB
dispatch_6 = Dispatch(List=flatten, DispatchPattern=panel)  # -> ListA, ListB
dispatch_7 = Dispatch(List=scale_nu.Geometry, DispatchPattern=panel_2)  # -> ListA, ListB
dispatch_8 = Dispatch(List=scale_nu.Geometry, DispatchPattern=panel)  # -> ListA, ListB
graft = GraftTree(Tree=dispatch_4.ListA, IncludeEmptyLists=True, IncludeNullItems=True)  # -> simplify(Tree)
graft_2 = GraftTree(Tree=dispatch.ListA, IncludeEmptyLists=True, IncludeNullItems=True)  # -> simplify(Tree)
graft_3 = GraftTree(Tree=dispatch_2.ListA, IncludeEmptyLists=True, IncludeNullItems=True)  # -> simplify(Tree)
graft_4 = GraftTree(Tree=dispatch_7.ListA, IncludeEmptyLists=True, IncludeNullItems=True)  # -> simplify(Tree)
graft_5 = GraftTree(Tree=dispatch_6.ListA, IncludeEmptyLists=True, IncludeNullItems=True)  # -> simplify(Tree)
graft_6 = GraftTree(Tree=dispatch_8.ListA, IncludeEmptyLists=True, IncludeNullItems=True)  # -> simplify(Tree)
graft_7 = GraftTree(Tree=dispatch_3.ListA, IncludeEmptyLists=True, IncludeNullItems=True)  # -> simplify(Tree)
graft_8 = GraftTree(Tree=dispatch_5.ListA, IncludeEmptyLists=True, IncludeNullItems=True)  # -> simplify(Tree)
xy = XYPlane(Origin=Point(0, 0, 0))
rdiff = RegionDifference(CurvesA=graft, CurvesB=graft_4)  # -> simplify(Result)
rdiff_2 = RegionDifference(CurvesA=graft_5, CurvesB=graft_6)  # -> simplify(Result)
rdiff_3 = RegionDifference(CurvesA=graft_3, CurvesB=graft_2)  # -> simplify(Result)
rdiff_4 = RegionDifference(CurvesA=graft_7, CurvesB=graft_8)  # -> simplify(Result)
flatten_6 = FlattenTree(Tree=rdiff, Path="{0}")
flatten_7 = FlattenTree(Tree=rdiff_3, Path="{0}")
flatten_8 = FlattenTree(Tree=rdiff_2, Path="{0}")
flatten_9 = FlattenTree(Tree=rdiff_4, Path="{0}")
graft_9 = GraftTree(Tree=flatten_6, IncludeEmptyLists=True, IncludeNullItems=True)  # -> simplify(Tree)
graft_10 = GraftTree(Tree=flatten_7, IncludeEmptyLists=True, IncludeNullItems=True)  # -> simplify(Tree)
graft_11 = GraftTree(Tree=flatten_8, IncludeEmptyLists=True, IncludeNullItems=True)  # -> simplify(Tree)
graft_12 = GraftTree(Tree=flatten_9, IncludeEmptyLists=True, IncludeNullItems=True)  # -> simplify(Tree)
rint = RegionIntersection(CurvesA=flatten_5, CurvesB=graft_9, Plane=xy)  # -> simplify(Result)
rint_2 = RegionIntersection(CurvesA=flatten_5, CurvesB=graft_11, Plane=xy)  # -> simplify(Result)
rint_3 = RegionIntersection(CurvesA=flatten_4, CurvesB=graft_10, Plane=xy)  # -> simplify(Result)
rint_4 = RegionIntersection(CurvesA=flatten_4, CurvesB=graft_12, Plane=xy)  # -> simplify(Result)
boundary = BoundarySurfaces(Edges=rint)
boundary_2 = BoundarySurfaces(Edges=rint_2)
boundary_3 = BoundarySurfaces(Edges=rint_3)
boundary_4 = BoundarySurfaces(Edges=rint_4)
merge = Merge(Data1=boundary, Data2=boundary_3)
merge_2 = Merge(Data1=boundary_2, Data2=boundary_4)
smesh = SimpleMesh(Brep=merge)
smesh_2 = SimpleMesh(Brep=merge_2)
mcol = MeshColours(Mesh=smesh, Colours=ColourSwatch(SwatchColor=RGB(0, 0, 0)))
mcol_2 = MeshColours(Mesh=smesh_2, Colours=ColourSwatch(SwatchColor=RGB(219, 0, 0)))
