# Grasshopper definition Fish Swarm.ghx (Grasshopper 0.9.76)

pt = ConstructPoint(XCoordinate=0, YCoordinate=0, ZCoordinate=0)
number_slider = Slider(2000, range=0..3000)
sph = Sphere(Base=pt, Radius=Slider(100, range=0..100))  # -> reparameterize(Sphere)
popgeo = PopulateGeometry(Geometry=sph, Count=number_slider, Seed=1)
srf_cp = SurfaceClosestPoint(Point=popgeo, Surface=sph)  # -> Point, UVPoint, Distance
vec2pt = Vector2Pt(PointA=popgeo, PointB=pt, Unitize=False)  # -> Vector, Length
random = Random(Range=Slider(40, range=0..100), Number=number_slider, Seed=2)
dom = ConstructDomain(DomainStart=Slider(0, range=0..100), DomainEnd=Slider(30, range=0..30))
evalsrf = EvaluateSurface(Surface=sph, Point=srf_cp.UVPoint)  # -> Point, Normal, Frame
random_2 = Random(Range=dom, Number=number_slider, Seed=Slider(345, range=0..1000))
amp = Amplitude(Vector=vec2pt.Vector, Amplitude=random)
rad = Radians(Degrees=random_2)
move = Move(Geometry=popgeo, Motion=amp)  # -> Geometry, Transform
rotate = Rotate(Geometry=evalsrf.Frame, Angle=rad, Plane=evalsrf.Frame)  # -> Geometry, Transform
deplane = DeconstructPlane(Plane=rotate.Geometry)  # -> Origin, XAxis, YAxis, ZAxis
range = Range(Domain=Domain(0, 1), Steps=Slider(2, range=0..10))
line = LineSDL(Start=move.Geometry, Direction=deplane.XAxis, Length=Slider(31.5, range=0..50))
crv = Curve(reparameterize(line))
vdis = VectorDisplay(Anchor=move.Geometry, Vector=deplane.XAxis)
graph = GraphMapper(
    range,
    x0=0,
    x1=1,
    y0=0,
    y1=1,
    container_name="Bezier",
    cpx=[0, 0.3333333433, 0.9565217495, 1],
    cpy=[0, 0, 0.5942028761, 1])
dom_2 = ConstructDomain(DomainStart=Slider(2, range=0..10), DomainEnd=Slider(0, range=0..100))
remap = RemapNumbers(Value=graph, Source=Domain(0, 1), Target=dom_2)  # -> Mapped, Clipped
bnd = Bounds(Numbers=random)
number_slider_2 = Slider(28, range=0..100)
number_slider_3 = Slider(10, range=0..10)
remap_2 = RemapNumbers(Value=random, Source=bnd, Target=Domain(0, 1))  # -> Mapped, Clipped
vpipe = PipeVariable(Curve=crv, Parameters=range, Radii=remap.Mapped, Caps=0)
gradient = Gradient(LowerLimit=0, UpperLimit=1, Parameter=remap_2.Mapped, stops=[0: RGB(135, 205, 255), 1: RGB(29, 46, 122)])
custom_mesh_settings = SettingsCustom(
    StitchSeams=True,
    SimplePlanes=False,
    Refine=True,
    MinCount=number_slider_2,
    MaxCount=number_slider_2,
    AspectRatio=20,
    MaxDistance=0,
    MaxAngle=20,
    MinEdge=number_slider_3,
    MaxEdge=number_slider_3)
mesh = MeshBrep(Brep=vpipe, Settings=custom_mesh_settings)  # -> simplify(flatten(Mesh))
preview = CustomPreview(Geometry=mesh, Shader=gradient)
