# Grasshopper definition Gradient Islamic.ghx (Grasshopper 0.9.76)

hexgrid = Hexagonal(Plane=PlaneXY(0, 0, 0), Size=Slider(10, range=0..10), ExtentX=Slider(20, range=0..100), ExtentY=Slider(15, range=0..100))  # -> simplify(Cells), Points
flatten = FlattenTree(Tree=hexgrid.Cells, Path="{0}")
flatten_2 = FlattenTree(Tree=hexgrid.Points, Path="{0}")
explode = Explode(Curve=flatten, Recursive=True)  # -> simplify(Segments), reverse(Vertices)
rotate = Rotate(Geometry=flatten, Angle=1.570796327, Plane=flatten_2)  # -> Geometry, Transform
cull_i = CullIndex(List=explode.Vertices, Indices=0, Wrap=True)  # -> reverse(simplify(List))
scale = Scale(Geometry=rotate.Geometry, Center=flatten_2, Factor=Slider(0.42, range=0..1))  # -> Geometry, Transform
lng = ListLength(List=cull_i)
explode_2 = Explode(Curve=scale.Geometry, Recursive=True)  # -> Segments, Vertices
series = Series(Start=0, Step="60", Count=lng)
midpoint = MidPoint(crv=explode_2.Segments)
xy = XYPlane(Origin=cull_i)
rad = Radians(Degrees=series)
rotate_2 = Rotate(Geometry=xy, Angle=rad, Plane=xy)  # -> Geometry, Transform
hexgrid_2 = Hexagonal(Plane=rotate_2.Geometry, Size=Slider(1.3, range=0..10), ExtentX="1", ExtentY="1")  # -> simplify(Cells), Points
shift = ShiftList(List=midpoint, Shift="5", Wrap=True)
cp = ControlPoints(Curve=hexgrid_2.Cells)  # -> reverse(simplify(Points)), Weights, Knots
shift_2 = ShiftList(List=midpoint, Shift="3", Wrap=True)
cull_i_2 = CullIndex(List=cp.Points, Indices=0, Wrap=True)  # -> reverse(simplify(List))
item = ListItem(List=cull_i_2, Index=Slider(1, range=0..1), Wrap=True)
item_2 = ListItem(List=cull_i_2, Index=Slider(5, range=0..10), Wrap=True)
pshift = ShiftPaths(Data=item, Offset=-1)
pshift_2 = ShiftPaths(Data=item_2, Offset=-1)
ln = Line(StartPoint=pshift, EndPoint=shift)  # -> simplify(Line)
ln_2 = Line(StartPoint=pshift_2, EndPoint=shift_2)  # -> simplify(Line)
shift_3 = ShiftList(List=ln_2, Shift="4", Wrap=True)
llx = LineLine(Line1=ln, Line2=shift_3)  # -> ParamA, ParamB, PointA, PointB
end = EndPoints(Curve=shift_3)  # -> Start, End
end_2 = EndPoints(Curve=ln)  # -> Start, End
ln_3 = Line(StartPoint=end_2.Start, EndPoint=llx.PointA)
ln_4 = Line(StartPoint=end.Start, EndPoint=llx.PointB)
flip = FlipCurve(Curve=ln_4)  # -> Curve, Flag
merge = Merge(Data1=ln_3, Data2=flip.Curve)  # -> simplify(Result)
midpoint_2 = MidPoint(crv=merge)
pt = Point(flatten_2)
crv_cp = CurveClosestPoint(Point=midpoint_2, Curve=reparameterize(merge))  # -> Point, Parameter, Distance
pdecon = Deconstruct(Point=pt)  # -> XComponent, YComponent, ZComponent
eval = EvaluateCurve(Curve=reparameterize(merge), Parameter=crv_cp.Parameter)  # -> Point, Tangent, Angle
pi = Pi(Factor="0.5")
Z = UnitZ(Factor=1)
bnd = Bounds(Numbers=pdecon.XComponent)
dom = ConstructDomain(DomainStart=Slider(-2.51, range=-5..5), DomainEnd=Slider(4.33, range=-5..5))
vrot = Rotate(Vector=eval.Tangent, Axis=Z, Angle=pi)
remap = RemapNumbers(Value=pdecon.XComponent, Source=bnd, Target=dom)  # -> Mapped, Clipped
graft = GraftTree(Tree=remap.Mapped, IncludeEmptyLists=True, IncludeNullItems=True)  # -> simplify(Tree)
amp = Amplitude(Vector=vrot, Amplitude=graft)
move = Move(Geometry=midpoint_2, Motion=amp)  # -> Geometry, Transform
end_3 = EndPoints(Curve=merge)  # -> Start, End
arc = Arc3Pt(PointA=end_3.Start, PointB=move.Geometry, PointC=end_3.End)  # -> Arc, Plane, Radius
join = JoinCurves(Curves=flatten(arc.Arc), Preserve=False)
centerpoint = CenterPoint(B=join)
pdecon_2 = Deconstruct(Point=centerpoint)  # -> XComponent, YComponent, ZComponent
scale_2 = Scale(Geometry=join, Center=centerpoint, Factor=Slider(0.95, range=0..1))  # -> Geometry, Transform
bnd_2 = Bounds(Numbers=pdecon_2.XComponent)
graft_2 = GraftTree(Tree=join, IncludeEmptyLists=True, IncludeNullItems=True)  # -> simplify(Tree)
graft_3 = GraftTree(Tree=scale_2.Geometry, IncludeEmptyLists=True, IncludeNullItems=True)  # -> simplify(Tree)
remap_2 = RemapNumbers(Value=pdecon_2.XComponent, Source=bnd_2, Target=Domain(0, 1))  # -> Mapped, Clipped
merge_2 = Merge(Data1=graft_2, Data2=graft_3)
gradient = Gradient(LowerLimit=0, UpperLimit=1, Parameter=remap_2.Mapped, stops=[0: RGB(220, 0, 40), 1: RGB(130, 178, 255)])
loft = Loft(Curves=merge_2, Options={Adjust=False, Closed=False, LoftEnds=0, LoftSimp=0, LoftType=0, Rebuild=10, Refit=0.01})
Z_2 = UnitZ(Factor=Slider(3, range=0..10))
extr = Extrude(Base=loft, Direction=Z_2)  # -> flatten(Extrusion)
preview = CustomPreview(Geometry=extr, Shader=gradient)

# ==== cluster MidPoint: Middle Point of Curve
crv = ClusterInput()
num = Number(0.5)
eval = EvaluateLength(Curve=crv, Length=num, Normalized=True)  # -> Point, Tangent, Parameter
pt = ClusterOutput(eval.Point)

# ==== cluster CenterPoint
B = ClusterInput()
box_corners = BoxCorners(Box=B)  # -> CornerA, CornerB, CornerC, CornerD, CornerE, CornerF, CornerG, CornerH
ln = Line(PointA=box_corners.CornerA, PointB=box_corners.CornerG)
eval = EvaluateCurve(Curve=ln, Parameter=0.5)  # -> Point, Tangent, Angle
P = ClusterOutput(eval.Point)
