# Grasshopper definition Ribbon Loop.ghx (Grasshopper 0.9.76)

number_slider = Slider(58, range=0..100)
addition = Addition(A=number_slider, B=Slider(87, range=0..100))
number_slider_2 = Slider(77, range=0..100)
cir = Circle(Plane=PlaneXY(0, 0, 0), Radius=number_slider)
cir_2 = Circle(Plane=PlaneXY(0, 0, 0), Radius=addition)
divide = DivideCurve(Curve=cir, Count=number_slider_2, Kinks=False)  # -> Points, Tangents, Parameters
divide_2 = DivideCurve(Curve=cir_2, Count=number_slider_2, Kinks=False)  # -> Points, Tangents, Parameters
ln = Line(StartPoint=divide.Points, EndPoint=divide_2.Points)
multiplication = Multiplication(A="2", B=Slider(4, range=1..10))
eval = EvaluateLength(Curve=ln, Length=Slider(0.5, range=0..1), Normalized=True)  # -> Point, Tangent, Parameter
Z = UnitZ(Factor=1)
pi = Pi(Factor=multiplication)
pl = ConstructPlane(Origin=eval.Point, XAxis=eval.Tangent, YAxis=Z)
lng = ListLength(List=divide.Points)
range = Range(Domain=pi, Steps=lng)
cull_i = CullIndex(List=range, Indices=0, Wrap=True)
rotate = Rotate(Geometry=ln, Angle=cull_i, Plane=pl)  # -> Geometry, Transform
sin = Sine(Value=cull_i)
bnd = Bounds(Numbers=sin)
dom = ConstructDomain(DomainStart=Slider(0.333, range=0.1..2), DomainEnd=Slider(3, range=1..3))
remap = RemapNumbers(Value=sin, Source=bnd, Target=dom)  # -> Mapped, Clipped
scale = Scale(Geometry=rotate.Geometry, Center=pl, Factor=remap.Mapped)  # -> Geometry, Transform
loft = Loft(Curves=scale.Geometry, Options={Adjust=False, Closed=True, LoftEnds=0, LoftSimp=0, LoftType=0, Rebuild=10, Refit=0.01})
preview = CustomPreview(
    Geometry=loft,
    Shader={ambient=RGB(0, 0, 0), diffuse=RGB(255, 105, 180), emission=RGB(76, 32, 54), shine=0.5, specular=RGB(255, 255, 255), transparency=0})
