# Grasshopper definition Snake Tower.ghx (Grasshopper 0.9.76)
# plug-ins: MeshEdit Components, Weaverbird

number_slider = Slider(36, range=0..100)
cir = Circle(Plane=PlaneXY(0, 0, 0), Radius=number_slider)
multiplication = Multiplication(A=number_slider, B=Slider(0.57, range=0..1))
pt = ConstructPoint(XCoordinate=0, YCoordinate=0, ZCoordinate=0)
X = UnitX(Factor=multiplication)
move = Move(Geometry=cir, Motion=X)  # -> Geometry, Transform
yz = YZPlane(Origin=pt)
crv = Curve(reparameterize(move.Geometry))
pcx = CurvePlane(Curve=crv, Plane=yz)  # -> Points, ParamsC, ParamsP
shatter = Shatter(Curve=crv, Parameters=pcx.ParamsC)
item = ListItem(List=shatter, Index=0, Wrap=True)
number_slider_2 = Slider(30, range=0..100)
mirror = Mirror(Geometry=item, Plane=PlaneYZ(0, 0, 0))  # -> Geometry, Transform
merge = Merge(Data1=item, Data2=mirror.Geometry)  # -> simplify(graft(Result))
pi = Pi(Factor=Slider(2.89, range=0..10))
range = Range(Domain=pi, Steps=number_slider_2)
range_2 = Range(Domain=Slider(310, range=0..1000), Steps=number_slider_2)
Z = UnitZ(Factor=range_2)
move_2 = Move(Geometry=merge, Motion=Z)  # -> Geometry, Transform
rotate = Rotate(Geometry=move_2.Geometry, Angle=range, Plane=pt)  # -> simplify(Geometry), Transform
loft = Loft(Curves=rotate.Geometry, Options={Adjust=False, Closed=False, LoftEnds=0, LoftSimp=0, LoftType=0, Rebuild=10, Refit=0.01})
sdivide = DivideSurface(Surface=loft, UCount=Slider(45, range=0..100), VCount=Slider(19, range=0..100))  # -> simplify(Points), Normals, Parameters
path_mapper = PathMapper(sdivide.Points, source="{A;B}(i)", target="{A;i}(B)")
pline = PolyLine(Vertices=path_mapper, Closed=False)
pshift = ShiftPaths(Data=pline, Offset=-1)
loft_2 = Loft(Curves=pshift, Options={Adjust=False, Closed=False, LoftEnds=0, LoftSimp=0, LoftType=3, Rebuild=10, Refit=0.01})
number_slider_3 = Slider(3.82, range=0..10)
join = BrepJoin(Breps=flatten(loft_2))  # -> Breps, Closed
smesh = SimpleMesh(Brep=join.Breps)
wbframe = WeaverbirdsPictureFrame(MeshPolylines=smesh, Distance=number_slider_3, InsetType=0)
wbwindow = WeaverbirdsMeshWindow(MeshPolylines=smesh, Distance=number_slider_3, InsetType=0)
explode = MeshExplode(Mesh=wbwindow, Interpolate=False)
wbthicken = WeaverbirdsMeshThicken(MeshCurves=wbframe, Distance=Slider(2, range=0..10), OffsetType=0)
area = Area(Geometry=explode)  # -> Area, Centroid
preview = CustomPreview(Geometry=wbthicken, Shader=ColourSwatch(SwatchColor=RGB(123, 255, 8)))
pdecon = Deconstruct(Point=area.Centroid)  # -> XComponent, YComponent, ZComponent
bnd = Bounds(Numbers=pdecon.ZComponent)
remap = RemapNumbers(Value=pdecon.ZComponent, Source=bnd, Target=Domain(0, 1))  # -> Mapped, Clipped
gradient = Gradient(LowerLimit=0, UpperLimit=1, Parameter=remap.Mapped, stops=[0: RGB(237, 248, 255), 1: RGB(66, 224, 255)])
preview_2 = CustomPreview(Geometry=explode, Shader=gradient)
