# Grasshopper definition Torii Gates.ghx (Grasshopper 0.9.76)

division = Division(A=Slider(500, range=0..1000), B=2)
neg = Negative(Value=division)
dom = ConstructDomain(DomainStart=neg, DomainEnd=division)
rectangle = Rectangle(Plane=PlaneXY(0, 0, 0), XSize=dom, YSize=dom, Radius=0)  # -> Rectangle, Length
Z = UnitZ(Factor=Slider(634, range=0..1000))
move = Move(Geometry=rectangle.Rectangle, Motion=Z)  # -> Geometry, Transform
area = Area(Geometry=move.Geometry)  # -> Area, Centroid
scale = Scale(Geometry=move.Geometry, Center=area.Centroid, Factor=Slider(0.9, range=0..1))  # -> Geometry, Transform
explode = Explode(Curve=scale.Geometry, Recursive=True)  # -> Segments, Vertices
merge = Merge(Data1=rectangle.Rectangle, Data2=scale.Geometry)
eval = EvaluateLength(Curve=explode.Segments, Length="0.5", Normalized=True)  # -> Point, Tangent, Parameter
loft = Loft(Curves=merge, Options={Adjust=False, Closed=False, LoftEnds=0, LoftSimp=0, LoftType=0, Rebuild=10, Refit=0.01})
fcircle = CircleFit(Points=eval.Point)  # -> Circle, Radius, Deviation
offset = Offset(Curve=fcircle.Circle, Distance=Slider(26, range=0..100), Plane=PlaneXY(0, 0, 0), Corners=1)
Z_2 = UnitZ(Factor=Slider(4000, range=0..10000))
move_2 = Move(Geometry=offset, Motion=Z_2)  # -> Geometry, Transform
extr = Extrude(Base=offset, Direction=Z_2)
neg_2 = Negative(Value=Slider(100, range=0..100))
cap = CapHoles(Brep=extr)
offset_2 = Offset(Curve=move_2.Geometry, Distance=neg_2, Plane=PlaneXY(0, 0, 0), Corners=1)
boundary = BoundarySurfaces(Edges=offset_2)
Z_3 = UnitZ(Factor=Slider(150, range=0..300))
extr_2 = Extrude(Base=boundary, Direction=Z_3)
merge_2 = Merge(Data1=cap, Data2=extr_2)  # -> flatten(Result)
cap_2 = CapHoles(Brep=loft)
group = Group(Objects=cap_2)
group_2 = Group(Objects=merge_2)
merge_3 = Merge(Data1=group, Data2=group_2)
ungroup = Ungroup(Group=merge_3)  # -> simplify(Objects)
X = UnitX(Factor=Slider(2030, range=0..10000))
move_3 = Move(Geometry=ungroup, Motion=X)  # -> Geometry, Transform
mirror = Mirror(Geometry=move_3.Geometry, Plane=PlaneYZ(0, 0, 0))  # -> Geometry, Transform
merge_4 = Merge(Data1=move_3.Geometry, Data2=mirror.Geometry)
bbox = BoundingBox(Content=flatten(merge_4), Plane=PlaneXY(0, 0, 0), UnionBox=True)  # -> Box, Box_2
debrep = DeconstructBrep(Brep=bbox.Box)  # -> Faces, Edges, Vertices
area_2 = Area(Geometry=debrep.Faces)  # -> Area, Centroid
number_slider = Slider(312, range=0..1000)
number_slider_2 = Slider(624, range=0..1000)
pdecon = Deconstruct(Point=area_2.Centroid)  # -> XComponent, YComponent, ZComponent
sort = SortList(Keys=pdecon.ZComponent, ValuesA=debrep.Faces)  # -> Keys, reverse(ValuesA)
item = ListItem(List=sort.ValuesA, Index=0, Wrap=True)
number_slider_3 = Slider(150, range=0..150)
dim = Dimensions(Surface=item)  # -> UDimension, VDimension
area_3 = Area(Geometry=item)  # -> Area, Centroid
neg_3 = Negative(Value=number_slider_2)
neg_4 = Negative(Value=Slider(100, range=0..1000))
addition = Addition(A=dim.UDimension, B=Slider(1600, range=0..2000))
addition_2 = Addition(A=dim.VDimension, B=neg_4)
Z_4 = UnitZ(Factor=neg_3)
addition_3 = Addition(A=addition, B=number_slider_3)
addition_4 = Addition(A=addition_2, B=number_slider_3)
Z_5 = UnitZ(Factor=number_slider)
move_4 = Move(Geometry=item, Motion=Z_4)  # -> Geometry, Transform
division_2 = Division(A=addition, B=dim.UDimension)
division_3 = Division(A=addition_2, B=dim.VDimension)
division_4 = Division(A=addition_3, B=dim.UDimension)
division_5 = Division(A=addition_4, B=dim.VDimension)
move_5 = Move(Geometry=item, Motion=Z_5)  # -> Geometry, Transform
scale_nu = ScaleNU(Geometry=item, Plane=area_3.Centroid, ScaleX=division_2, ScaleY=division_3, ScaleZ=1)  # -> Geometry, Transform
scale_nu_2 = ScaleNU(Geometry=move_5.Geometry, Plane=area_3.Centroid, ScaleX=division_4, ScaleY=division_5, ScaleZ=1)  # -> Geometry, Transform
scale_nu_3 = ScaleNU(Geometry=move_4.Geometry, Plane=area_3.Centroid, ScaleX=division_2, ScaleY=Slider(0.3, range=0..1), ScaleZ=1)  # -> Geometry, Transform
pt = Point(area_3.Centroid)
number_slider_4 = Slider(200, range=0..1000)
line = LineSDL(Start=pt, Direction=Z_4, Length=number_slider_2)
X_2 = UnitX(Factor=Slider(500, range=0..1000))
merge_5 = Merge(Data1=scale_nu.Geometry, Data2=scale_nu_2.Geometry)
dim_2 = Dimensions(Surface=scale_nu_2.Geometry)  # -> UDimension, VDimension
neg_5 = Negative(Value=number_slider)
area_4 = Area(Geometry=scale_nu_2.Geometry)  # -> Area, Centroid
division_6 = Division(A=X_2, B="-2")
loft_2 = Loft(Curves=merge_5, Options={Adjust=False, Closed=False, LoftEnds=0, LoftSimp=0, LoftType=0, Rebuild=10, Refit=0.01})
addition_5 = Addition(A=dim_2.UDimension, B=Slider(500, range=0..1000))
extr_3 = Extrude(Base=line, Direction=X_2)
Z_6 = UnitZ(Factor=neg_5)
addition_6 = Addition(A=dim_2.VDimension, B=number_slider_4)
merge_6 = Merge(Data1=merge_5, Data2=loft_2)
move_6 = Move(Geometry=extr_3, Motion=division_6)  # -> Geometry, Transform
Y = UnitY(Factor=Slider(10, range=0..10))
division_7 = Division(A=addition_5, B=dim_2.UDimension)
extr_4 = Extrude(Base=scale_nu_3.Geometry, Direction=Z_6)
division_8 = Division(A=addition_6, B=dim_2.VDimension)
join = BrepJoin(Breps=merge_6)  # -> Breps, Closed
number_slider_5 = Slider(50000, range=0..100000)
extr_5 = Extrude(Base=move_6.Geometry, Direction=Y)
division_9 = Division(A=Y, B="-2")
scale_nu_4 = ScaleNU(Geometry=scale_nu_2.Geometry, Plane=area_4.Centroid, ScaleX=division_7, ScaleY=division_8, ScaleZ=1)  # -> Geometry, Transform
number_slider_6 = Slider(20, range=0..100)
move_7 = Move(Geometry=extr_5, Motion=division_9)  # -> flatten(Geometry), Transform
crv = Curve(scale_nu_4.Geometry)
planesrf = PlaneSurface(Plane=PlaneXY(0, 0, 0), XSize=number_slider_5, YSize=number_slider_5)
explode_2 = Explode(Curve=crv, Recursive=True)  # -> Segments, Vertices
dispatch = Dispatch(List=explode_2.Segments, DispatchPattern=[True, False])  # -> ListA, ListB
sdivide = DivideSurface(Surface=planesrf, UCount=number_slider_6, VCount=number_slider_6)  # -> Points, Normals, Parameters
pop2d = Populate2D(Region=planesrf, Count=Slider(5, range=0..10), Seed=1)
graft = GraftTree(Tree=pop2d, IncludeEmptyLists=True, IncludeNullItems=True)  # -> simplify(Tree)
crv_2 = Curve(dispatch.ListA)
flatten = FlattenTree(Tree=sdivide.Points, Path="{0}")
eval_2 = EvaluateLength(Curve=crv_2, Length="0.5", Normalized=True)  # -> Point, Tangent, Parameter
dist = Distance(PointA=graft, PointB=flatten)
eval_3 = EvaluateCurve(Curve=crv_2, Parameter=eval_2.Parameter)  # -> Point, Tangent, Angle
Z_7 = UnitZ(Factor=1)
number_slider_7 = Slider(4523, range=0..10000)
min = Minimum(A=dist, B=Slider(20666, range=0..100000))
division_10 = Division(A=number_slider_4, B=2)
vrot = Rotate(Vector=eval_3.Tangent, Axis=Z_7, Angle="Rad(90)")
flip = FlipMatrix(Data=min)
amp = Amplitude(Vector=vrot, Amplitude=division_10)
neg_6 = Negative(Value=number_slider_7)
end = EndPoints(Curve=graft(crv_2))  # -> Start, End
ma = MassAddition(Input=flip)  # -> Result, PartialResults
move_8 = Move(Geometry=eval_2.Point, Motion=amp)  # -> graft(Geometry), Transform
bnd = Bounds(Numbers=flatten(ma.Result))
dom_2 = ConstructDomain(DomainStart=neg_6, DomainEnd=number_slider_7)
merge_7 = Merge(Data1=end.Start, Data2=move_8.Geometry, Data3=end.End)
remap = RemapNumbers(Value=ma.Result, Source=bnd, Target=dom_2)  # -> Mapped, Clipped
Z_8 = UnitZ(Factor=remap.Mapped)  # -> flatten(UnitVector)
nurbs = NurbsCurve(Vertices=merge_7, Degree=2, Periodic=False)  # -> flatten(Curve), Length, Domain
number_slider_8 = Slider(444, range=0..1000)
move_9 = Move(Geometry=flatten, Motion=Z_8)  # -> Geometry, Transform
addition_7 = Addition(A=number_slider_6, B=1)
weave = Weave(Pattern=[0, 1], Stream0=nurbs.Curve, Stream1=dispatch.ListB, NullGaps=False)
srfgrid = SurfaceFromPoints(Points=move_9.Geometry, UCount=addition_7, Interpolate=False)
join_2 = JoinCurves(Curves=weave, Preserve=False)
crv_3 = Curve(srfgrid)
Z_9 = UnitZ(Factor=number_slider_8)
area_5 = Area(Geometry=srfgrid)  # -> Area, Centroid
boundary_2 = BoundarySurfaces(Edges=join_2)
dim_3 = Dimensions(Surface=boundary_2)  # -> UDimension, VDimension
popgeo = PopulateGeometry(Geometry=crv_3, Count="1", Seed=Slider(410, range=0..1000))
addition_8 = Addition(A=dim_3.UDimension, B=Slider(500, range=0..1000))
addition_9 = Addition(A=dim_3.VDimension, B=Slider(193, range=0..1000))
move_10 = Move(Geometry=boundary_2, Motion=Z_9)  # -> Geometry, Transform
Z_10 = UnitZ(Factor=1)
ln = Line(StartPoint=popgeo, EndPoint=area_5.Centroid)
division_11 = Division(A=addition_8, B=dim_3.UDimension)
division_12 = Division(A=addition_9, B=dim_3.VDimension)
area_6 = Area(Geometry=move_10.Geometry)  # -> Area, Centroid
scale_nu_5 = ScaleNU(Geometry=move_10.Geometry, Plane=area_6.Centroid, ScaleX=division_11, ScaleY=division_12, ScaleZ=1)  # -> Geometry, Transform
pl = ConstructPlane(Origin=popgeo, XAxis=ln, YAxis=Z_10)
crv_4 = Curve(scale_nu_5.Geometry)
sec = BrepPlane(Brep=srfgrid, Plane=pl)  # -> Curves, Points
explode_3 = Explode(Curve=crv_4, Recursive=True)  # -> Segments, Vertices
dispatch_2 = Dispatch(List=explode_3.Segments, DispatchPattern=[True, False])  # -> ListA, ListB
crv_5 = Curve(sec.Curves)
division_13 = Division(A=number_slider_8, B=-2)
crv_6 = Curve(dispatch_2.ListA)
eval_4 = EvaluateLength(Curve=crv_6, Length="0.5", Normalized=True)  # -> Point, Tangent, Parameter
end_2 = EndPoints(Curve=graft(crv_6))  # -> Start, End
Z_11 = UnitZ(Factor=division_13)
neg_7 = Negative(Value=Slider(9000, range=0..10000))
move_11 = Move(Geometry=eval_4.Point, Motion=Z_11)  # -> graft(Geometry), Transform
ext = ExtendCurve(Curve=crv_5, Type=0, Start=neg_7, End=neg_7)
merge_8 = Merge(Data1=end_2.Start, Data2=move_11.Geometry, Data3=end_2.End)  # -> simplify(Result)
divide = DivideCurve(Curve=ext, Count=Slider(20, range=0..100), Kinks=False)  # -> Points, Tangents, Parameters
nurbs_2 = NurbsCurve(Vertices=merge_8, Degree=2, Periodic=False)  # -> flatten(Curve), Length, Domain
devec = DeconstructVector(Vector=divide.Tangents)  # -> XComponent, YComponent, ZComponent
weave_2 = Weave(Pattern=[0, 1], Stream0=nurbs_2.Curve, Stream1=dispatch_2.ListB, NullGaps=False)
Z_12 = UnitZ(Factor=1)
vec = VectorXYZ(XComponent=devec.XComponent, YComponent=devec.YComponent, ZComponent=0)  # -> Vector, Length
crv_7 = Curve(dispatch_2.ListB)
crv_8 = Curve(nurbs_2.Curve)
join_3 = JoinCurves(Curves=weave_2, Preserve=False)
vrot_2 = Rotate(Vector=vec.Vector, Axis=Z_12, Angle="Rad(-90)")
crv_9 = Curve(boundary_2)
netsurf = NetworkSurface(CurvesU=crv_8, CurvesV=crv_7, Continuity=2)
merge_9 = Merge(Data1=crv_9, Data2=join_3)  # -> flatten(Result)
pl_2 = ConstructPlane(Origin=divide.Points, XAxis=vrot_2, YAxis=vec.Vector)
loft_3 = Loft(Curves=merge_9, Options={Adjust=False, Closed=False, LoftEnds=0, LoftSimp=0, LoftType=0, Rebuild=10, Refit=0.01})
merge_10 = Merge(Data1=netsurf, Data2=loft_3, Data3=boundary_2)  # -> flatten(Result)
merge_11 = Merge(Data1=extr_4, Data2=join.Breps, Data3=move_7.Geometry)  # -> flatten(Result)
join_4 = BrepJoin(Breps=merge_10)  # -> Breps, Closed
path = ConstructPath(Indices="0")
path_2 = ConstructPath(Indices="1")
path_3 = ConstructPath(Indices="2")
replace = ReplacePaths(Data=merge_11, Search=path, Replace=path_2)
geo = Geometry(merge_4)
replace_2 = ReplacePaths(Data=join_4.Breps, Search=path, Replace=path_3)
xy = XYPlane(Origin=Point(0, 0, 0))
merge_12 = Merge(Data1=geo, Data2=replace, Data3=replace_2)
mesh = Mesh(merge_12)
preview = CustomPreview(Geometry=srfgrid, Shader=ColourSwatch(SwatchColor=RGB(173, 173, 173)))
group_3 = Group(Objects=mesh)  # -> flatten(Group)
merge_13 = Merge(
    Data1=ColourSwatch(SwatchColor=RGB(69, 3, 3)),
    Data2=ColourSwatch(SwatchColor=RGB(255, 0, 0)),
    Data3=ColourSwatch(SwatchColor=RGB(97, 97, 97)))
group_4 = Group(Objects=group_3)
orient = Orient(Geometry=group_4, Source=xy, Target=pl_2)  # -> Geometry, Transform
ungroup_2 = Ungroup(Group=orient.Geometry)  # -> simplify(Objects)
preview_2 = CustomPreview(Geometry=ungroup_2, Shader=merge_13)
