# Grasshopper definition Whipped Wire.ghx (Grasshopper 0.9.76)

number_slider = Slider(100, range=0..100)
pt = ConstructPoint(XCoordinate=0, YCoordinate=0, ZCoordinate=0)
X = UnitX(Factor=1)
Z = UnitZ(Factor=1)
line = LineSDL(Start=pt, Direction=X, Length=Slider(100, range=0..100))
line_2 = LineSDL(Start=pt, Direction=Z, Length=Slider(356, range=0..1000))
rad = Radians(Degrees=Slider(10, range=0..10))
rad_2 = Radians(Degrees=Slider(8.239, range=0..10))
divide = DivideCurve(Curve=line, Count=number_slider, Kinks=False)  # -> Points, Tangents, Parameters
lng = ListLength(List=divide.Points)
divide_2 = DivideCurve(Curve=line_2, Count=number_slider, Kinks=False)  # -> Points, Tangents, Parameters
series = Series(Start=0, Step=rad, Count=lng)
series_2 = Series(Start=0, Step=rad_2, Count=lng)
rotate = Rotate(Geometry=divide.Points, Angle=series, Plane=pt)  # -> Geometry, Transform
rotate_2 = Rotate(Geometry=divide_2.Points, Angle=series_2, Plane=rotate.Geometry)  # -> Geometry, Transform
pi = Pi(Factor="2")
intcrv = Interpolate(Vertices=rotate_2.Geometry, Degree=3, Periodic=False, KnotStyle=1)  # -> Curve, Length, Domain
range = Range(Domain=pi, Steps=Slider(7, range=0..10))  # -> reverse(Range)
cull_i = CullIndex(List=range, Indices=0, Wrap=True)  # -> reverse(List)
rotate_3 = Rotate(Geometry=intcrv.Curve, Angle=cull_i, Plane=PlaneXY(0, 0, 0))  # -> Geometry, Transform
crv = Curve(reparameterize(rotate_3.Geometry))
divide_3 = DivideCurve(Curve=crv, Count=10, Kinks=False)  # -> Points, Tangents, simplify(Parameters)
graft = GraftTree(Tree=crv, IncludeEmptyLists=True, IncludeNullItems=True)
lng_2 = ListLength(List=divide_3.Parameters)
series_3 = Series(Start=0, Step=Slider(1.2, range=0..10), Count=lng_2)
vpipe = PipeVariable(Curve=graft, Parameters=divide_3.Parameters, Radii=series_3, Caps=2)  # -> flatten(Pipe)
lng_3 = ListLength(List=vpipe)  # -> expr("x-1", Length)
range_2 = Range(Domain=Domain(0, 1), Steps=lng_3)
gradient = Gradient(LowerLimit=0, UpperLimit=1, Parameter=range_2, stops=[0: RGB(255, 87, 126), 1: RGB(173, 0, 66)])
preview = CustomPreview(Geometry=vpipe, Shader=gradient)
