# Grasshopper definition Voronoi Pipe.ghx (Grasshopper 0.9.76)
# plug-ins: Weaverbird

number_slider = Slider(100, range=0..100)
rectangle = Rectangle(Plane=PlaneXY(0, 0, 0), XSize=number_slider, YSize=number_slider, Radius=0)  # -> Rectangle, Length
pop2d = Populate2D(Region=rectangle.Rectangle, Count=Slider(100, range=0..100), Seed=1)
voronoi = Voronoi(Points=pop2d, Boundary=rectangle.Rectangle, BruteForceOverride=False)
area = Area(Geometry=voronoi)  # -> Area, Centroid
Z = UnitZ(Factor=Slider(4.7, range=0..10))
scale = Scale(Geometry=voronoi, Center=area.Centroid, Factor=Slider(0.84, range=0..1))  # -> Geometry, Transform
Z_2 = UnitZ(Factor=Slider(4.6, range=0..10))
scale_2 = Scale(Geometry=voronoi, Center=area.Centroid, Factor=Slider(0.52, range=0..1))  # -> Geometry, Transform
scale_3 = Scale(Geometry=voronoi, Center=area.Centroid, Factor=Slider(1, range=0..1))  # -> Geometry, Transform
Z_3 = UnitZ(Factor=Slider(2.8, range=0..10))
Z_4 = UnitZ(Factor=Slider(0, range=0..10))
move = Move(Geometry=voronoi, Motion=Z)  # -> Geometry, Transform
move_2 = Move(Geometry=scale.Geometry, Motion=Z_2)  # -> Geometry, Transform
move_3 = Move(Geometry=scale_2.Geometry, Motion=Z_3)  # -> Geometry, Transform
move_4 = Move(Geometry=scale_3.Geometry, Motion=Z_4)  # -> Geometry, Transform
graft = GraftTree(Tree=move.Geometry, IncludeEmptyLists=True, IncludeNullItems=True)  # -> simplify(Tree)
graft_2 = GraftTree(Tree=move_2.Geometry, IncludeEmptyLists=True, IncludeNullItems=True)  # -> simplify(Tree)
graft_3 = GraftTree(Tree=move_3.Geometry, IncludeEmptyLists=True, IncludeNullItems=True)  # -> simplify(Tree)
graft_4 = GraftTree(Tree=move_4.Geometry, IncludeEmptyLists=True, IncludeNullItems=True)  # -> simplify(Tree)
merge = Merge(Data1=graft, Data2=graft_2)
merge_2 = Merge(Data1=graft_2, Data2=graft_3)
merge_3 = Merge(Data1=graft_3, Data2=graft_4)
loft = Loft(Curves=merge, Options={Adjust=False, Closed=False, LoftEnds=0, LoftSimp=0, LoftType=0, Rebuild=10, Refit=0.01})  # -> simplify(Loft)
loft_2 = Loft(Curves=merge_2, Options={Adjust=False, Closed=False, LoftEnds=0, LoftSimp=0, LoftType=0, Rebuild=10, Refit=0.01})  # -> simplify(Loft)
loft_3 = Loft(Curves=merge_3, Options={Adjust=False, Closed=False, LoftEnds=0, LoftSimp=0, LoftType=0, Rebuild=10, Refit=0.01})  # -> simplify(Loft)
join = BrepJoin(Breps=flatten(loft))  # -> Breps, Closed
smesh = SimpleMesh(Brep=loft_3)
smesh_2 = SimpleMesh(Brep=join.Breps)
smesh_3 = SimpleMesh(Brep=loft_2)
merge_4 = Merge(Data1=smesh_2, Data2=smesh_3, Data3=smesh)  # -> flatten(Result)
mjoin = MeshJoin(Meshes=merge_4)
neg = Negative(Value=Slider(1, range=0..1))
wbcatmullclark = WeaverbirdsCatmullClarkSubdivision(MeshCurves=mjoin, Level=Slider(3, range=0..10), SmoothNakedEdges=1)
vec = VectorXYZ(XComponent=Slider(0.73, range=0..1), YComponent=Slider(0.46, range=0..1), ZComponent=neg)  # -> Vector, Length
demesh = DeconstructMesh(Mesh=wbcatmullclark)  # -> Vertices, Faces, Colours, Normals
graft_5 = GraftTree(Tree=area.Centroid, IncludeEmptyLists=True, IncludeNullItems=True)
preview = CustomPreview(
    Geometry=wbcatmullclark,
    Shader={ambient=RGB(0, 0, 0), diffuse=RGB(255, 105, 180), emission=RGB(76, 32, 54), shine=0.5, specular=RGB(255, 255, 255), transparency=0})
pull = PullPoint(Point=demesh.Vertices, Geometry=flatten(graft_5), ClosestOnly=True)  # -> ClosestPoint, Distance
bnd = Bounds(Numbers=pull.Distance)
remap = RemapNumbers(Value=pull.Distance, Source=bnd, Target=Domain(0, 1))  # -> Mapped, Clipped
gradient = Gradient(LowerLimit=0, UpperLimit=1, Parameter=remap.Clipped, stops=[0: RGB(51, 88, 255), 1: RGB(161, 255, 247)])
mcol = MeshColours(Mesh=wbcatmullclark, Colours=gradient)
