# Grasshopper definition Landscape Contour.ghx (Grasshopper 0.9.76)
# plug-ins: treesloth01, Noise 4D

number_slider = Slider(100, range=0..100)
number_slider_2 = Slider(50, range=0..100)
planesrf = PlaneSurface(Plane=PlaneXY(0, 0, 0), XSize=number_slider, YSize=number_slider)
sdivide = DivideSurface(Surface=planesrf, UCount=number_slider_2, VCount=number_slider_2)  # -> Points, Normals, Parameters
pop2d = Populate2D(Region=planesrf, Count=Slider(7, range=0..100), Seed=1)
flatten = FlattenTree(Tree=sdivide.Points, Path="{0}")
number_slider_3 = Slider(5.9, range=0..10)
pull = PullPoint(Point=flatten, Geometry=pop2d, ClosestOnly=True)  # -> ClosestPoint, Distance
bnd = Bounds(Numbers=pull.Distance)
perlin = PerlinNoise(Values=flatten, Time=Slider(0, range=0..1), Scale=Slider(0.714, range=0..1))
neg = Negative(Value=number_slider_3)
remap = RemapNumbers(Value=pull.Distance, Source=bnd, Target=Slider(27, range=0..100))  # -> Mapped, Clipped
remap_2 = RemapNumbers(Value=pull.Distance, Source=bnd, Target=Domain(0, 1))  # -> Mapped, Clipped
bnd_2 = Bounds(Numbers=perlin)
dom = ConstructDomain(DomainStart=neg, DomainEnd=number_slider_3)
remap_3 = RemapNumbers(Value=perlin, Source=bnd_2, Target=dom)  # -> Mapped, Clipped
multiplication = Multiplication(A=remap_3.Mapped, B=remap_2.Mapped)
addition = Addition(A=multiplication, B=remap.Mapped)
Z = UnitZ(Factor=addition)
move = Move(Geometry=flatten, Motion=Z)  # -> Geometry, Transform
addition_2 = Addition(A=number_slider_2, B=1)
srfgrid = SurfaceFromPoints(Points=move.Geometry, UCount=addition_2, Interpolate=False)
bbox = BoundingBox(Content=srfgrid, Plane=PlaneXY(0, 0, 0))  # -> Box, Box_2
area = Area(Geometry=bbox.Box)  # -> Area, Centroid
preview = CustomPreview(
    Geometry=srfgrid,
    Shader={ambient=RGB(0, 0, 0), diffuse=RGB(255, 105, 180), emission=RGB(76, 32, 54), shine=0.5, specular=RGB(255, 255, 255), transparency=0})
scale_nu = ScaleNU(Geometry=bbox.Box, Plane=area.Centroid, ScaleX=1, ScaleY=1, ScaleZ=Slider(2, range=0..10))  # -> Geometry, Transform
box_corners = BoxCorners(Box=scale_nu.Geometry)  # -> CornerA, CornerB, CornerC, CornerD, CornerE, CornerF, CornerG, CornerH
debrep = DeconstructBrep(Brep=scale_nu.Geometry)  # -> Faces, Edges, Vertices
pdecon = Deconstruct(Point=box_corners.CornerA)  # -> XComponent, YComponent, ZComponent
pdecon_2 = Deconstruct(Point=box_corners.CornerE)  # -> XComponent, YComponent, ZComponent
area_2 = Area(Geometry=debrep.Faces)  # -> Area, Centroid
dom_2 = ConstructDomain(DomainStart=pdecon.ZComponent, DomainEnd=pdecon_2.ZComponent)
pdecon_3 = Deconstruct(Point=area_2.Centroid)  # -> XComponent, YComponent, ZComponent
sort = SortList(Keys=pdecon_3.ZComponent, ValuesA=debrep.Faces)  # -> Keys, ValuesA
range = Range(Domain=dom_2, Steps=Slider(30, range=0..100))
subset = SubList(List=range, Domain=Domain(0, 1), Wrap=True)  # -> simplify(graft(List)), Index
first_last = FirstLast(List=sort.ValuesA)  # -> FirstValue, LastValue
pt = ConstructPoint(XCoordinate=0, YCoordinate=0, ZCoordinate=range)
edges = BrepEdges(Brep=srfgrid)  # -> Naked, Interior, NonManifold
edges_2 = BrepEdges(Brep=first_last.LastValue)  # -> Naked, Interior, NonManifold
edges_3 = BrepEdges(Brep=first_last.FirstValue)  # -> Naked, Interior, NonManifold
bang = ExplodeTree(Data=subset.List)  # -> Branch0, Branch1
join = JoinCurves(Curves=edges.Naked, Preserve=False)
join_2 = JoinCurves(Curves=edges_2.Naked, Preserve=False)
join_3 = JoinCurves(Curves=edges_3.Naked, Preserve=False)
subtraction = Subtraction(A=bang.Branch1, B=bang.Branch0)
Z_2 = UnitZ(Factor=subtraction)
merge = Merge(Data1=join_3, Data2=join)  # -> flatten(Result)
merge_2 = Merge(Data1=join_2, Data2=join)  # -> flatten(Result)
subtraction_2 = Subtraction(A=subtraction, B=Slider(0.001, range=0..0.001))
loft = Loft(Curves=merge, Options={Adjust=False, Closed=False, LoftEnds=0, LoftSimp=0, LoftType=0, Rebuild=10, Refit=0.01})
loft_2 = Loft(Curves=merge_2, Options={Adjust=False, Closed=False, LoftEnds=0, LoftSimp=0, LoftType=0, Rebuild=10, Refit=0.01})
Z_3 = UnitZ(Factor=subtraction_2)
merge_3 = Merge(Data1=srfgrid, Data2=loft, Data3=first_last.FirstValue)  # -> flatten(Result)
merge_4 = Merge(Data1=loft_2, Data2=first_last.LastValue, Data3=srfgrid)  # -> flatten(Result)
join_4 = BrepJoin(Breps=merge_3)  # -> Breps, Closed
join_5 = BrepJoin(Breps=merge_4)  # -> Breps, Closed
xy = XYPlane(Origin=pt)
sec = BrepPlane(Brep=join_4.Breps, Plane=xy)  # -> simplify(Curves), Points
sec_2 = BrepPlane(Brep=join_5.Breps, Plane=xy)  # -> simplify(Curves), Points
boundary = BoundarySurfaces(Edges=sec_2.Curves)
boundary_2 = BoundarySurfaces(Edges=sec.Curves)
extr = Extrude(Base=boundary_2, Direction=Z_2)
extr_2 = Extrude(Base=boundary, Direction=Z_3)  # -> simplify(Extrusion)
move_2 = Move(Motion=Vector(0, 0, 10))  # -> Geometry, Transform
prune = PruneTree(Tree=extr_2, Minimum=1, Maximum=0)
preview_2 = CustomPreview(Geometry=extr, Shader=ColourSwatch(SwatchColor=RGB(140, 98, 53)))
group = Group(Objects=prune)  # -> flatten(Group)
lng = ListLength(List=group)  # -> expr("x-1", Length)
range_2 = Range(Domain=Domain(0, 1), Steps=lng)
gradient = Gradient(LowerLimit=0, UpperLimit=1, Parameter=range_2, stops=[0: RGBA(26, 41, 143, 61), 1: RGBA(130, 253, 255, 7)])
preview_3 = CustomPreview(Geometry=group, Shader=gradient)
