# Grasshopper definition Inflated Diamond.ghx (Grasshopper 0.9.76)

number_slider = Slider(6, range=0..10)
dom = ConstructDomain(DomainStart=Slider(35, range=0..100), DomainEnd=Slider(100, range=0..100))
random = Random(Range=dom, Number=number_slider, Seed=Slider(7, range=0..100))
series = Series(Start=0, Step=Slider(47, range=0..100), Count=number_slider)
number_slider_2 = Slider(15, range=0..20)
number_slider_3 = Slider(18, range=0..20)
cir = Circle(Plane=PlaneXY(0, 0, 0), Radius=random)
Z = UnitZ(Factor=series)
move = Move(Geometry=cir, Motion=Z)  # -> Geometry, Transform
mod = Modulus(A=number_slider_2, B=2)
mod_2 = Modulus(A=number_slider_3, B=2)
loft = Loft(Curves=move.Geometry, Options={Adjust=False, Closed=False, LoftEnds=0, LoftSimp=0, LoftType=0, Rebuild=10, Refit=0.01})
addition = Addition(A=number_slider_2, B=mod)
addition_2 = Addition(A=number_slider_3, B=mod_2)
sdivide = DivideSurface(Surface=loft, UCount=addition, VCount=addition_2)  # -> simplify(Points), Normals, Parameters
pline = PolyLine(Vertices=sdivide.Points, Closed=False)  # -> simplify(Polyline)
flatten = FlattenTree(Tree=pline, Path="{0}")
makepair = MakePair(x=flatten)  # -> out, simplify(A); inputs x: tree, loop: Boolean
# ---------- makepair: C# ----------
    DataTree<object> tree = new DataTree<object>();
    for(int i = 0; i < x.BranchCount; i++){
      List<object> planes = x.Branches[i];
      GH_Path pathO = x.Paths[i];
      int[] sample = new int[pathO.Length + 1];

      for(int t = 0; t < pathO.Length - 1; t++){
        sample[t] = pathO[t];
      }


      for(int n = 0; n < x.Branches[i].Count; n++){
        sample[pathO.Length - 1] = i;
        sample[pathO.Length] = n;

        GH_Path path = new GH_Path(sample);
        if(n < x.Branches[i].Count - 1){
          tree.Add(planes[n], path);
          tree.Add(planes[n + 1], path);
        }else if(loop){
          tree.Add(planes[x.Branches[i].Count - 1], path);
          tree.Add(planes[0], path);
        }

      }
    }

    A = tree;
# ---------- end makepair ----------
tstat = TreeStatistics(Tree=makepair.A)  # -> Paths, Length, Count
lng = ListLength(List=tstat.Paths)
group = Group(Objects=makepair.A)  # -> flatten(Group)
series_2 = Series(Start=0, Step=1, Count=lng)
mod_3 = Modulus(A=series_2, B="2")
dispatch = Dispatch(List=group, DispatchPattern=mod_3)  # -> ListA, ListB
ungroup = Ungroup(Group=dispatch.ListB)
rev = ReverseList(List=ungroup)  # -> simplify(List)
group_2 = Group(Objects=rev)  # -> flatten(Group)
weave = Weave(Pattern=[0, 1], Stream0=flatten(dispatch.ListA), Stream1=group_2, NullGaps=False)
ungroup_2 = Ungroup(Group=weave)  # -> simplify(Objects)
item = ListItem(List=ungroup_2, Index=1, Wrap=True)
item_2 = ListItem(List=ungroup_2, Index=0, Wrap=True)
explode = Explode(Curve=item, Recursive=True)  # -> simplify(Segments), Vertices
explode_2 = Explode(Curve=item_2, Recursive=True)  # -> simplify(Segments), Vertices
lng_2 = ListLength(List=explode.Segments)
lng_3 = ListLength(List=explode_2.Segments)
end = EndPoints(Curve=explode_2.Segments)  # -> Start, End
series_3 = Series(Start=0, Step=1, Count=lng_2)
end_2 = EndPoints(Curve=explode.Segments)  # -> Start, End
series_4 = Series(Start=0, Step=1, Count=lng_3)
mod_4 = Modulus(A=series_3, B="2")
mod_5 = Modulus(A=series_4, B="2")
dispatch_2 = Dispatch(List=end.Start, DispatchPattern=mod_5)  # -> ListA, ListB
dispatch_3 = Dispatch(List=end.End, DispatchPattern=mod_5)  # -> ListA, ListB
dispatch_4 = Dispatch(List=end_2.Start, DispatchPattern=mod_4)  # -> ListA, ListB
dispatch_5 = Dispatch(List=end_2.End, DispatchPattern=mod_4)  # -> ListA, ListB
weave_2 = Weave(Pattern=[0, 1], Stream0=dispatch_5.ListB, Stream1=dispatch_4.ListA, NullGaps=False)
weave_3 = Weave(Pattern=[0, 1], Stream0=dispatch_2.ListB, Stream1=dispatch_3.ListA, NullGaps=False)
extr = ExtrudePoint(Base=explode_2.Segments, Point=weave_2)
extr_2 = ExtrudePoint(Base=explode.Segments, Point=weave_3)
flatten_2 = FlattenTree(Tree=extr, Path="{0}")
flip = Flip(Surface=flatten_2)  # -> Surface, Result
flatten_3 = FlattenTree(Tree=extr_2, Path="{0}")
join = BrepJoin(Breps=flip.Surface)  # -> Breps, Closed
join_2 = BrepJoin(Breps=flatten_3)  # -> Breps, Closed
merge = Merge(Data1=join_2.Breps, Data2=join.Breps)
edges = BrepEdges(Brep=merge)  # -> Naked, Interior, NonManifold
crv = Curve(simplify(edges.Naked))
join_3 = JoinCurves(Curves=crv, Preserve=False)
explode_3 = Explode(Curve=join_3, Recursive=True)  # -> Segments, Vertices
bbox = BoundingBox(Content=crv, Plane=PlaneXY(0, 0, 0), UnionBox=True)  # -> Box, Box_2
srf = Surface(reparameterize(loft))
area = Area(Geometry=bbox.Box)  # -> Area, simplify(Centroid)
dispatch_6 = Dispatch(List=explode_3.Segments, DispatchPattern=[True, False])  # -> simplify(ListA), ListB
srf_cp = SurfaceClosestPoint(Point=area.Centroid, Surface=srf)  # -> Point, UVPoint, Distance
evalsrf = EvaluateSurface(Surface=srf, Point=srf_cp.UVPoint)  # -> Point, Normal, Frame
midpoint = MidPoint(crv=dispatch_6.ListB)
midpoint_2 = MidPoint(crv=dispatch_6.ListA)
neg = Negative(Value=evalsrf.Normal)
item_3 = ListItem(List=midpoint, Index=0, Wrap=True)
item_4 = ListItem(List=midpoint_2, Index=0, Wrap=True)
item_5 = ListItem(List=midpoint, Index=1, Wrap=True)
item_6 = ListItem(List=midpoint_2, Index=1, Wrap=True)
amp = Amplitude(Vector=neg, Amplitude=Slider(6.83, range=0..10))
move_2 = Move(Geometry=area.Centroid, Motion=amp)  # -> simplify(Geometry), Transform
arc = Arc3Pt(PointA=item_3, PointB=move_2.Geometry, PointC=item_5)  # -> simplify(Arc), Plane, Radius
arc_2 = Arc3Pt(PointA=item_4, PointB=move_2.Geometry, PointC=item_6)  # -> Arc, Plane, Radius
crv_2 = Curve(dispatch_6.ListB)
crv_3 = Curve(dispatch_6.ListA)
weave_4 = Weave(Pattern=[0, 1], Stream0=dispatch_6.ListA, Stream1=move_2.Geometry, NullGaps=False)
pdecon = Deconstruct(Point=move_2.Geometry)  # -> XComponent, YComponent, ZComponent
weave_5 = Weave(Pattern=[0, 1], Stream0=crv_3, Stream1=arc.Arc, NullGaps=False)  # -> simplify(Weave)
weave_6 = Weave(Pattern=[0, 1], Stream0=crv_2, Stream1=arc_2.Arc, NullGaps=False)  # -> simplify(Weave)
bnd = Bounds(Numbers=flatten(pdecon.ZComponent))
netsurf = NetworkSurface(CurvesU=weave_6, CurvesV=weave_5, Continuity=2)
remap = RemapNumbers(Value=pdecon.ZComponent, Source=bnd, Target=Domain(0, 1))  # -> Mapped, Clipped
gradient = Gradient(LowerLimit=0, UpperLimit=1, Parameter=remap.Mapped, stops=[0.15: RGB(255, 144, 0), 0.85: RGB(255, 231, 191)])
preview = CustomPreview(Geometry=netsurf, Shader=gradient)

# ==== cluster MidPoint: Middle Point of Curve
crv = ClusterInput()
num = Number(0.5)
eval = EvaluateLength(Curve=crv, Length=num, Normalized=True)  # -> Point, Tangent, Parameter
pt = ClusterOutput(eval.Point)
