# Grasshopper definition Complex Shelf.ghx (Grasshopper 0.9.76)
# plug-ins: Kangaroo Components

number_slider = Slider(5, range=0..10)
sqgrid = Square(Plane=PlaneXY(0, 0, 0), Size=Slider(10, range=0..10), ExtentX=number_slider, ExtentY=number_slider)  # -> simplify(Cells), Points
number_slider_2 = Slider(13, range=0..100)
group = Group(Objects=sqgrid.Cells)
flatten = FlattenTree(Tree=group, Path="{0}")
dispatch = Dispatch(List=flatten, DispatchPattern=[True, False])  # -> ListA, ListB
series = Series(Start=0, Step=number_slider_2, Count=Slider(5, range=0..10))
geo = Geometry(dispatch.ListA)
Z = UnitZ(Factor=series)
graft = GraftTree(Tree=Z, IncludeEmptyLists=True, IncludeNullItems=True)
move = Move(Geometry=geo, Motion=graft)  # -> simplify(Geometry), Transform
bbox = BoundingBox(Content=move.Geometry, Plane=PlaneXY(0, 0, 0), UnionBox=True)  # -> Box, Box_2
tstat = TreeStatistics(Tree=bbox.Box)  # -> Paths, Length, Count
lng = ListLength(List=tstat.Paths)
area = Area(Geometry=bbox.Box)  # -> Area, Centroid
series_2 = Series(Start=0, Step=1, Count=lng)
rad = Radians(Degrees="90")
mod = Modulus(A=series_2, B="2")
multiplication = Multiplication(A=rad, B=mod)  # -> graft(Result)
rotate = Rotate(Geometry=move.Geometry, Angle=multiplication, Plane=area.Centroid)  # -> simplify(Geometry), Transform
ungroup = Ungroup(Group=rotate.Geometry)
number_slider_3 = Slider(724, range=0..1000)
tstat_2 = TreeStatistics(Tree=ungroup)  # -> Paths, Length, Count
lng_2 = ListLength(List=tstat_2.Paths)
lng_3 = ListLength(List=ungroup)
series_3 = Series(Start=number_slider_3, Step=number_slider_3, Count=lng_2)
unflatten = UnflattenTree(Tree=series_3, Guide=lng_3)
random = Random(Range=Domain(0, 1), Number=lng_3, Seed=unflatten)  # -> simplify(Random)
smaller = SmallerThan(FirstNumber=random, SecondNumber=Slider(0.81, range=0..1))  # -> SmallerThan, OrEqualTo
cull = CullPattern(List=ungroup, CullPattern=smaller.SmallerThan)
runion = RegionUnion(Curves=cull)
bbox_2 = BoundingBox(Content=runion, Plane=PlaneXY(0, 0, 0))  # -> Box, Box_2
debrep = DeconstructBrep(Brep=bbox_2.Box)  # -> simplify(Faces), Edges, Vertices
crv = Curve(debrep.Faces)
num = Number(number_slider_2)
explode = Explode(Curve=crv, Recursive=True)  # -> Segments, Vertices
duppt = RemoveDuplicatePts(Points=explode.Vertices, Tolerance=0.01)  # -> simplify(UniquePoints)
xy = XYPlane(Origin=Point(0, 0, 0))
project = Project(Geometry=duppt, Plane=xy)  # -> Geometry, Transform
ln = Line(StartPoint=duppt, EndPoint=project.Geometry)
len = Length(Curve=ln)
larger = LargerThan(FirstNumber=len, SecondNumber=Slider(0.01, range=0..0.01))  # -> LargerThan, OrEqualTo
cull_2 = CullPattern(List=ln, CullPattern=larger.LargerThan)
prune = PruneTree(Tree=cull_2, Minimum="1", Maximum=0)
crv_2 = Curve(reparameterize(prune))
divlength = DivideLength(Curve=crv_2, Length=num)  # -> Points, Tangents, Parameters
shatter = Shatter(Curve=crv_2, Parameters=divlength.Parameters)  # -> flatten(Segments)
dupln = RemoveDuplicateLines(Lines=shatter, Tolerance=0.01)
boundary = BoundarySurfaces(Edges=runion)
area_2 = Area(Geometry=boundary)  # -> Area, Centroid
pdecon = Deconstruct(Point=area_2.Centroid)  # -> XComponent, YComponent, ZComponent
Z_2 = UnitZ(Factor=Slider(0.5, range=0..1))
bnd = Bounds(Numbers=flatten(pdecon.ZComponent))
pipe = Pipe(Curve=dupln, Radius=Slider(0.2, range=0..1), Caps=0)
extr = Extrude(Base=boundary, Direction=Z_2)
remap = RemapNumbers(Value=pdecon.ZComponent, Source=bnd, Target=Domain(0, 1))  # -> Mapped, Clipped
gradient = Gradient(LowerLimit=0, UpperLimit=1, Parameter=remap.Mapped, stops=[0.15: RGB(130, 94, 35), 0.85: RGB(207, 140, 33)])
preview = CustomPreview(Geometry=pipe, Shader=ColourSwatch(SwatchColor=RGB(143, 143, 143)))
preview_2 = CustomPreview(Geometry=extr, Shader=gradient)
