# Grasshopper definition Mystery Circle.ghx (Grasshopper 0.9.76)
# plug-ins: MeshEdit Components

number_slider = Slider(1000, range=0..1000)
number_slider_2 = Slider(15, range=0..100)
number_slider_3 = Slider(200, range=0..200)
rectangle = Rectangle(Plane=PlaneXY(0, 0, 0), XSize=number_slider, YSize=number_slider, Radius=0)  # -> Rectangle, Length
boundary = BoundarySurfaces(Edges=rectangle.Rectangle)
pop2d = Populate2D(Region=rectangle.Rectangle, Count=number_slider_2, Seed=1)
dom = ConstructDomain(DomainStart=Slider(150, range=0..1000), DomainEnd=Slider(300, range=0..1000))
sdivide = DivideSurface(Surface=boundary, UCount=number_slider_3, VCount=number_slider_3)  # -> Points, Normals, Parameters
graft = GraftTree(Tree=pop2d, IncludeEmptyLists=True, IncludeNullItems=True)  # -> simplify(Tree)
flatten = FlattenTree(Tree=sdivide.Points, Path="{0}")
random = Random(Range=dom, Number=number_slider_2, Seed=2)
dist = Distance(PointA=graft, PointB=flatten)
num = Number(random)
flip = FlipMatrix(Data=dist)
min = Minimum(A=flip, B=num)
mm = MassMultiplication(Input=min)  # -> Result, PartialResults
bnd = Bounds(Numbers=flatten(mm.Result))
pi = Pi(Factor=Slider(15, range=0..20))
remap = RemapNumbers(Value=mm.Result, Source=bnd, Target=pi)  # -> Mapped, Clipped
sin = Sine(Value=remap.Mapped)
bnd_2 = Bounds(Numbers=flatten(sin))
remap_2 = RemapNumbers(Value=sin, Source=bnd_2, Target=Slider(58, range=0..100))  # -> Mapped, Clipped
flatten_2 = FlattenTree(Tree=remap_2.Mapped, Path="{0}")
addition = Addition(A=number_slider_3, B=1)
Z = UnitZ(Factor=flatten_2)
move = Move(Geometry=flatten, Motion=Z)  # -> Geometry, Transform
frompoints = MeshFromPoints(Points=move.Geometry, UDirection=addition, VDirection=addition)
srfgrid = SurfaceFromPoints(Points=move.Geometry, UCount=addition, Interpolate=False)
demesh = DeconstructMesh(Mesh=frompoints)  # -> Vertices, Faces, Colours, Normals
panel = Panel(frompoints)
preview = CustomPreview(
    Geometry=srfgrid,
    Shader={ambient=RGB(0, 0, 0), diffuse=RGB(255, 105, 180), emission=RGB(76, 32, 54), shine=0.5, specular=RGB(255, 255, 255), transparency=0})
pdecon = Deconstruct(Point=demesh.Vertices)  # -> XComponent, YComponent, ZComponent
bnd_3 = Bounds(Numbers=pdecon.ZComponent)
bnd_4 = Bounds(Numbers=pdecon.YComponent)
preview_2 = CustomPreview(
    Geometry=frompoints,
    Shader={ambient=RGB(0, 0, 0), diffuse=RGB(255, 105, 180), emission=RGB(76, 32, 54), shine=0.5, specular=RGB(255, 255, 255), transparency=0})
remap_3 = RemapNumbers(Value=pdecon.ZComponent, Source=bnd_3, Target=Domain(0, 1))  # -> Mapped, Clipped
remap_4 = RemapNumbers(Value=pdecon.YComponent, Source=bnd_4, Target=Domain(0, 1))  # -> Mapped, Clipped
gradient = Gradient(LowerLimit=0, UpperLimit=1, Parameter=remap_4.Mapped, stops=[0: RGB(10, 0, 0), 1: RGB(184, 147, 0)])
gradient_2 = Gradient(LowerLimit=0, UpperLimit=1, Parameter=remap_3.Mapped, stops=[0: RGB(92, 92, 92), 1: RGB(230, 57, 57)])
addition_2 = Addition(A=gradient, B=gradient_2)
mcol = MeshColours(Mesh=frompoints, Colours=addition_2)
